# Grasshopper definition Dataset generation script.gh (Grasshopper 1.0.8)
# plug-ins: RhinoCodePluginGH, Heteroptera, MeshEdit Components, Human UI, Pufferfish, ClipperComponents, Human, LunchBox, Weaverbird, MetaHopper, Kangaroo2 Components, Nautilus

# ----
# test
# Activate the recorder at th end of the script
number_slider = Slider(4, range=0..10)

number_slider_2 = Slider(404, range=0..1000)

# ----
# generate
number_slider_3 = Slider(204, range=0..1000)

tap_buffer = TapBuffer(Reset=False, Incremental=True, Valve=Slider(40000, range=0..100000), CounterTarget=Slider(604, range=0..1000), Hold=True)

# ----
# place them manually then set them here
points = Point([<point referenced from the Rhino model> x101])

# ----
# Am I using an external plugin?
toggle = BooleanToggle(False)
project = Project(Geometry=points, Plane=PlaneXY(0, 0, 0))  # -> Geometry, Transform
dependencies = GhPythonScript(Find=toggle)  # -> Dep; inputs Find: Boolean
# ---------- dependencies: Python ----------
import Grasshopper as gh
if Find:

    asms = {}
    
    for obj in ghenv.Component.OnPingDocument().Objects:
        asm = gh.Instances.ComponentServer.FindAssemblyByObject(obj.ComponentGuid)

        if asm is not None and not asm.IsCoreLibrary:
            asms[asm.Name]=asm.Version
    
    
    if len(asms)==1: Dep= "No dependencies aparently... You are good"
    else: Dep = asms
    

    ghenv.Component.ExpireSolution(True)
    
else:
    Dep= "Toggle Find  to check"
# ---------- end dependencies ----------
oil_can = OilCan(DataList=project.Geometry, Reset=False, Drop=tap_buffer, DropMode=0)
panel = Panel(dependencies)
number_slider_4 = Slider(120, range=0..1000)

series = Series(Start=Slider(60, range=60..120), Step=Slider(5, range=0..100), Count=Slider(12, range=0..100))
oil_can_2 = OilCan(DataList=series, Reset=False, Drop=tap_buffer, DropMode=0)

circle = Circle(Plane=oil_can, Radius=oil_can_2)

shrimp_read_geojson = ShrimpGISReadGeojson(geojson_file="C:\Users\Aly Mahmoud\Downloads\chembur streets.geojson", run_it=Toggle(True))  # -> out, field, type, geometry; inputs run_it: Boolean; plug-in component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
geometry = Geometry(shrimp_read_geojson.geometry)
polyline_offset = PolylineOffset(
    Polylines=geometry,
    Distance=Slider(2, range=0..10),
    Plane=Plane(origin=(0, 0, 0), x=(0, 0, 0), y=(0, 0, 0)),
    Tolerance=0.01,
    ClosedFillet=1,
    OpenFillet=1,
    Miter=2)  # -> Contour, Holes
center = Center(Geometry=flatten(polyline_offset.Contour))  # -> Center, Dimension
divide_curve = DivideCurve(Curve=circle, Count=10, Kinks=False)  # -> Points, Tangents, Parameters
distance = Distance(PointA=center.Center, PointB=divide_curve.Points)
smaller_than = SmallerThan(FirstNumber=distance, SecondNumber=Slider(550, range=0..550))  # -> SmallerThan, OrEqualTo
cull_pattern = CullPattern(List=flatten(polyline_offset.Contour), CullPattern=smaller_than.SmallerThan)
cull_pattern_2 = CullPattern(List=flatten(polyline_offset.Contour), CullPattern=invert(smaller_than.SmallerThan))
region_union = RegionUnion(Curves=cull_pattern)
custom_preview_lineweights = CustomPreviewLineweights(Geometry=cull_pattern_2, Shader=ColourSwatch(SwatchColor=RGB(0, 0, 0)), Absolute=False)
boundary_surfaces = BoundarySurfaces(Edges=region_union)
brep_curve = BrepCurve(Brep=boundary_surfaces, Curve=circle)  # -> flatten(Curves), Points
surface_split = SurfaceSplit(Surface=boundary_surfaces, Curves=brep_curve.Curves)  # -> flatten(Fragments)
custom_preview_lineweights_2 = CustomPreviewLineweights(Geometry=geometry, Shader=ColourSwatch(SwatchColor=RGB(125, 125, 125)), Absolute=False)

file_path = FilePath("C:\Users\Aly Mahmoud\Downloads\tardeo green.geojson")
shrimp_read_geojson_2 = ShrimpGISReadGeojson(geojson_file=file_path, run_it=Toggle(True))  # -> out, field, type, geometry; inputs run_it: Boolean; plug-in component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
geometry_2 = Geometry(shrimp_read_geojson_2.geometry)
center_2 = Center(Geometry=flatten(geometry_2))  # -> Center, Dimension
point_in_curve = PointInCurve(Point=center_2.Center, Curve=circle)  # -> Relationship, Point
cull_pattern_3 = CullPattern(List=flatten(geometry_2), CullPattern=point_in_curve.Relationship)
cull_pattern_4 = CullPattern(List=flatten(geometry_2), CullPattern=invert(point_in_curve.Relationship))
colour_swatch = ColourSwatch(SwatchColor=RGB(76, 138, 0))
colour_swatch_2 = ColourSwatch(SwatchColor=RGB(0, 0, 0))
custom_preview_lineweights_3 = CustomPreviewLineweights(Geometry=cull_pattern_3, Shader=colour_swatch, Absolute=False)
custom_preview_lineweights_4 = CustomPreviewLineweights(Geometry=cull_pattern_4, Shader=colour_swatch, Absolute=False)

geometry_3 = Geometry(flatten(shrimp_read_geojson.geometry))
join_curves = JoinCurves(Curves=geometry_3, Preserve=False)
end_points = EndPoints(Curve=join_curves)  # -> Start, End
merge = Merge(Data1=end_points.Start, Data2=end_points.End)
removeduplicatepts = RemoveDuplicatePts(Points=flatten(merge), Tolerance=0.01)
number_slider_5 = Slider(30, range=0..100)
multiplication = Multiplication(A=number_slider_5, B=0.7)

# ----
# 9 meters for buildings that are 3 floors high
number_slider_6 = Slider(11.7, range=0..20)

point_in_curve_2 = PointInCurve(Point=removeduplicatepts, Curve=circle)  # -> Relationship, Point
cull_pattern_5 = CullPattern(List=point_in_curve_2.Point, CullPattern=point_in_curve_2.Relationship)
unit_z = UnitZ(Factor=Slider(6, range=0..10))
move = Move(Geometry=oil_can, Motion=unit_z)  # -> Geometry, Transform

shift_list = ShiftList(List=cull_pattern_5, Shift=1, Wrap=True)
pull_point = PullPoint(Point=graft(cull_pattern_5), Geometry=graft(shift_list), ClosestOnly=True)  # -> ClosestPoint, flatten(Distance)
point_groups = PointGroups(Points=cull_pattern_5, Distance=Slider(14, range=8..35))  # -> Groups, Indices
smaller_than_2 = SmallerThan(FirstNumber=pull_point.Distance, SecondNumber=number_slider_5)  # -> SmallerThan, OrEqualTo
param_viewer = ParamViewer(point_groups.Groups)
prune_tree = PruneTree(Tree=point_groups.Groups, Minimum=Slider(2, range=0..10), Maximum=Slider(7, range=0..10))
cull_pattern_6 = CullPattern(List=cull_pattern_5, CullPattern=smaller_than_2.SmallerThan)

panel_2 = Panel("Pitched roof buildings")  # disabled
panel_3 = Panel("Flat roof buildings")  # disabled
query_model_objects = QueryModelObjects(Layer=panel_3, Locked=True, Hidden=True, AutoUpdateState=True)  # disabled
query_model_objects_2 = QueryModelObjects(Layer=panel_2, Locked=True, Hidden=True, AutoUpdateState=True)  # disabled
panel_4 = Panel("switch")  # disabled
model_object = ModelObject(Object=query_model_objects, Layer=panel_3)  # -> Object, Geometry, Name, Layer, Visibility, Display, Drafting, Render; disabled
model_object_2 = ModelObject(Object=query_model_objects_2, Layer=panel_2)  # -> Object, Geometry, Name, Layer, Visibility, Display, Drafting, Render; disabled
create_button = CreateButton(ButtonName=panel_4, ButtonStyle=0)  # disabled
sort_objects_by_type = SortObjectsByType(RhinoObjects=model_object.Geometry)  # -> Points, Curves, Surfaces, Breps, Meshes, TextObjects, HatchObjects, LightObjects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; disabled
sort_objects_by_type_2 = SortObjectsByType(RhinoObjects=model_object_2.Geometry)  # -> Points, Curves, Surfaces, Breps, Meshes, TextObjects, HatchObjects, LightObjects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; disabled
value_listener = ValueListener(Elements=create_button, SomeProperty=True)  # -> Values, Indices; disabled
brep = Brep(sort_objects_by_type_2.Breps)  # disabled

# ----
# Staircase room
volume = Volume()  # -> Volume, Centroid
larger_than = LargerThan(FirstNumber=volume.Volume, SecondNumber=Slider(711, range=0..1000))  # -> LargerThan, OrEqualTo
cull_pattern_7 = CullPattern(CullPattern=larger_than.LargerThan)

number_slider_7 = Slider(59, range=0..100)

cap_holes = CapHoles(Brep=brep)  # disabled
center_3 = Center(Geometry=sort_objects_by_type.Breps)  # -> Center, Dimension; disabled
center_4 = Center(Geometry=brep)  # -> Center, Dimension; disabled
point_in_curve_3 = PointInCurve(Point=center_3.Center, Curve=circle)  # -> Relationship, Point; disabled
point_in_curve_4 = PointInCurve(Point=center_4.Center, Curve=circle)  # -> Relationship, Point; disabled
cull_pattern_8 = CullPattern(List=sort_objects_by_type.Breps, CullPattern=point_in_curve_3.Relationship)  # disabled
cull_pattern_9 = CullPattern(List=brep, CullPattern=point_in_curve_4.Relationship)  # disabled
cap_holes_2 = CapHoles(Brep=cull_pattern_8)  # disabled

cull_pattern_10 = CullPattern(List=brep, CullPattern=invert(point_in_curve_4.Relationship))  # disabled
cull_pattern_11 = CullPattern(List=sort_objects_by_type.Breps, CullPattern=invert(point_in_curve_3.Relationship))  # disabled
colour_swatch_3 = ColourSwatch(SwatchColor=RGB(158, 158, 158))  # disabled
panel_5 = Panel("""False
True
True
True""")
custom_preview_lineweights_5 = CustomPreviewLineweights(Geometry=[cull_pattern_11, cull_pattern_10], Shader=colour_swatch_3, Thickness=0.2, Absolute=False)  # disabled
number_slider_8 = Slider(14, range=0..100)
boundary_surfaces_2 = BoundarySurfaces(Edges=circle)

# ----
# Green roof %
green_roof_percentage = Slider(10, range=0..100)

green_roof_percentage_2 = Slider(100, range=0..100)
green_roof_percentage_3 = Slider(5, range=0..100)
construct_domain = ConstructDomain(DomainStart=green_roof_percentage_3, DomainEnd=green_roof_percentage_2)
range = Range(Domain=construct_domain, Steps=Slider(20, range=0..100))
oil_can_3 = OilCan(DataList=range, Reset=False, Drop=tap_buffer, DropMode=1)
division = Division(A=oil_can_3, B=100)
area = Area(Geometry=circle)  # -> Area, Centroid

# ----
# grid size
grid_size = Slider(2.4, range=0.5..3)

saturated_soil_density_per_m3 = Panel("1300")
saturated_soil_density_per_m3_2 = Panel("1450")
saturated_soil_density_per_m3_3 = Panel("1200")
saturated_soil_density_per_m3_4 = Panel("1350")
saturated_soil_density_per_m3_5 = Panel("1300")
saturated_soil_density_per_m3_6 = Panel("1400")
saturated_soil_density_per_m3_7 = Panel("1550")
saturated_soil_density_per_m3_8 = Panel("1700")
saturated_soil_density_per_m3_9 = Panel("1400")
saturated_soil_density_per_m3_10 = Panel("1100")
saturated_soil_density_per_m3_11 = Panel("675")
saturated_soil_density_per_m3_12 = Panel("700")
saturated_soil_density_per_m3_13 = Panel("920")
oil_can_4 = OilCan(
    DataList=[saturated_soil_density_per_m3_12, saturated_soil_density_per_m3_11, saturated_soil_density_per_m3_13],
    Reset=False,
    Drop=tap_buffer,
    DropMode=1)
oil_can_5 = OilCan(
    DataList=[saturated_soil_density_per_m3_9, saturated_soil_density_per_m3_10, saturated_soil_density_per_m3_6, saturated_soil_density_per_m3_4, saturated_soil_density_per_m3, saturated_soil_density_per_m3_2, saturated_soil_density_per_m3_5, saturated_soil_density_per_m3_3, saturated_soil_density_per_m3_7, saturated_soil_density_per_m3_8],
    Reset=False,
    Drop=tap_buffer,
    DropMode=1)
python_3_script = Python3Script(density=oil_can_4)  # -> out, a; inputs density: Int32
# ---------- python_3_script: Python ----------
def get_material(density):
    if density == 675:
        return "coco peat"
    elif density == 700:
        return "Pumice"
    elif density == 920:
        return "sedum Extensive"
    else:
        return "Unknown material"
a = get_material(density)
# ---------- end python_3_script ----------
panel_6 = Panel(python_3_script.a)
python_3_script_2 = Python3Script(density=oil_can_5)  # -> out, a; inputs density: Int32
# ---------- python_3_script_2: Python ----------
def get_material(density):
    if density == 1400:
        return "EXTENSIVE MINERAL SUBSTRATE"
    elif density == 1100:
        return "EXTENSIVE MINERAL SUBSTRATE LIGHT"
    elif density == 1400:
        return "EXTENSIVE SUBSTRATE"
    elif density == 1350:
        return "EXTENSIVE SUBSTRATE LIGHT"
    elif density == 1300:
        return "EXTENSIVE SUBSTRATE EXTRA LIGHT"
    elif density == 1450:
        return "INTENSIVE SUBSTRATE"
    elif density == 1300:
        return "INTENSIVE SUBSTRATE LIGHT"
    elif density == 1200:
        return "INTENSIVE SUBSTRATE EXTRA LIGHT"
    elif density == 1550:
        return "INTENSIVE PLANT SUBSTRATE"
    elif density == 1700:
        return "INTENSIVE PLANT SUBSTRATE TG"
    else:
        return "Unknown material"
a = get_material(density)
# ---------- end python_3_script_2 ----------
panel_7 = Panel(python_3_script_2.a)
construct_domain_2 = ConstructDomain(DomainStart=Slider(0.04, range=0..0.1), DomainEnd=Slider(0.075, range=0..0.1))
max_rain_fail_in_one_hour = Panel("0.0510")
max_rain_fail_in_one_hour_2 = Panel("0.0460")
max_rain_fail_in_one_hour_3 = Panel("0.0700")
max_rain_fail_in_one_hour_4 = Panel("0.0550")
max_rain_fail_in_one_hour_5 = Panel("0.0653")
max_rain_fail_in_one_hour_6 = Panel("0.0600")
range_2 = Range(Domain=construct_domain_2, Steps=Slider(10, range=0..100))
oil_can_6 = OilCan(DataList=range_2, Reset=False, Drop=tap_buffer, DropMode=1)
saturated_soil_density_per_m3_14 = Panel("800")
saturated_soil_density_per_m3_15 = Panel("900")
saturated_soil_density_per_m3_16 = Panel("1000")
saturated_soil_density_per_m3_17 = Panel("400")
oil_can_7 = OilCan(
    DataList=[saturated_soil_density_per_m3_17, saturated_soil_density_per_m3_15, saturated_soil_density_per_m3_16, saturated_soil_density_per_m3_14],
    Reset=False,
    Drop=tap_buffer,
    DropMode=0)
python_3_script_3 = Python3Script(density=oil_can_7)  # -> out, a; inputs density: Int32
# ---------- python_3_script_3: Python ----------
def get_material(density):
    if density == 400:
        return "Khus or Vetiver"
    elif density == 900:
        return "Bamboo Fiber"
    elif density == 1000:
        return "Coconut Coir"
    elif density == 800:
        return "Hemp Fiber"
    else:
        return "Unknown material"
a = get_material(density)
# ---------- end python_3_script_3 ----------
panel_8 = Panel(python_3_script_3.a)

# ----
# S=1: Perfect balance, all rain is absorbed, no runoff.
# S<1: Insufficient soil absorption, resulting in runoff.
# S>1: Excess soil absorption capacity, no runoff, with room to absorb more water.
max_rain_fail_in_one_hour_7 = Panel(oil_can_6)
division_2 = Division(A=oil_can_7, B=1000)
relay = Relay()
multiplication_2 = Multiplication(A=division_2, B=relay)
division_3 = Division(A=multiplication_2, B=max_rain_fail_in_one_hour_7)
value_list = ValueList({"Min": 0, "Average": 1, "Max": 2}, selected="Max")
average = Average(Input=division_3)
min_max = MinMax(Number=division_3)  # -> Minimum, Maximum
mass_addition = MassAddition(Input=multiplication_2)  # -> Result, PartialResults
water_holding_capacity_for_each_box = Panel(multiplication_2)
stream_filter = StreamFilter(Gate=value_list, Stream0=min_max.Minimum, Stream1=average, Stream2=min_max.Maximum)
water_holding_capacity_total = Panel(mass_addition.Result)
modulus = Modulus(A="1", B=stream_filter)
s_soil_retention_factor = Panel(modulus)

python_3_script_4 = Python3Script(density=oil_can_7)  # -> out, a; inputs density: Int32
# ---------- python_3_script_4: Python ----------
def get_material(density):
    if density == 400:
        return 0.3
    elif density == 900:
        return 0.4
    elif density == 1000:
        return 0.15
    elif density == 800:
        return 0.2
    else:
        return "Unknown material"
a = get_material(density)
# ---------- end python_3_script_4 ----------

get_selected_objects = GetSelectedObjects(AllObjects_Object=[tensile_filling, total_building_roof_area, total_green_roof_area, total_percentage_of_runoff_reduced_by_gr, green_roof_percentage_4, percentage_of_runoff_reduced_by_tensile, green_roof_soil_type, max_rain_fail_in_one_hour_8, total_reduced_run_off_value, total_region_run_off_value, total_region_area, total_run_off_percentage, area_of_tensile])  # -> ComponentObjects, ParamObjects, OtherObjects
param_info = ParamInfo(Param=get_selected_objects.ParamObjects)  # -> Name, NickName, DataType, Pivot, Bounds, Sources, Recipients, Kind
set_panel_properties = SetPanelProperties(Panel=get_selected_objects.ParamObjects, Color=ColourSwatch(SwatchColor=RGB(255, 255, 255)))
panel_9 = Panel(param_info.NickName)

trim_tree = TrimTree(Tree=oil_can_6, Depth=1)
trim_tree_2 = TrimTree(Tree=oil_can_3, Depth=1)
addition = Addition(A=trim_tree_2, B=0)
addition_2 = Addition(A=trim_tree, B=0)
green_roof_soil_type = Panel(python_3_script_2.a)
green_roof_percentage_4 = Panel(addition)
tensile_filling = Panel(python_3_script_3.a)
max_rain_fail_in_one_hour_8 = Panel(addition_2)
second_trial_200_iterations = Data(Tree({0;0}: ["Bamboo Fiber", "5015.483055", "2753.28", "54.9", "80", "26.68", "EXTENSIVE MINERAL SUBSTRATE", "0.0435", "699.084299", "2377.905677", "32515.638429", "29.39916", "275.457449"], {0;1}: ["Coconut Coir", "10397.639503", "5955.84", "57.28", "75", "27.06", "EXTENSIVE MINERAL SUBSTRATE LIGHT", "0.047", "910.421108", "2833.429404", "38027.066738", "32.13142", "654.515178"], {0;2}: ["Hemp Fiber", "7602.130679", "3916.8", "51.52", "70", "27.09", "EXTENSIVE MINERAL SUBSTRATE", "0.0505", "877.205648", "2924.896486", "38611.66209", "29.990998", "780.272385"], {0;3}: ["Khus or Vetiver", "1123.029649", "495.36", "44.11", "65", "28.62", "EXTENSIVE MINERAL SUBSTRATE LIGHT", "0.054", "223.467488", "752.933015", "10656.114025", "29.679597", "671.637482"], {0;4}: ["Bamboo Fiber", "2357.504523", "892.8", "37.87", "60", "27.36", "EXTENSIVE MINERAL SUBSTRATE", "0.0575", "266.085516", "931.166301", "12141.131701", "28.57551", "378.254645"], {0;5}: ["Coconut Coir", "3988.669478", "1393.92", "34.95", "55", "26.99", "EXTENSIVE SUBSTRATE LIGHT", "0.061", "321.457271", "1137.276725", "14390.567846", "28.265528", "302.080444"]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))
first_trial_70_iterations = Data(Tree({0;0}: ["11309.733553", "1711.768036", "149.76", "6.45", "25", "28.11", "600", "0.0435", "202.257798", "779.844247", "10551.777783", "25.935666"], {0;1}: ["13273.228961", "3686.390714", "311.04", "6.22", "30", "27.01", "700", "0.047", "232.868756", "991.909688", "12587.789277", "23.47681"], {0;2}: ["15393.804003", "3686.390714", "311.04", "6.22", "35", "26.91", "400", "0.0505", "267.487144", "1123.459563", "13340.675636", "23.809236"], {0;3}: ["17671.458676", "4009.318188", "334.08", "6.15", "40", "26.84", "300", "0.054", "305.446536", "1279.514887", "15985.786291", "23.872058"], {0;4}: ["20106.192983", "5067.397514", "437.76", "6.37", "45", "27.22", "500", "0.0575", "354.209792", "1478.918437", "18258.288713", "23.950597"], {0;5}: ["22698.006922", "5930.579289", "524.16", "6.52", "50", "27.16", "600", "0.061", "400.086573", "1679.157656", "19685.852268", "23.826624"]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))  # disabled
panel_10 = Panel("G:\Other computers\My Computer\IAAC\Thesis\run off prediction chembur.csv")

shrimp_read_geojson_3 = ShrimpGISReadGeojson(geojson_file="C:\Users\Aly Mahmoud\Downloads\chembur building.geojson", run_it=Toggle(True))  # -> out, field, type, geometry; inputs run_it: Boolean; plug-in component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

bounding_rectangle = BoundingRectangle(Geometry=flatten(shrimp_read_geojson_3.geometry), Plane=PlaneXY(0, 0, 0), Axis=0, Slide=0, Union=True)  # -> Bounding, DimensionX, DimensionY
grid_in_rectangle = GridInRectangle(Rectangle=bounding_rectangle.Bounding, Size=Slider(240, range=0..1000))  # -> flatten(Points), U, V
sort_objects_by_type_3 = SortObjectsByType(RhinoObjects=shrimp_read_geojson_3.geometry)  # -> Points, Curves, Surfaces, Breps, Meshes, TextObjects, HatchObjects, LightObjects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

geometry_4 = Geometry(sort_objects_by_type_3.Breps)
center_5 = Center(Geometry=flatten(geometry_4))  # -> Center, Dimension
point_in_curve_5 = PointInCurve(Point=center_5.Center, Curve=circle)  # -> Relationship, Point
cull_pattern_12 = CullPattern(List=flatten(geometry_4), CullPattern=point_in_curve_5.Relationship)
cull_pattern_13 = CullPattern(List=flatten(geometry_4), CullPattern=invert(point_in_curve_5.Relationship))
custom_preview_lineweights_6 = CustomPreviewLineweights(Geometry=cull_pattern_12, Shader=ColourSwatch(SwatchColor=RGB(153, 132, 50)), Absolute=False)
custom_preview_lineweights_7 = CustomPreviewLineweights(Geometry=cull_pattern_13, Shader=ColourSwatch(SwatchColor=RGB(0, 0, 0)), Absolute=False)

# ----
# Building heights
number_slider_9 = Slider(8, range=0..10)
list_length = ListLength(List=cull_pattern_12)
construct_domain_3 = ConstructDomain(DomainStart=number_slider_9, DomainEnd=Slider(31, range=0..100))
number_slider_10 = Slider(10, range=0..10)
random = Random(Range=construct_domain_3, Number=list_length, Seed=Slider(5, range=0..10))
unit_z_2 = UnitZ(Factor=random)
extrude = Extrude(Base=cull_pattern_12, Direction=unit_z_2)

center_6 = Center(Geometry=extrude, forall=True)  # -> Center, Dimension

# ----
# Should be dependent on the maximum span
number_slider_11 = Slider(39, range=0..100)
number_slider_12 = Slider(21, range=0..100)
isovist = IsoVist(Plane=center_6.Center, Count=number_slider_7, Radius=number_slider_7, Obstacles=extrude)  # -> Points, Distance, Index

average_2 = Average(Input=flatten(prune_tree))
# Charts
unit_z_3 = UnitZ(Factor=1)
move_2 = Move(Geometry=center_6.Center, Motion=unit_z_3)  # -> Geometry, Transform
number_slider_13 = Slider(21, range=0..100)
number_slider_14 = Slider(39, range=0..100)
isovist_2 = IsoVist(Plane=move_2.Geometry, Count=Slider(100, range=0..100), Radius=oil_can_2, Obstacles=extrude)  # -> Points, Distance, Index
polyline = PolyLine(Vertices=isovist_2.Points, Closed=True)
boundary_surfaces_3 = BoundarySurfaces(Edges=circle)

cull_pattern_14 = CullPattern(List=extrude, CullPattern=invert([False, True, True, True]))
cull_pattern_15 = CullPattern(List=extrude, CullPattern=[False, True, True, True])
merge_2 = Merge(Data1=cull_pattern_15, Data2=cull_pattern_14)
box_top_surface = BoxTopSurface_2(tree=merge_2)
brep_wireframe = BrepWireframe(Brep=box_top_surface, Density=-1)
box_top_surface_2 = BoxTopSurface_2(tree=cull_pattern_15)
cap_holes_3 = CapHoles(Brep=cull_pattern_15)
join_curves_2 = JoinCurves(Curves=brep_wireframe, Preserve=False)
project_2 = Project(Curve=join_curves_2, Brep=circle, Direction=Vector(0, 0, 1))

# ----
# Staircase room or roof obstacles
volume_2 = Volume(Geometry=cap_holes_3)  # -> Volume, Centroid
larger_than_2 = LargerThan(FirstNumber=volume_2.Volume, SecondNumber=Slider(330, range=0..1000))  # -> LargerThan, OrEqualTo
cull_pattern_16 = CullPattern(List=cull_pattern_15, CullPattern=invert(larger_than_2.LargerThan))

close_curve = CloseCurve(Curve=project_2, CloseType=0, Bulge=0.5, Tolerance=0)  # -> Closed, ResultBoolean
others = Data(cull_pattern_14)
boundary_surfaces_4 = BoundarySurfaces(Edges=flatten(close_curve.Closed))

# ----
# Parapet
brep_wireframe_2 = BrepWireframe(Brep=box_top_surface_2, Density=-1)
join_curves_3 = JoinCurves(Curves=brep_wireframe_2, Preserve=False)
offset_curve_loose = OffsetCurveLoose(Curve=join_curves_3, Distance="-0.25")
unit_z_4 = UnitZ(Factor=Slider(1.2, range=0..10))
ruled_surface = RuledSurface(CurveA=join_curves_3, CurveB=offset_curve_loose)
extrude_2 = Extrude(Base=ruled_surface, Direction=unit_z_4)

solid_difference = SolidDifference(BrepsA=boundary_surfaces_2, BrepsB=boundary_surfaces_4)
merge_3 = Merge(Data1=cull_pattern_16, Data2=others)

unit_z_5 = UnitZ(Factor="-0.1")
move_3 = Move(Geometry=merge_3, Motion=unit_z_5)  # -> Geometry, Transform

area_2 = Area(Geometry=solid_difference)  # -> Area, Centroid
area_3 = Area(Geometry=box_top_surface_2)  # -> Area, Centroid
mass_addition_2 = MassAddition(Input=area_2.Area)  # -> Result, PartialResults
mass_addition_3 = MassAddition(Input=flatten(area_3.Area))  # -> Result, PartialResults

clean_tree = CleanTree(RemoveNulls=True, RemoveInvalid=True, RemoveEmpty=True, Tree=box_top_surface_2)
list_item = ListItem(List=clean_tree, Index=0, Wrap=True)
bounding_rectangle_2 = BoundingRectangle(Geometry=clean_tree, Plane=PlaneXY(0, 0, 0), Axis=0, Slide=0, Union=True)  # -> Bounding, DimensionX, DimensionY
offset_surface = OffsetSurface(Surface=clean_tree, Distance=1, BothSides=0, CreateSolid=True)
grid_in_rectangle_2 = GridInRectangle(Rectangle=bounding_rectangle_2.Bounding, Size=grid_size, Compact=False, FitSize=False)  # -> flatten(Points), U, V
solid_difference_2 = SolidDifference(BrepsA=offset_surface, BrepsB=move_3.Geometry)
point_in_brep = PointInBrep(Brep=solid_difference_2, Point=grid_in_rectangle_2.Points, Strict=False)
cull_pattern_17 = CullPattern(List=grid_in_rectangle_2.Points, CullPattern=point_in_brep)

deconstruct_brep = DeconstructBrep(Brep=clean_tree)  # -> Faces, Edges, Vertices; disabled
number_slider_15 = Slider(0.36, range=0..1)  # disabled
list_item_2 = ListItem(List=deconstruct_brep.Edges, Index=0, Wrap=True)  # disabled
xy_plane = XYPlane(Origin=Point(0, 0, 0))  # disabled
align_plane = AlignPlane(Plane=xy_plane, Direction=list_item_2)  # -> Plane, Angle; disabled
bounding_rectangle_3 = BoundingRectangle(Geometry=clean_tree, Plane=align_plane.Plane, Axis=0, Slide=number_slider_15, Union=True)  # -> Bounding, DimensionX, DimensionY; disabled
grid_in_rectangle_3 = GridInRectangle(Rectangle=bounding_rectangle_3.Bounding, Size=1, Compact=True, FitSize=False)  # -> flatten(Points), U, V; disabled
point_in_brep_2 = PointInBrep(Brep=solid_difference_2, Point=grid_in_rectangle_3.Points, Strict=False)  # disabled
cull_pattern_18 = CullPattern(List=grid_in_rectangle_3.Points, CullPattern=point_in_brep_2)  # disabled

custom_preview_lineweights_8 = CustomPreviewLineweights(
    Geometry=[cull_pattern_15, extrude_2, cull_pattern_14],
    Shader=ColourSwatch(SwatchColor=RGB(66, 66, 66)),
    Thickness=0.2,
    Absolute=False)
removeduplicatepts_2 = RemoveDuplicatePts(Points=cull_pattern_17, Tolerance=0.01)

area_4 = Area(Geometry=clean_tree)  # -> Area, Centroid
mass_addition_4 = MassAddition(Input=area_4.Area)  # -> Result, PartialResults
max_rain_fail_in_one_hour_9 = Panel("0.0653")
run_off_coeffecient_concrete = Panel("0.70")
roof_area = Panel(mass_addition_4.Result)
multiplication_3 = Multiplication(A=mass_addition_4.Result, B=max_rain_fail_in_one_hour_9, C=run_off_coeffecient_concrete)
concrete_roof_run_off_volume = Panel(multiplication_3)

mass_addition_5 = MassAddition(Input=flatten(area_4.Area))  # -> Result, PartialResults
mass_addition_6 = MassAddition(Input=flatten(multiplication_3))  # -> Result, PartialResults
addition_3 = Addition(A=mass_addition_5.Result, B=mass_addition_2.Result)
trim_tree_3 = TrimTree(Tree=addition_3, Depth=1)
addition_4 = Addition(A=mass_addition_3.Result, B=0)
addition_5 = Addition(A=trim_tree_3, B=0)
total_region_area = Panel(addition_5)
total_building_roof_area = Panel(addition_4)

polyline_2 = PolyLine(Vertices=isovist.Points, Closed=True)
pull_point_2 = PullPoint(Point=isovist.Points, Geometry=extrude, ClosestOnly=True)  # -> ClosestPoint, Distance
boundary_surfaces_5 = BoundarySurfaces(Edges=polyline_2)
smaller_than_3 = SmallerThan(FirstNumber=pull_point_2.Distance, SecondNumber=Slider(0.01, range=0..0.01))  # -> SmallerThan, OrEqualTo
unit_z_6 = UnitZ(Factor=Slider(1.6, range=0..58))
cull_pattern_19 = CullPattern(List=isovist.Points, CullPattern=smaller_than_3.SmallerThan)
move_4 = Move(Geometry=cull_pattern_19, Motion=unit_z_6)  # -> Geometry, Transform
panel_11 = Panel(move_4.Geometry)
polyline_3 = PolyLine(Vertices=move_4.Geometry, Closed=True)

cull_pattern_20 = CullPattern(List=cull_pattern_19, CullPattern=[False, True])
rebuild_curve = RebuildCurve(Curve=polyline_3, Count=Slider(4, range=0..10), EndTangents=False)

boundary_surfaces_6 = BoundarySurfaces(Edges=rebuild_curve)

mesh = Mesh(boundary_surfaces_6)

number_slider_16 = Slider(1, range=0..1)
radians = Radians(Degrees=Slider(140, range=0..360))
curve_region_to_roof_automatic = CurveRegionToRoofAutomatic(AngleOfRoof=0.7853975, RoofType=0, PrecisionFactor=1)  # -> Roof, MedialAxis
gene_pool = GenePool(Decimals=2, Maximum=4, Minimum=0, Value=[2.987208808, 4, 4, 2, 2, 2, 2, 2, 2, 2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])
number_slider_17 = Slider(1, range=0..1)

quad_remesh_parameters = QuadRemeshParameters(
    TargetQuadCount=1000,
    UseAdaptiveQuads=True,
    AdaptiveQuadSize=50,
    DetectHardEdges=True,
    PreserveMeshArrayHardEdges=0,
    SymmetryAxis=0,
    GuideCurveInfluence=0,
    TargetEdgeLength=Slider(4, range=0..10))
quad_remesh = QuadRemesh(MeshOrBrep=mesh, QuadRemeshParameters=quad_remesh_parameters)
box_top_surface_3 = BoxTopSurface_2(tree=extrude)
brep_wireframe_3 = BrepWireframe(Brep=box_top_surface_3, Density=-1)
join_curves_4 = JoinCurves(Curves=flatten(brep_wireframe_3), Preserve=False)
set_group_properties = SetGroupProperties(
    Group=["Grasshopper.Kernel.Types.GH_ObjectWrapper", "Grasshopper.Kernel.Types.GH_ObjectWrapper", "Grasshopper.Kernel.Types.GH_ObjectWrapper"],
    Color=ColourSwatch(SwatchColor=RGB(255, 136, 0)))
number_slider_18 = Slider(4, range=0..100)
divide_curve_2 = DivideCurve(Curve=join_curves_4, Count=Slider(104, range=0..1100), Kinks=False)  # -> Points, Tangents, Parameters
meshcorners = MeshCorners(Mesh=quad_remesh, Angle=2.35619449)
face_normals = FaceNormals(Mesh=quad_remesh)  # -> Centers, Normals
panel_12 = Panel("-9")
mesh_edges = MeshEdges(Mesh=quad_remesh)  # -> NakedEdges, InteriorEdges, NonManifoldEdges
gene_pool_2 = GenePool(Decimals=2, Maximum=4, Minimum=0, Value=4)
amplitude = Amplitude(Vector=face_normals.Normals, Amplitude=Slider(6.6, range=0..10))
unit_z_7 = UnitZ(Factor=["-3", "-6"])
deconstruct_mesh = DeconstructMesh(Mesh=quad_remesh)  # -> Vertices, Faces, Colours, Normals
vector_display = VectorDisplay(Anchor=face_normals.Centers, Vector=amplitude)
pull_point_3 = PullPoint(Point=deconstruct_mesh.Vertices, Geometry=mesh_edges.NakedEdges, ClosestOnly=True)  # -> ClosestPoint, Distance
construct_domain_4 = ConstructDomain(DomainStart=0, DomainEnd=number_slider_18)  # -> flatten(Domain)
larger_than_3 = LargerThan(FirstNumber=pull_point_3.Distance, SecondNumber=Slider(0.01, range=0..0.01))  # -> LargerThan, OrEqualTo
panel_13 = Panel("-1")
genepool_controller = GenePoolController(GenePool=gene_pool_2, Count=Slider(1, range=0..1), Range=construct_domain_4, Randomness=5)
cull_pattern_21 = CullPattern(List=deconstruct_mesh.Vertices, CullPattern=larger_than_3.LargerThan)
show = Show(G=quad_remesh)
panel_14 = Panel("15")

number_slider_19 = Slider(1.41, range=-5..3)
vertexloads = VertexLoads(Mesh=quad_remesh, Strength=number_slider_19)

meshcorners_2 = MeshCorners(Mesh=quad_remesh, Angle=radians)
list_item_3 = ListItem(List=flatten(quad_remesh), Index=0, Wrap=True)  # -> Item, Item1
nakedvertices = NakedVertices(Mesh=quad_remesh)  # -> ClothedIndex, NakedIndex, ClothedPts, NakedPts
data = Data(nakedvertices.NakedPts)
mesh_edges_2 = MeshEdges(Mesh=quad_remesh)  # -> NakedEdges, InteriorEdges, NonManifoldEdges
merge_4 = Merge(Data1=mesh_edges_2.NakedEdges, Data2=mesh_edges_2.InteriorEdges)
construct_domain_5 = ConstructDomain(DomainStart=0, DomainEnd=number_slider_18)  # -> flatten(Domain)
list_length_2 = ListLength(List=data)
closest_point = ClosestPoint(Point=meshcorners, Cloud=flatten(divide_curve_2.Points))  # -> ClosestPoint, CPIndex, Distance
genepool_controller_2 = GenePoolController(GenePool=gene_pool, Count=list_length_2, Range=construct_domain_5, Randomness=5)

length_line = LengthLine(Line=merge_4, Strength=10)
edgelengths = EdgeLengths(Mesh=quad_remesh, LengthFactor=Slider(0.63, range=0..1), Strength=Slider(17, range=0..100))

closest_points = ClosestPoints(Point=data, Count=number_slider_18)  # -> ClosestPoint, CPIndex, Distance
move_5 = Move(Geometry=graft(closest_points.ClosestPoint), Motion=unit_z_7)  # -> Geometry, Transform
list_item_4 = ListItem(List=closest_points.ClosestPoint, Index=gene_pool_2, Wrap=True)
trim_tree_4 = TrimTree(Tree=list_item_4, Depth=2)
trim_tree_5 = TrimTree(Tree=move_5.Geometry, Depth=1)
unit_z_8 = UnitZ(Factor=number_slider_19)
load = Load(Point=cull_pattern_21, ForceVector=unit_z_8, Weighting=1)
anchor = Anchor(Point=meshcorners, Target=closest_point.ClosestPoint, Strength=10000)
entwine = Entwine(Branch00=show, Branch01=edgelengths, Branch02=vertexloads, Branch03=anchor, FlattenInputs=True)
zombiesolver = ZombieSolver(GoalObjects=entwine, Threshold="0.00001", Tolerance="0.0001", MaxIterations="1000")  # -> I, V, O
weaverbird_s_tile = WeaverbirdsTile(MeshCurves=flatten(zombiesolver.O), FillStrategy=1, OptIn=2)
face_normals_2 = FaceNormals(Mesh=weaverbird_s_tile)  # -> Centers, Normals
amplitude_2 = Amplitude(Vector=face_normals_2.Normals, Amplitude=Slider(10, range=0..10))
vector_display_2 = VectorDisplay(Anchor=face_normals_2.Centers, Vector=amplitude_2)

custom_preview = CustomPreview(Geometry=boundary_surfaces_5, Material=ColourSwatch(SwatchColor=RGBA(255, 33, 33, 152)))
custom_preview_lineweights_9 = CustomPreviewLineweights(Geometry=weaverbird_s_tile, Shader=ColourSwatch(SwatchColor=RGB(178, 181, 94)), Absolute=False)

merge_5 = Merge(Data1=closest_points.ClosestPoint, Data2=trim_tree_5)
average_3 = Average(Input=merge_5)
custom_preview_lineweights_10 = CustomPreviewLineweights(Geometry=zombiesolver.O, Shader=ColourSwatch(SwatchColor=RGBA(0, 0, 0, 107)), Absolute=False)
deconstruct_mesh_2 = DeconstructMesh(Mesh=weaverbird_s_tile)  # -> Vertices, Faces, Colours, Normals

weaverbird_s_catmull_clark_subdivision = WeaverbirdsCatmullClarkSubdivision(MeshCurves=weaverbird_s_tile, Level=Slider(0, range=0..10), SmoothNakedEdges=0)
mesh_edges_3 = MeshEdges(Mesh=weaverbird_s_catmull_clark_subdivision)  # -> NakedEdges, InteriorEdges, NonManifoldEdges
mesh_edges_4 = MeshEdges(Mesh=weaverbird_s_tile)  # -> NakedEdges, InteriorEdges, NonManifoldEdges
deconstruct_mesh_3 = DeconstructMesh(Mesh=weaverbird_s_catmull_clark_subdivision)  # -> Vertices, Faces, Colours, Normals
curve = Curve(mesh_edges_3.NakedEdges)
pull_point_4 = PullPoint(Point=deconstruct_mesh_3.Vertices, Geometry=mesh_edges_4.InteriorEdges, ClosestOnly=True)  # -> ClosestPoint, Distance
pull_point_5 = PullPoint(Point=deconstruct_mesh_3.Vertices, Geometry=[mesh_edges_4.InteriorEdges, mesh_edges_4.NakedEdges], ClosestOnly=True)  # -> ClosestPoint, Distance
pull_point_6 = PullPoint(Point=deconstruct_mesh_3.Vertices, Geometry=curve, ClosestOnly=True)  # -> ClosestPoint, Distance
smaller_than_4 = SmallerThan(FirstNumber=pull_point_5.Distance, SecondNumber=Slider(0.17, range=0..1))  # -> SmallerThan, OrEqualTo
smaller_than_5 = SmallerThan(FirstNumber=pull_point_4.Distance, SecondNumber=Slider(0.33, range=0..1))  # -> SmallerThan, OrEqualTo
smaller_than_6 = SmallerThan(FirstNumber=pull_point_6.Distance, SecondNumber=Slider(0.02, range=0..1))  # -> SmallerThan, OrEqualTo
number_slider_20 = Slider(-1, range=-1..0)
number_slider_21 = Slider(-0.004, range=-0.505..0)
number_slider_22 = Slider(-0.18, range=-2..0)
number_slider_23 = Slider(-0.009, range=-0.009..0.01)
number_slider_24 = Slider(-2, range=-2..0)
number_slider_25 = Slider(-2.1, range=-10..0)
number_slider_26 = Slider(-0.12, range=-2..0)
cull_pattern_22 = CullPattern(List=deconstruct_mesh_3.Vertices, CullPattern=invert(smaller_than_4.SmallerThan))
unit_z_9 = UnitZ(Factor="0.1")
cull_pattern_23 = CullPattern(List=deconstruct_mesh_3.Vertices, CullPattern=smaller_than_5.SmallerThan)
cull_pattern_24 = CullPattern(List=deconstruct_mesh_3.Vertices, CullPattern=smaller_than_6.SmallerThan)
unit_z_10 = UnitZ(Factor=number_slider_23)
move_6 = Move(Geometry=cull_pattern_23, Motion=unit_z_9)  # -> Geometry, Transform
load_2 = Load(Point=cull_pattern_22, ForceVector=unit_z_10, Weighting=1)
edgelengths_2 = EdgeLengths(Mesh=weaverbird_s_catmull_clark_subdivision, LengthFactor=1, Strength=1)
anchor_2 = Anchor(Point=cull_pattern_23, Target=move_6.Geometry, Strength=10000)
vertexloads_2 = VertexLoads(Mesh=weaverbird_s_catmull_clark_subdivision, Strength=number_slider_23)
anchor_3 = Anchor(Point=cull_pattern_24, Strength=10000)
show_2 = Show(G=weaverbird_s_catmull_clark_subdivision)
entwine_2 = Entwine(Branch00=show_2, Branch01=edgelengths_2, Branch02=anchor_3, Branch04=vertexloads_2, FlattenInputs=True)
zombiesolver_2 = ZombieSolver(GoalObjects=entwine_2, Threshold="0.00001", Tolerance="0.0001", MaxIterations="1000")  # -> I, V, O
weaverbird_s_tile_2 = WeaverbirdsTile(MeshCurves=flatten(zombiesolver_2.O), FillStrategy=1, OptIn=2)
weaverbird_s_laplacian_smoothing = WeaverbirdsLaplacianSmoothing(MeshCurves=weaverbird_s_tile_2, Level=Slider(10, range=0..10), SmoothNakedEdges=0, Thin=1)
panel_15 = Panel(weaverbird_s_tile_2)
mesh_naked_edges = MeshNakedEdges(Mesh=weaverbird_s_laplacian_smoothing)  # -> Naked, ResultBoolean
custom_preview_lineweights_11 = CustomPreviewLineweights(Geometry=weaverbird_s_laplacian_smoothing, Shader=ColourSwatch(SwatchColor=RGBA(191, 201, 145, 210)), Absolute=False)
pipe = Pipe(Curve=mesh_naked_edges.Naked, Radius=Slider(0.3, range=0..1), Caps=0)

custom_preview_lineweights_12 = CustomPreviewLineweights(Geometry=pipe, Shader=ColourSwatch(SwatchColor=RGBA(0, 0, 0, 210)), Absolute=False)
parameter_pipe_mesh = ParameterPipeMesh(
    Curve=mesh_naked_edges.Naked,
    Radius=0.5,
    ParametersU=[0, 0.1, 0.2, 0.3, 0.4, 0.5, 0.6, 0.7, 0.8, 0.9, 1],
    ParametersV=[0, 0.25, 0.5, 0.75, 1],
    Weighted=False,
    Lengths=False,
    Angle=Slider(1, range=0..1),
    Rotation=0,
    EndType=0,
    Triangulate=True)
data_2 = Data(weaverbird_s_laplacian_smoothing)

# ----
# Rain water visuals
deconstruct_mesh_4 = DeconstructMesh(Mesh=data_2)  # -> Vertices, Faces, Colours, Normals
cull_pattern_25 = CullPattern(List=deconstruct_mesh_4.Vertices, CullPattern=[False, False, True, True])
flow_on_mesh_along_scalar_gradient = FlowOnMeshAlongScalarGradient(Mesh=data_2, Points=cull_pattern_25, Samples=1000, Direction=Slider(0, range=0..2), Tolerance=0.001)
custom_preview_lineweights_13 = CustomPreviewLineweights(Geometry=flow_on_mesh_along_scalar_gradient, Shader=ColourSwatch(SwatchColor=RGB(0, 106, 255)), Absolute=False)

mesh_area = MeshArea(Mesh=weaverbird_s_tile)  # -> Area, Centroid

run_off_coeffecient_filling = Panel(python_3_script_4.a)
mass_addition_7 = MassAddition(Input=flatten(mesh_area.Area))  # -> Result, PartialResults
tensile_s_area_per_building = Panel(mass_addition_7.Result)
multiplication_4 = Multiplication(A=mass_addition_7.Result, B=max_rain_fail_in_one_hour_7, C=run_off_coeffecient_filling)
tensile_runoff_volume_per_building = Panel(multiplication_4)

panel_16 = Panel(mesh_area.Area)
replace_nulls = ReplaceNulls(Items=mass_addition_7.Result, Replacements="0")  # -> Items, Count
addition_6 = Addition(A=replace_nulls.Items, B=0)
area_of_tensile = Panel(addition_6)

# ----
# Dividing roof into 3 regions which accumilates to givin percentage
center_7 = Center(Geometry=clean_tree)  # -> Center, Dimension
pull_point_7 = PullPoint(Point=removeduplicatepts_2, Geometry=center_7.Center, ClosestOnly=True)  # -> ClosestPoint, Distance
min_max_2 = MinMax(Number=pull_point_7.Distance)  # -> Minimum, Maximum
construct_domain_6 = ConstructDomain(DomainStart=0, DomainEnd=min_max_2.Maximum)
divide_domain = DivideDomain(Domain=construct_domain_6, Count=Slider(3, range=0..10))
list_item_5 = ListItem(List=divide_domain, Index=0, Wrap=True)  # -> Item, Item1, Item2
includes = Includes(Value=pull_point_7.Distance, Domain=list_item_5.Item)  # -> Includes, Deviation
includes_2 = Includes(Value=pull_point_7.Distance, Domain=list_item_5.Item1)  # -> Includes, Deviation
includes_3 = Includes(Value=pull_point_7.Distance, Domain=list_item_5.Item2)  # -> Includes, Deviation
cull_pattern_26 = CullPattern(List=removeduplicatepts_2, CullPattern=includes.Includes)
cull_pattern_27 = CullPattern(List=removeduplicatepts_2, CullPattern=includes_2.Includes)
cull_pattern_28 = CullPattern(List=removeduplicatepts_2, CullPattern=includes_3.Includes)
panel_17 = Panel(divide_domain)
list_length_3 = ListLength(List=cull_pattern_27)
list_length_4 = ListLength(List=cull_pattern_26)
list_length_5 = ListLength(List=cull_pattern_28)
multiplication_5 = Multiplication(A=list_length_4, B=division)
multiplication_6 = Multiplication(A=list_length_3, B=division)
multiplication_7 = Multiplication(A=list_length_5, B=division)
panel_18 = Panel(multiplication_6)
panel_19 = Panel(multiplication_7)
panel_20 = Panel(multiplication_5)
closest_points_2 = ClosestPoints(Point=center_7.Center, Cloud=cull_pattern_26, Count=multiplication_5)  # -> ClosestPoint, CPIndex, Distance
closest_points_3 = ClosestPoints(Point=center_7.Center, Cloud=cull_pattern_27, Count=multiplication_6)  # -> ClosestPoint, CPIndex, Distance
closest_points_4 = ClosestPoints(Point=center_7.Center, Cloud=cull_pattern_28, Count=multiplication_7)  # -> ClosestPoint, CPIndex, Distance
list_length_6 = ListLength(List=closest_points_2.ClosestPoint)
panel_21 = Panel(list_length_6)
list_length_7 = ListLength(List=closest_points_4.ClosestPoint)
panel_22 = Panel(list_length_7)
list_length_8 = ListLength(List=closest_points_3.ClosestPoint)
panel_23 = Panel(list_length_8)
list_length_9 = ListLength(List=flatten(removeduplicatepts_2))
mass_addition_8 = MassAddition(Input=flatten(list_length_9))  # -> Result, PartialResults

merge_6 = Merge(Data1=closest_points_2.ClosestPoint, Data2=closest_points_3.ClosestPoint, Data3=closest_points_4.ClosestPoint)

list_length_10 = ListLength(List=flatten(merge_6))
mass_addition_9 = MassAddition(Input=flatten(list_length_10))  # -> Result, PartialResults
division_4 = Division(A=mass_addition_9.Result, B=mass_addition_8.Result)
panel_24 = Panel(division_4)

# ----
# Rectangles
box_bottom_surface = BoxTopSurface(brep=solid_difference_2)
brep_wireframe_4 = BrepWireframe(Brep=box_bottom_surface, Density=-1)
join_curves_5 = JoinCurves(Curves=brep_wireframe_4, Preserve=False)  # -> simplify(Curves)
pull_point_8 = PullPoint(Point=merge_6, Geometry=flatten(join_curves_5), ClosestOnly=True)  # -> ClosestPoint, Distance
larger_than_4 = LargerThan(FirstNumber=pull_point_8.Distance, SecondNumber=Slider(2, range=0..10))  # -> LargerThan, OrEqualTo
starting_domain = Slider(0.1, range=0.1..1)
cull_pattern_29 = CullPattern(List=merge_6, CullPattern=larger_than_4.LargerThan)
clean_tree_2 = CleanTree(RemoveNulls=True, RemoveInvalid=True, RemoveEmpty=True, Tree=cull_pattern_29)  # -> simplify(Tree)
pull_point_9 = PullPoint(Point=clean_tree_2, Geometry=join_curves_5, ClosestOnly=True)  # -> ClosestPoint, Distance
number_slider_27 = Slider(1, range=0..1)
square = Square(Value=grid_size)
bounds = Bounds(Numbers=pull_point_9.Distance)
constrained_area_rectangle = ConstrainedAreaRectangle(Plane=clean_tree_2, Area=square, FactorX=number_slider_27, FactorY=number_slider_27)  # -> Rectangle, DimensionX, DimensionY

# ----
# T Mass / m2
# mass of one cell
# Area of one cell
saturated_soil_density_cocopeat_per_m3 = Panel(oil_can_5)
vegitation_weight_heavy = Panel("200")
user_inputs_roof_dead_load_bearing = Panel("350")
vegitation_weight_medium = Panel("100")
square_2 = Square(Value=grid_size)
vegitation_weight_light = Panel("50")
addition_7 = Addition(A=saturated_soil_density_cocopeat_per_m3, B=vegitation_weight_light)
multiplication_8 = Multiplication(A=user_inputs_roof_dead_load_bearing, B=square_2)
division_5 = Division(A=user_inputs_roof_dead_load_bearing, B=addition_7)
maximum_soil_depth = Panel(division_5)
round = Round(Number=multiplication_8)  # -> Nearest, Floor, Ceiling

construct_domain_7 = ConstructDomain(DomainStart=starting_domain, DomainEnd=division_5)
remap_numbers = RemapNumbers(Value=pull_point_9.Distance, Source=bounds, Target=construct_domain_7)  # -> Mapped, Clipped
box_rectangle = BoxRectangle(Rectangle=constrained_area_rectangle.Rectangle, Height=remap_numbers.Mapped)  # -> simplify(Box)
box_top_surface_4 = BoxTopSurface_2(tree=box_rectangle)

volume_3 = Volume(Geometry=box_rectangle)  # -> Volume, Centroid
multiplication_9 = Multiplication(A=addition_7, B=volume_3.Volume)
larger_than_5 = LargerThan(FirstNumber=round.Nearest, SecondNumber=multiplication_9)  # -> LargerThan, OrEqualTo
cull_pattern_30 = CullPattern(List=box_rectangle, CullPattern=invert(larger_than_5.OrEqualTo))
cull_pattern_31 = CullPattern(List=box_rectangle, CullPattern=larger_than_5.OrEqualTo)

box_sides = BoxTopSurface_3(brep=box_rectangle)
entwine_3 = Entwine(Branch00=box_top_surface_4, Branch01=box_sides, FlattenInputs=True)

panel_25 = Panel("https://climate.onebuilding.org/WMO_Region_2_Asia/IND_India/MH_Maharashtra/IND_MH_Mumbai-Shivaji.Intl.AP.430030_TMYx.zip")
downloadepw = LBDownloadWeather(weather_URL=panel_25)  # -> epw_file, stat_file, ddy_file; plug-in component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
importepw = LBImportEPW(epw_file=downloadepw.epw_file)  # -> location, dry_bulb_temperature, dew_point_temperature, relative_humidity, wind_speed, wind_direction, direct_normal_rad, diffuse_horizontal_rad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; plug-in component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
center_8 = Center(Geometry=cull_pattern_15, forall=True)  # -> Center, Dimension
analysisperiod = LBAnalysisPeriod(
    start_month=Slider(5, range=5..8),
    start_day=Slider(7, range=1..31),
    start_hour=Slider(7, range=0..23),
    end_month=Slider(5, range=5..8),
    end_day=Slider(7, range=1..31),
    end_hour=Slider(18, range=0..23))  # -> period, hoys, dates; plug-in component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
legendpar = LBLegendParameters(min=Slider(1, range=0..1), max=Slider(12, range=0..100))  # -> leg_par; plug-in component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
sunpath = LBSunPath(location=importepw.location, hoys=analysisperiod.hoys, center_pt=center_8.Center, scale=Slider(3.8, range=0..10))  # -> out, vectors, altitudes, azimuths, hoys, sun_pts, analemma, daily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; plug-in component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
division_6 = Division(A=grid_size, B=Slider(2, range=0..10))
directsunhours = LBDirectSunHours(
    vectors=flatten(sunpath.vectors),
    geometry=flatten(box_top_surface_4),
    context=flatten([cull_pattern_15, cull_pattern_14]),
    grid_size=division_6,
    legend_par=legendpar,
    run=Toggle(True))  # -> out, points, results, mesh, legend, title, int_mtx; plug-in component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
amplitude_3 = Amplitude(Vector=sunpath.vectors, Amplitude=Slider(258.9, range=0..510))
text_tag = TextTag(Location=directsunhours.points, Text=directsunhours.results)
vector_display_3 = VectorDisplay(Anchor=sunpath.sun_pts, Vector=amplitude_3)
mesh_explode = MeshExplode(Mesh=directsunhours.mesh, Interpolate=False)
smaller_than_7 = SmallerThan(FirstNumber=directsunhours.results, SecondNumber=Slider(9, range=6..9))  # -> SmallerThan, OrEqualTo
mesh_sphere = MeshSphere(Base=sunpath.sun_pts, Radius=Slider(5, range=0..6), UCount=10, VCount=20)
custom_preview_2 = CustomPreview(Geometry=mesh_sphere, Material=ColourSwatch(SwatchColor=RGBA(255, 247, 0, 145)))
cull_pattern_32 = CullPattern(List=mesh_explode, CullPattern=invert(smaller_than_7.SmallerThan))
cull_pattern_33 = CullPattern(List=mesh_explode, CullPattern=smaller_than_7.SmallerThan)
average_4 = Average(Input=directsunhours.results)
mass_addition_10 = MassAddition(Input=directsunhours.results)  # -> Result, PartialResults
panel_26 = Panel(mass_addition_10.Result)
panel_27 = Panel(average_4)

unit_z_11 = UnitZ(Factor=remap_numbers.Mapped)

# ----
# S=1: Perfect balance, all rain is absorbed, no runoff.
# S<1: Insufficient soil absorption, resulting in runoff.
# S>1: Excess soil absorption capacity, no runoff, with room to absorb more water.
division_7 = Division(A=saturated_soil_density_cocopeat_per_m3, B=1000)
max_rain_fail_in_one_hour_10 = Panel(oil_can_6)
multiplication_10 = Multiplication(A=division_7, B=remap_numbers.Mapped)
division_8 = Division(A=multiplication_10, B=max_rain_fail_in_one_hour_10)
value_list_2 = ValueList({"Min": 0, "Average": 1, "Max": 2}, selected="Min")
average_5 = Average(Input=division_8)
min_max_3 = MinMax(Number=division_8)  # -> Minimum, Maximum
water_holding_capacity_for_each_box_2 = Panel(multiplication_10)
mass_addition_11 = MassAddition(Input=multiplication_10)  # -> Result, PartialResults
stream_filter_2 = StreamFilter(Gate=value_list_2, Stream0=min_max_3.Minimum, Stream1=average_5, Stream2=min_max_3.Maximum)
water_holding_capacity_total_2 = Panel(mass_addition_11.Result)
modulus_2 = Modulus(A="1", B=stream_filter_2)
s_soil_retention_factor_2 = Panel(modulus_2)

area_5 = Area(Geometry=constrained_area_rectangle.Rectangle)  # -> Area, Centroid
subtraction = Subtraction(A="1", B=modulus_2)
run_off_coeffecient_green = Panel("0.2")
mass_addition_12 = MassAddition(Input=area_5.Area)  # -> Result, PartialResults
gr_area_per_building = Panel(mass_addition_12.Result)
multiplication_11 = Multiplication(A=mass_addition_12.Result, B=max_rain_fail_in_one_hour_10, C=run_off_coeffecient_green, D=subtraction)
green_roof_runoff_volume_per_building = Panel(multiplication_11)

mass_addition_13 = MassAddition(Input=flatten(area_5.Area))  # -> Result, PartialResults

box_bottom_surface_2 = BoxTopSurface(brep=box_rectangle)
box_sides_2 = BoxTopSurface_3(brep=box_rectangle)
area_6 = Area(Geometry=box_bottom_surface_2)  # -> Area, Centroid
area_7 = Area(Geometry=box_sides_2)  # -> Area, Centroid
merge_7 = Merge(Data1=area_6.Area, Data2=area_7.Area)
trim_tree_6 = TrimTree(Tree=merge_7, Depth=1)
plastic_price_polypropylene_pp = Panel("37")
mass_addition_14 = MassAddition(Input=trim_tree_6)  # -> Result, PartialResults
multiplication_12 = Multiplication(A=mass_addition_14.Result, B=plastic_price_polypropylene_pp)
round_2 = Round(Number=multiplication_12)  # -> Nearest, Floor, Ceiling
plastic_material_area_m2_per_building = Panel(mass_addition_14.Result)
concatenate = Concatenate(FragmentA=round_2.Nearest, FragmentB=" €")
estimate_plastic_material_cost = Panel(concatenate)

box_top_surface_5 = BoxTopSurface_2(tree=box_rectangle)
area_8 = Area(Geometry=box_top_surface_5)  # -> Area, Centroid
trim_tree_7 = TrimTree(Tree=area_8.Area, Depth=1)
vegitation_price_per_m2_perennials_and_w = Panel("40")  # "Vegitation price per m2 (Perennials and Wildflowers)"
mass_addition_15 = MassAddition(Input=trim_tree_7)  # -> Result, PartialResults
multiplication_13 = Multiplication(A=mass_addition_15.Result, B=vegitation_price_per_m2_perennials_and_w)
round_3 = Round(Number=multiplication_13)  # -> Nearest, Floor, Ceiling
vegitation_area_m2_per_building = Panel(mass_addition_15.Result)
concatenate_2 = Concatenate(FragmentA=round_3.Nearest, FragmentB=" €")
estimate_vegitation_material_cost = Panel(concatenate_2)

cocopeat_soil_price_per_m3 = Panel("175")
volume_4 = Volume(Geometry=box_rectangle)  # -> Volume, Centroid
multiplication_14 = Multiplication(A=cocopeat_soil_price_per_m3, B=volume_4.Volume)
mass_addition_16 = MassAddition(Input=multiplication_14)  # -> Result, PartialResults
round_4 = Round(Number=multiplication_14)  # -> Nearest, Floor, Ceiling
concatenate_3 = Concatenate(FragmentA=round_4.Nearest, FragmentB=" €")
round_5 = Round(Number=mass_addition_16.Result)  # -> Nearest, Floor, Ceiling
concatenate_4 = Concatenate(FragmentA=round_5.Nearest, FragmentB=" €")
estimate_cost_per_box = Panel(concatenate_3)
estimate_soil_cost_per_building = Panel(concatenate_4)

mass_addition_17 = MassAddition(Input=merge_7)  # -> Result, PartialResults
plastic_material_area_m2_per_box = Panel(mass_addition_17.Result)

volume_5 = Volume(Geometry=box_rectangle)  # -> Volume, Centroid
module_price_per_m3 = Panel("1160")
multiplication_15 = Multiplication(A=module_price_per_m3, B=volume_5.Volume)
mass_addition_18 = MassAddition(Input=multiplication_15)  # -> Result, PartialResults
round_6 = Round(Number=multiplication_15)  # -> Nearest, Floor, Ceiling
concatenate_5 = Concatenate(FragmentA=round_6.Nearest, FragmentB=" €")
round_7 = Round(Number=mass_addition_18.Result)  # -> Nearest, Floor, Ceiling
concatenate_6 = Concatenate(FragmentA=round_7.Nearest, FragmentB=" €")
estimate_cost_per_box_2 = Panel(concatenate_5)
estimate_cost_per_building = Panel(concatenate_6)

mass_addition_19 = MassAddition(Input=round_2.Nearest)  # -> Result, PartialResults
mass_addition_20 = MassAddition(Input=round_5.Nearest)  # -> flatten(Result), PartialResults

addition_8 = Addition(A=round_2.Nearest, B=round_5.Nearest, C=round_3.Nearest)
concatenate_7 = Concatenate(FragmentA=addition_8, FragmentB=" €")
total_estimated_dry_cost_per_building = Panel(concatenate_7)

entwine_4 = Entwine(Branch00=mass_addition_19.Result, Branch01=round_5.Nearest, FlattenInputs=True)
panel_28 = Panel(entwine_4)
addition_9 = Addition(A=mass_addition_13.Result, B=0)
total_green_roof_area = Panel(addition_9)

grid_in_rectangle_4 = GridInRectangle(Rectangle=constrained_area_rectangle.Rectangle, Size=Slider(1.75, range=1..2), Compact=True)  # -> Points, U, V
number_slider_28 = Slider(0.2, range=0..1)
custom_preview_lineweights_14 = CustomPreviewLineweights(
    Geometry=box_top_surface_4,
    Shader=ColourSwatch(SwatchColor=RGB(156, 186, 136)),
    Thickness=number_slider_28,
    Absolute=False)
custom_preview_lineweights_15 = CustomPreviewLineweights(Geometry=box_sides, Shader=ColourSwatch(SwatchColor=RGB(54, 54, 54)), Thickness=number_slider_28, Absolute=False)

move_7 = Move(Geometry=grid_in_rectangle_4.Points, Motion=unit_z_11)  # -> Geometry, Transform

dot_display = DotDisplay(Point=move_7.Geometry, Colour=ColourSwatch(SwatchColor=RGB(51, 105, 39)), Size=Slider(0.2, range=0..10))

run_off_coeffecient = Panel("0.70")
max_rain_fail_in_one_hour_11 = Panel("0.0653")
subtraction_2 = Subtraction(A=mass_addition_4.Result, B=mass_addition_12.Result)
multiplication_16 = Multiplication(A=subtraction_2, B=max_rain_fail_in_one_hour_11, C=run_off_coeffecient)

addition_10 = Addition(A=multiplication_11, B=multiplication_16)
subtraction_3 = Subtraction(A=multiplication_3, B=addition_10)

mass_addition_21 = MassAddition(Input=flatten(subtraction_3))  # -> Result, PartialResults

mass_addition_22 = MassAddition(Input=flatten(subtraction_3))  # -> Result, PartialResults
subtraction_4 = Subtraction(A=mass_addition_6.Result, B=mass_addition_22.Result)
division_9 = Division(A=mass_addition_21.Result, B=mass_addition_6.Result)
multiplication_17 = Multiplication(A=division_9, B=100)
round_to_decimal_place = RoundToDecimalPlace(NumberX=[subtraction_4, mass_addition_22.Result], DecimalPlace=2, RoundType=0)  # -> Rounded, Difference

reduced_run_off_volume = Panel(mass_addition_21.Result)
data_3 = Data(round_to_decimal_place.Rounded)

round_to_decimal_place_2 = RoundToDecimalPlace(NumberX=multiplication_17, DecimalPlace=2, RoundType=0)  # -> Rounded, Difference
addition_11 = Addition(A=round_to_decimal_place_2.Rounded, B=0)
total_percentage_of_runoff_reduced_by_gr = Panel(addition_11)  # "Total Percentage of runoff reduced by green roof"

# ----
# Run off reduced percentage for each building
division_10 = Division(A=subtraction_3, B=multiplication_3)
multiplication_18 = Multiplication(A=division_10, B=100)

round_to_decimal_place_3 = RoundToDecimalPlace(NumberX=multiplication_18, DecimalPlace=2, RoundType=0)  # -> Rounded, Difference

percentage_of_runoff_reduced = Panel(round_to_decimal_place_3.Rounded)

area_9 = Area(Geometry=boundary_surfaces_3)  # -> Area, Centroid
mass_addition_23 = MassAddition(Input=area_9.Area)  # -> Result, PartialResults
max_rain_fail_in_one_hour_12 = Panel("0.0653")
square_area = Panel(mass_addition_23.Result)

run_off_coeffecient_2 = Panel("0.95")
max_rain_fail_in_one_hour_13 = Panel("0.0653")
subtraction_5 = Subtraction(A=mass_addition_23.Result, B=mass_addition_7.Result)
multiplication_19 = Multiplication(A=subtraction_5, B=max_rain_fail_in_one_hour_13, C=run_off_coeffecient_2)

multiplication_20 = Multiplication(A=mass_addition_23.Result, B=max_rain_fail_in_one_hour_12, C=run_off_coeffecient_2)
concrete_roof_run_off_volume_2 = Panel(multiplication_20)

mass_addition_24 = MassAddition(Input=flatten(multiplication_20))  # -> Result, PartialResults
addition_12 = Addition(A=mass_addition_6.Result, B=mass_addition_24.Result)
addition_13 = Addition(A=addition_12, B=0)
total_region_run_off_value = Panel(addition_13)

addition_14 = Addition(A=multiplication_4, B=multiplication_19)
subtraction_6 = Subtraction(A=multiplication_20, B=addition_14)

mass_addition_25 = MassAddition(Input=flatten(subtraction_6))  # -> Result, PartialResults

addition_15 = Addition(A=mass_addition_21.Result, B=mass_addition_25.Result)
division_11 = Division(A=addition_15, B=addition_12)
multiplication_21 = Multiplication(A=division_11, B=100)
addition_16 = Addition(A=addition_15, B=0)
addition_17 = Addition(A=multiplication_21, B=0)
total_reduced_run_off_value = Panel(addition_16)
total_run_off_percentage = Panel(addition_17)
mass_addition_26 = MassAddition(Input=flatten(subtraction_6))  # -> Result, PartialResults
division_12 = Division(A=subtraction_6, B=multiplication_20)
multiplication_22 = Multiplication(A=division_12, B=100)
subtraction_7 = Subtraction(A=mass_addition_24.Result, B=mass_addition_26.Result)
round_to_decimal_place_4 = RoundToDecimalPlace(NumberX=multiplication_22, DecimalPlace=2, RoundType=0)  # -> Rounded, Difference
trim_tree_8 = TrimTree(Tree=round_to_decimal_place_4.Rounded, Depth=1)
addition_18 = Addition(A=trim_tree_8, B=0)
percentage_of_runoff_reduced_by_tensile = Panel(addition_18)
merge_8 = Merge(
    Data1=tensile_filling,
    Data2=total_building_roof_area,
    Data3=total_green_roof_area,
    Data4=total_percentage_of_runoff_reduced_by_gr,
    Data5=green_roof_percentage_4,
    Data6=percentage_of_runoff_reduced_by_tensile,
    Data7=green_roof_soil_type,
    Data8=max_rain_fail_in_one_hour_8,
    Data9=total_reduced_run_off_value,
    Data10=total_region_run_off_value,
    Data11=total_region_area,
    Data12=total_run_off_percentage,
    Data13=area_of_tensile)
round_to_decimal_place_5 = RoundToDecimalPlace(NumberX=[subtraction_7, mass_addition_26.Result], DecimalPlace=2, RoundType=0)  # -> Rounded, Difference
data_recorder = DataRecorder(merge_8, DataLimit=-10, RecordData=True)

reduced_run_off_area = Panel(mass_addition_25.Result)
data_4 = Data(round_to_decimal_place_5.Rounded)

partition_list = PartitionList(List=data_recorder, Size=Slider(13, range=0..100))
panel_29 = Panel(partition_list)
script = Script(data_tree=partition_list, headings=param_info.NickName, csv_path=panel_10)  # -> out, a; inputs data_tree: tree, headings: list of String, csv_path: String
# ---------- script: Python ----------
import csv
import ghpythonlib.treehelpers as th
import os

nested_list = th.tree_to_list(data_tree)

with open(csv_path, 'w', newline='') as file:
    writer = csv.writer(file)
    # Write headings first
    writer.writerow(headings)
    # Write each row
    for sublist in nested_list:
        writer.writerow(sublist)
# ---------- end script ----------

# ==== cluster BoxTopSurface
brep = ClusterInput()
deconstruct_brep = DeconstructBrep(Brep=brep)  # -> Faces, Edges, Vertices
center = Center(Geometry=deconstruct_brep.Faces, referenceAll=0)  # -> Center, Dimension
deconstruct = Deconstruct(Point=center.Center)  # -> XComponent, YComponent, ZComponent
min_max = MinMax(Number=deconstruct.ZComponent)  # -> Minimum, Maximum
equality = Equality(FirstNumber=deconstruct.ZComponent, SecondNumber=min_max.Minimum)  # -> Equality, Inequality
panel = Panel(min_max.Maximum)
cull_pattern = CullPattern(List=deconstruct_brep.Faces, CullPattern=equality.Equality)
list = ClusterOutput(cull_pattern)

# ==== cluster BoxTopSurface_2
tree = ClusterInput()
clean_tree = CleanTree(RemoveNulls=True, RemoveInvalid=True, RemoveEmpty=False, Tree=tree)
deconstruct_brep = DeconstructBrep(Brep=clean_tree)  # -> Faces, Edges, Vertices
center = Center(Geometry=deconstruct_brep.Faces, referenceAll=0)  # -> Center, Dimension
deconstruct = Deconstruct(Point=center.Center)  # -> XComponent, YComponent, ZComponent
min_max = MinMax(Number=deconstruct.ZComponent)  # -> Minimum, Maximum
equality = Equality(FirstNumber=deconstruct.ZComponent, SecondNumber=min_max.Maximum)  # -> Equality, Inequality
panel = Panel(min_max.Maximum)
cull_pattern = CullPattern(List=deconstruct_brep.Faces, CullPattern=equality.Equality)
list = ClusterOutput(cull_pattern)

# ==== cluster BoxTopSurface_3
brep = ClusterInput()
deconstruct_brep = DeconstructBrep(Brep=brep)  # -> Faces, Edges, Vertices
center = Center(Geometry=deconstruct_brep.Faces, referenceAll=0)  # -> Center, Dimension
deconstruct = Deconstruct(Point=center.Center)  # -> XComponent, YComponent, ZComponent
min_max = MinMax(Number=deconstruct.ZComponent)  # -> Minimum, Maximum
equality = Equality(FirstNumber=deconstruct.ZComponent, SecondNumber=min_max.Maximum)  # -> Equality, Inequality
equality_2 = Equality(FirstNumber=deconstruct.ZComponent, SecondNumber=min_max.Minimum)  # -> Equality, Inequality
panel = Panel(min_max.Maximum)
gate_and = GateAnd(A=equality.Inequality, B=equality_2.Inequality)
cull_pattern = CullPattern(List=deconstruct_brep.Faces, CullPattern=gate_and)
list = ClusterOutput(cull_pattern)
