# Grasshopper definition Green roof for floods.gh (Grasshopper 1.0.8)
# plug-ins: RhinoCodePluginGH, Heteroptera, MeshEdit Components, Human UI, Pufferfish, ClipperComponents, Human, Parakeet, LunchBox, MetaHopper, Kangaroo2 Components, eleFront, Nautilus

get_selected_objects = GetSelectedObjects(AllObjects_Object=locate)  # -> ComponentObjects, ParamObjects, OtherObjects
panel = Panel("""0
1
2
3
4
5
6
7
8
9
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""")
create_slider = CreateSlider(
    Slider=get_selected_objects.ParamObjects,
    ShowBounds=False,
    ShowTicks=False,
    ShowTooltip=False,
    ShowValLabel=True,
    showLabel=True)
value_listener = ValueListener(Elements=create_slider, SomeProperty=True)  # -> Values, Indices
trim_tree = TrimTree(Tree=panel, Depth=1)
dependencies = GhPythonScript(Find=Toggle(False))  # -> Dep; inputs Find: Boolean
# ---------- dependencies: Python ----------
import Grasshopper as gh
if Find:

    asms = {}
    
    for obj in ghenv.Component.OnPingDocument().Objects:
        asm = gh.Instances.ComponentServer.FindAssemblyByObject(obj.ComponentGuid)

        if asm is not None and not asm.IsCoreLibrary:
            asms[asm.Name]=asm.Version
    
    
    if len(asms)==1: Dep= "No dependencies aparently... You are good"
    else: Dep = asms
    

    ghenv.Component.ExpireSolution(True)
    
else:
    Dep= "Toggle Find  to check"
# ---------- end dependencies ----------
get_selected_objects_2 = GetSelectedObjects(AllObjects_Object=user_inputs_roof_dead_load_bearing)  # -> ComponentObjects, ParamObjects, OtherObjects

panel_2 = Panel("""A reference Dead load for the green roof blocks, to be adaptable to the allowable extra loads on the roof.

Note: the Green roof blocks height will adapt automatically to this input.""")
get_selected_objects_3 = GetSelectedObjects()  # -> ComponentObjects, ParamObjects, OtherObjects
create_text_block = CreateTextBlock(Text=panel_2, TextSize=12, Justification=0)
create_text_box = CreateTextBox(Label="Roof Dead Load (Kg/m2)", DefaultText="600", UpdateButton=True, showLabel=True)
value_listener_2 = ValueListener(Elements=create_text_box, SomeProperty=True)  # -> Values, Indices
adjust_element_positioning = AdjustElementPositioning(
    ElementsToAdjust=create_text_block,
    Margin="0,20,0,0",
    AbsolutePositioning=False,
    Width=Slider(228, range=0..1000),
    Height=Slider(131, range=0..1000))
set_object_value = SetObjectValue(ObjectToSet=get_selected_objects_2.ParamObjects, ValueToSet=value_listener_2.Values)
merge = Merge(Data1=create_text_box, Data2=create_text_block)
create_expander = CreateExpander(UIElements=merge, Header="Loads", Open=True)
adjust_element_positioning_2 = AdjustElementPositioning(
    ElementsToAdjust=create_expander,
    Margin="0,20,0,0",
    AbsolutePositioning=False,
    Width=Slider(263, range=0..1000),
    Height=Slider(316, range=0..1000))

panel_3 = Panel(dependencies)

data = Data(panel)
create_checklist = CreateChecklist(ChecklistItems=data, Selected=False)
create_checklist_2 = CreateChecklist(ChecklistItems=data, Selected=False)
create_checklist_3 = CreateChecklist(ChecklistItems=data, Selected=False)
create_checklist_4 = CreateChecklist(ChecklistItems=data, Selected=False)
create_checklist_5 = CreateChecklist(ChecklistItems=data, Selected=False)
create_checklist_6 = CreateChecklist(ChecklistItems=data, Selected=False)
create_checklist_7 = CreateChecklist(ChecklistItems=data, Selected=False)
create_checklist_8 = CreateChecklist(ChecklistItems=data, Selected=False)
create_checklist_9 = CreateChecklist(ChecklistItems=data, Selected=False)
value_listener_3 = ValueListener(Elements=create_checklist_8, SomeProperty=True)  # -> Values, Indices
value_listener_4 = ValueListener(Elements=create_checklist_2, SomeProperty=True)  # -> Values, Indices
value_listener_5 = ValueListener(Elements=create_checklist, SomeProperty=True)  # -> Values, Indices
value_listener_6 = ValueListener(Elements=create_checklist_3, SomeProperty=True)  # -> Values, Indices
value_listener_7 = ValueListener(Elements=create_checklist_4, SomeProperty=True)  # -> Values, Indices
value_listener_8 = ValueListener(Elements=create_checklist_5, SomeProperty=True)  # -> Values, Indices
value_listener_9 = ValueListener(Elements=create_checklist_6, SomeProperty=True)  # -> Values, Indices
value_listener_10 = ValueListener(Elements=create_checklist_9, SomeProperty=True)  # -> Values, Indices
value_listener_11 = ValueListener(Elements=create_checklist_7, SomeProperty=True)  # -> Values, Indices
cull_pattern = CullPattern(List=data, CullPattern=value_listener_3.Values)
cull_pattern_2 = CullPattern(List=data, CullPattern=value_listener_5.Values)
cull_pattern_3 = CullPattern(List=data, CullPattern=value_listener_8.Values)
cull_pattern_4 = CullPattern(List=data, CullPattern=value_listener_7.Values)
cull_pattern_5 = CullPattern(List=data, CullPattern=value_listener_11.Values)
cull_pattern_6 = CullPattern(List=data, CullPattern=value_listener_10.Values)
cull_pattern_7 = CullPattern(List=data, CullPattern=value_listener_4.Values)
cull_pattern_8 = CullPattern(List=data, CullPattern=value_listener_6.Values)
cull_pattern_9 = CullPattern(List=data, CullPattern=value_listener_9.Values)

set_slider_properties = SetSliderProperties(Slider=get_selected_objects.ParamObjects, Value=value_listener.Values)
get_selected_objects_4 = GetSelectedObjects(AllObjects_Object=panel_91)  # -> ComponentObjects, ParamObjects, OtherObjects
get_selected_objects_5 = GetSelectedObjects(AllObjects_Object=[custom_preview_lineweights_15, custom_preview_lineweights_13, custom_preview_lineweights_14, custom_preview_lineweights_16])  # -> ComponentObjects, ParamObjects, OtherObjects

get_selected_objects_6 = GetSelectedObjects(AllObjects_Object=panel_16)  # -> ComponentObjects, ParamObjects, OtherObjects
create_text_box_2 = CreateTextBox(Label="Region radius (m)", DefaultText="60", UpdateButton=True, showLabel=True)
value_listener_12 = ValueListener(Elements=create_text_box_2, SomeProperty=True)  # -> Values, Indices
attach_tooltip_to_element = AttachTooltipToElement(
    ElementsToAttachTo=create_text_box_2,
    TooltipContent="Don't Foget to Press the Button",
    ShowDelay=500,
    Duration=Slider(5000, range=0..10000))
set_object_value_2 = SetObjectValue(ObjectToSet=get_selected_objects_6.ParamObjects, ValueToSet=value_listener_12.Values)
adjust_element_positioning_3 = AdjustElementPositioning(
    ElementsToAdjust=create_text_box_2,
    Margin="0,0,0,0",
    AbsolutePositioning=True,
    Width=Slider(261, range=0..1000),
    Height=Slider(28, range=0..1000))

get_selected_objects_7 = GetSelectedObjects(AllObjects_Object=custom_preview_lineweights_12)  # -> ComponentObjects, ParamObjects, OtherObjects
get_selected_objects_8 = GetSelectedObjects(AllObjects_Object=[custom_preview_lineweights_12, custom_preview_lineweights_15, custom_preview_lineweights_13, custom_preview_lineweights_14, mesh_colours_5, mesh_colours, mesh_colours_2, mesh_colours_3, mesh_colours_4, custom_preview_lineweights_16])  # -> ComponentObjects, ParamObjects, OtherObjects
get_selected_objects_9 = GetSelectedObjects(AllObjects_Object=[custom_preview_lineweights_12, custom_preview_lineweights_15, custom_preview_lineweights_13, custom_preview_lineweights_14, incidentradiation, custom_preview_lineweights_16])  # -> ComponentObjects, ParamObjects, OtherObjects
get_selected_objects_10 = GetSelectedObjects(AllObjects_Object=[custom_preview_lineweights_15, custom_preview_lineweights_13, custom_preview_lineweights_14, incidentradiation, mesh_colours_5, mesh_colours, mesh_colours_2, mesh_colours_3, mesh_colours_4, custom_preview_lineweights_16, cluster_10, point, data_19])  # -> ComponentObjects, ParamObjects, OtherObjects
get_selected_objects_11 = GetSelectedObjects(AllObjects_Object=[custom_preview_20, custom_preview_23, custom_preview_22, custom_preview_19, custom_preview_21, custom_preview_24, custom_preview_15, custom_preview_17, custom_preview_18, custom_preview_13, custom_preview_16, custom_preview_14, custom_preview_26])  # -> ComponentObjects, ParamObjects, OtherObjects
get_selected_objects_12 = GetSelectedObjects(AllObjects_Object=[custom_preview_lineweights_12, incidentradiation, mesh_colours_5, mesh_colours, mesh_colours_2, mesh_colours_3, mesh_colours_4])  # -> ComponentObjects, ParamObjects, OtherObjects
get_selected_objects_13 = GetSelectedObjects(AllObjects_Object=incidentradiation)  # -> ComponentObjects, ParamObjects, OtherObjects
get_selected_objects_14 = GetSelectedObjects(AllObjects_Object=grid_size_m)  # -> ComponentObjects, ParamObjects, OtherObjects
get_selected_objects_15 = GetSelectedObjects(AllObjects_Object=green_roof_percentage_2)  # -> ComponentObjects, ParamObjects, OtherObjects
get_selected_objects_16 = GetSelectedObjects(AllObjects_Object=divide_into_groups)  # -> ComponentObjects, ParamObjects, OtherObjects
get_selected_objects_17 = GetSelectedObjects(AllObjects_Object=panel_19)  # -> ComponentObjects, ParamObjects, OtherObjects
get_selected_objects_18 = GetSelectedObjects(AllObjects_Object=panel_17)  # -> ComponentObjects, ParamObjects, OtherObjects

create_file_picker = CreateFilePicker(ButtonLabelText="Buildings Geojson", DialogType=0, MustExist=True, Filter="All Files|*.*")
create_file_picker_2 = CreateFilePicker(ButtonLabelText="Context file R8", DialogType=0, MustExist=True, Filter="All Files|*.*")  # disabled
create_file_picker_3 = CreateFilePicker(ButtonLabelText="Highway Geojson", DialogType=0, MustExist=True, Filter="All Files|*.*")
value_listener_13 = ValueListener(Elements=create_file_picker, SomeProperty=True)  # -> Values, Indices
value_listener_14 = ValueListener(Elements=create_file_picker_3, SomeProperty=True)  # -> Values, Indices
set_object_value_3 = SetObjectValue(ObjectToSet=get_selected_objects_18.ParamObjects, ValueToSet=value_listener_13.Values)
set_object_value_4 = SetObjectValue(ObjectToSet=get_selected_objects_17.ParamObjects, ValueToSet=value_listener_14.Values)
python_3_script = Python3Script()  # -> out, a
# ---------- python_3_script: Python ----------
import rhinoscriptsyntax as rs
import os

def open_rhino_file(file_path):
    if os.path.exists(file_path):
        # Use the Rhino command to open the file
        rs.Command(f'-Open "{file_path}"')
    else:
        print("File not found! Check the file path.")

# Check if the input file_path is valid
if file_path:
    open_rhino_file(file_path)
else:
    print("No file path provided.")
# ---------- end python_3_script ----------
adjust_element_appearance = AdjustElementAppearance(FontSize=Slider(10, range=0..100))

create_label = CreateLabel(LabelText="Assign heights as per Building Tag", LabelSize=24, Justification=0)
adjust_element_positioning_4 = AdjustElementPositioning(
    ElementsToAdjust=create_label,
    AbsolutePositioning=False,
    Width=Slider(828, range=0..2100),
    Height=Slider(56, range=0..2100))

# ----
# Green roof percentage
number_slider = Slider(5, range=0..10)
create_slider_2 = CreateSlider(
    Slider=get_selected_objects_15.ParamObjects,
    SnapValue=number_slider,
    ShowBounds=False,
    ShowTicks=False,
    ShowTooltip=False,
    ShowValLabel=True,
    showLabel=True)
value_listener_15 = ValueListener(Elements=create_slider_2, SomeProperty=True)  # -> Values, Indices
set_slider_properties_2 = SetSliderProperties(Slider=get_selected_objects_15.ParamObjects, Value=value_listener_15.Values)

# ----
# Green roof Grid size
number_slider_2 = Slider(0.2, range=0..1)
create_slider_3 = CreateSlider(
    Slider=get_selected_objects_14.ParamObjects,
    SnapValue=number_slider_2,
    ShowBounds=False,
    ShowTicks=False,
    ShowTooltip=False,
    ShowValLabel=True,
    showLabel=True)
value_listener_16 = ValueListener(Elements=create_slider_3, SomeProperty=True)  # -> Values, Indices
set_slider_properties_3 = SetSliderProperties(Slider=get_selected_objects_14.ParamObjects, Value=value_listener_16.Values)

panel_4 = Panel("https://climate.onebuilding.org/WMO_Region_2_Asia/IND_India/MH_Maharashtra/IND_MH_Mumbai-Shivaji.Intl.AP.430030_TMYx.zip")
create_text_box_3 = CreateTextBox(Label="Paste EPW", DefaultText=panel_4, UpdateButton=True, showLabel=True)
value_listener_17 = ValueListener(Elements=create_text_box_3, SomeProperty=True)  # -> Values, Indices
set_object_value_5 = SetObjectValue(ObjectToSet=get_selected_objects_4.ParamObjects, ValueToSet=value_listener_17.Values)

get_selected_objects_19 = GetSelectedObjects(AllObjects_Object=[grid_in_rectangle_2, bounding_rectangle_3, point_in_brep_2, cull_pattern_19, offset_surface, cull_pattern_21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])  # -> ComponentObjects, ParamObjects, OtherObjects
create_toggle = CreateToggle(Default=False, Label="start")
value_listener_18 = ValueListener(Elements=create_toggle, SomeProperty=True)  # -> Values, Indices
enable_disable_object = EnableDisableObject(
    Objects=get_selected_objects_19.ComponentObjects,
    Enabled=value_listener_18.Values,
    AllObjects_Object=[grid_in_rectangle_2, bounding_rectangle_3, point_in_brep_2, cull_pattern_19, offset_surface, cull_pattern_21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])
enable_disable_object_2 = EnableDisableObject(
    Objects=get_selected_objects_19.ParamObjects,
    Enabled=value_listener_18.Values,
    AllObjects_Object=[number_slider_68, panel_85, starting_domain, number_slider_70, colour_swatch_31, number_slider_74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])
enable_disable_object_3 = EnableDisableObject(Objects=get_selected_objects_19.OtherObjects, Enabled=value_listener_18.Values)

get_selected_objects_20 = GetSelectedObjects(AllObjects_Object=md_slider)  # -> ComponentObjects, ParamObjects, OtherObjects
create_multidimensional_slider = CreateMultidimensionalSlider(StartingValue="0.33,0.30")
value_listener_19 = ValueListener(Elements=create_multidimensional_slider, SomeProperty=True)  # -> Values, Indices
set_object_value_6 = SetObjectValue(ObjectToSet=get_selected_objects_20.ParamObjects, ValueToSet=value_listener_19.Values)
adjust_element_positioning_5 = AdjustElementPositioning(
    ElementsToAdjust=create_multidimensional_slider,
    Margin="0,0,0,0",
    AbsolutePositioning=True,
    Width=Slider(388, range=0..1000),
    Height=Slider(371, range=0..1000))

create_slider_4 = CreateSlider(
    Slider=get_selected_objects_16.ParamObjects,
    ShowBounds=False,
    ShowTicks=False,
    ShowTooltip=False,
    ShowValLabel=True,
    showLabel=True)
value_listener_20 = ValueListener(Elements=create_slider_4, SomeProperty=True)  # -> Values, Indices
set_slider_properties_4 = SetSliderProperties(Slider=get_selected_objects_16.ParamObjects, Value=value_listener_20.Values)

panel_5 = Panel("Reduced run off percentage")
create_chart = CreateChart(Data="1", Names=panel_5, Title="Predicted Reduction Run Off %", ChartType=4)
adjust_element_appearance_2 = AdjustElementAppearance(
    ElementsToAdjust=create_chart,
    Foreground=ColourSwatch(SwatchColor=RGB(255, 255, 255)),
    Background=ColourSwatch(SwatchColor=RGB(33, 33, 33)),
    FontSize=Slider(14, range=0..20))
create_border = CreateBorder(UIElement=create_chart, BorderThickness=5, BorderColor=RGB(0, 0, 0), CornerRadius=3)
adjust_element_positioning_6 = AdjustElementPositioning(
    ElementsToAdjust=create_border,
    Margin="0,0,0,0",
    AbsolutePositioning=False,
    Width=Slider(394, range=0..1000),
    Height=Slider(358, range=0..1000),
    HorizontalAlignment=Slider(0, range=0..2),
    VerticalAlignment=Slider(2, range=0..2))
set_chart_contents = SetChartContents(ChartToModify=create_chart, NewChartNames=panel_5)
chart_appearance = ChartAppearance(
    ChartToModify=create_chart,
    Colors=[ColourSwatch(SwatchColor=RGB(155, 209, 242)), ColourSwatch(SwatchColor=RGB(57, 164, 230)), ColourSwatch(SwatchColor=RGB(44, 106, 145))])

create_label_2 = CreateLabel(LabelText="Estimated Total Runoff Volume     (Existing)", LabelSize=12, Justification=0)
adjust_element_appearance_3 = AdjustElementAppearance(
    ElementsToAdjust=create_label_2,
    Foreground=ColourSwatch(SwatchColor=RGB(232, 232, 232)),
    FontSize=Slider(24, range=0..30))

create_toggle_2 = CreateToggle(Default="True", Label="Original", OnLabel="On", OffLabel="Off")
value_listener_21 = ValueListener(Elements=create_toggle_2, SomeProperty=True)  # -> Values, Indices
hide_show_object_preview = HideShowObjectPreview(Objects=get_selected_objects_10.ComponentObjects, Visible=invert(value_listener_21.Values))
hide_show_object_preview_2 = HideShowObjectPreview(Objects=get_selected_objects_7.ComponentObjects, Visible=value_listener_21.Values)

create_toggle_3 = CreateToggle(Default="False", Label="Radiation levels", OnLabel="Radiation on", OffLabel="Radiation off")
value_listener_22 = ValueListener(Elements=create_toggle_3, SomeProperty=True)  # -> Values, Indices
hide_show_object_preview_3 = HideShowObjectPreview(Objects=get_selected_objects_8.ComponentObjects, Visible=invert(value_listener_22.Values))
hide_show_object_preview_4 = HideShowObjectPreview(Objects=get_selected_objects_13.ComponentObjects, Visible=value_listener_22.Values)

panel_6 = Panel("Estimated Total Runoff Volume    (After modifications)")  # disabled
create_label_3 = CreateLabel(LabelText=panel_6, LabelSize=12, Justification=0)  # disabled
number_slider_3 = Slider(24, range=0..30)  # disabled
colour_swatch = ColourSwatch(SwatchColor=RGB(232, 232, 232))  # disabled
adjust_element_appearance_4 = AdjustElementAppearance(ElementsToAdjust=create_label_3, Foreground=colour_swatch, FontSize=number_slider_3)  # disabled

create_toggle_4 = CreateToggle(Default="False", Label="Vegetation type", OnLabel="Vegetation type on", OffLabel="Vegetation type off")
value_listener_23 = ValueListener(Elements=create_toggle_4, SomeProperty=True)  # -> Values, Indices
hide_show_object_preview_5 = HideShowObjectPreview(Objects=get_selected_objects_9.ComponentObjects, Visible=invert(value_listener_23.Values))
hide_show_object_preview_6 = HideShowObjectPreview(
    Objects=[get_selected_objects_11.ComponentObjects, get_selected_objects_11.OtherObjects],
    Visible=value_listener_23.Values)

create_toggle_5 = CreateToggle(Default="False", Label="Soil Depth", OnLabel="Soil Depth on", OffLabel="Soil Depth off")
value_listener_24 = ValueListener(Elements=create_toggle_5, SomeProperty=True)  # -> Values, Indices
hide_show_object_preview_7 = HideShowObjectPreview(Objects=get_selected_objects_12.ComponentObjects, Visible=invert(value_listener_24.Values))
hide_show_object_preview_8 = HideShowObjectPreview(Objects=get_selected_objects_5.ComponentObjects, Visible=value_listener_24.Values)

adjust_element_appearance_5 = AdjustElementAppearance(ElementsToAdjust=create_text_block, Foreground=ColourSwatch(SwatchColor=RGB(145, 145, 145)))

panel_7 = Panel("https://colab.research.google.com/drive/1L0AFO0ew2kDGoL1DWifYGX11eO9e9vLP?usp=drive_link")
create_button = CreateButton(ButtonName="Go Macro First", ButtonStyle=0)
value_listener_25 = ValueListener(Elements=create_button, SomeProperty=True)  # -> Values, Indices
python_3_script_2 = Python3Script(URL=panel_7, y=value_listener_25.Values)  # -> out, a
# ---------- python_3_script_2: Python ----------
import webbrowser

# Function to open URL based on the boolean value of y
def open_link(y: bool):
    if y:  # If y is True, open the link
        url = URL  # Replace with your desired HTML link
        webbrowser.open(url)
    else:
        print("y is False, not opening the link.")

# Example usage
y = y  # Set y to True or False based on your condition
open_link(y)  # This will open the link if y is True
# ---------- end python_3_script_2 ----------

get_selected_objects_21 = GetSelectedObjects(AllObjects_Object=of_roof_area_as_green_2)  # -> ComponentObjects, ParamObjects, OtherObjects
of_roof_area_as_green = Panel("20")
green_roof_percentage = Panel("Green roof percentage %")
create_text_box_4 = CreateTextBox(Label=green_roof_percentage, DefaultText=of_roof_area_as_green, UpdateButton=True, showLabel=True)
value_listener_26 = ValueListener(Elements=create_text_box_4, SomeProperty=True)  # -> Values, Indices
set_object_value_7 = SetObjectValue(ObjectToSet=get_selected_objects_21.ParamObjects, ValueToSet=value_listener_26.Values)

get_selected_objects_22 = GetSelectedObjects(AllObjects_Object=value_list_3)  # -> ComponentObjects, ParamObjects, OtherObjects
panel_8 = Panel("""EXTENSIVE MINERAL SUBSTRATE
EXTENSIVE MINERAL SUBSTRATE LIGHT
EXTENSIVE MINERAL SUBSTRATE
EXTENSIVE SUBSTRATE LIGHT
EXTENSIVE SUBSTRATE EXTRA LIGHT
INTENSIVE SUBSTRATE            
EXTENSIVE SUBSTRATE EXTRA LIGHT  
INTENSIVE SUBSTRATE EXTRA LIGHT
INTENSIVE PLANT SUBSTRATE      
INTENSIVE PLANT SUBSTRATE TG      """)
create_pulldown_menu = CreatePulldownMenu(Label="Green roof Vegetation type", ListItems=panel_8, showLabel=True)
value_listener_27 = ValueListener(Elements=create_pulldown_menu, SomeProperty=True)  # -> Values, Indices
adjust_element_positioning_7 = AdjustElementPositioning(
    ElementsToAdjust=create_pulldown_menu,
    AbsolutePositioning=False,
    Width=Slider(393, range=0..1000),
    HorizontalAlignment=0)
set_object_value_8 = SetObjectValue(ObjectToSet=get_selected_objects_22.ParamObjects, ValueToSet=value_listener_27.Values)

get_selected_objects_23 = GetSelectedObjects(AllObjects_Object=panel_95)  # -> ComponentObjects, ParamObjects, OtherObjects

get_selected_objects_24 = GetSelectedObjects(AllObjects_Object=total_building_roof_area_3)  # -> ComponentObjects, ParamObjects, OtherObjects
total_building_roof_area = Panel("Total buildings roof area")
total_building_roof_area_2 = Panel("500")
create_text_box_5 = CreateTextBox(Label=total_building_roof_area, DefaultText=total_building_roof_area_2, UpdateButton=True, showLabel=True)
value_listener_28 = ValueListener(Elements=create_text_box_5, SomeProperty=True)  # -> Values, Indices
set_object_value_9 = SetObjectValue(ObjectToSet=get_selected_objects_24.ParamObjects, ValueToSet=value_listener_28.Values)

attach_tooltip_to_element_2 = AttachTooltipToElement(ElementsToAttachTo=create_file_picker_3, TooltipContent="Optional", ShowDelay=500, Duration=2000)

get_selected_objects_25 = GetSelectedObjects(AllObjects_Object=[custom_preview_lineweights_3, colour_swatch_8, boundary_surfaces, region_union, brep_curve, surface_split, center_4, cull_pattern_12, pull_point, smaller_than_2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])  # -> ComponentObjects, ParamObjects, OtherObjects
create_toggle_6 = CreateToggle(Default=False, Label="start")
value_listener_29 = ValueListener(Elements=create_toggle_6, SomeProperty=True)  # -> Values, Indices
enable_disable_object_4 = EnableDisableObject(
    Objects=get_selected_objects_25.ComponentObjects,
    Enabled=value_listener_29.Values,
    AllObjects_Object=[custom_preview_lineweights_3, boundary_surfaces, region_union, brep_curve, surface_split, center_4, cull_pattern_12, pull_point, smaller_than_2, box_top_surface_5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])
enable_disable_object_5 = EnableDisableObject(
    Objects=get_selected_objects_25.ParamObjects,
    Enabled=value_listener_29.Values,
    AllObjects_Object=[colour_swatch_8, number_slider_37, run_off_coeffecient_concrete, run_off_coeffecient_tiles_roof_slope, max_rain_fail_in_one_hour, run_off_coeffecient_asphalt, run_off_coeffecient_non_built])
enable_disable_object_6 = EnableDisableObject(Objects=get_selected_objects_25.OtherObjects, Enabled=value_listener_29.Values)

create_text_box_6 = CreateTextBox(Label="Currency ", UpdateButton=True, showLabel=True)

get_selected_objects_26 = GetSelectedObjects(AllObjects_Object=max_rain_fall_in_one_hour_3)  # -> ComponentObjects, ParamObjects, OtherObjects
max_rain_fall_in_one_hour = Panel("0.065")
max_rain_fall_in_one_hour_2 = Panel("Max rain fall in one hour")
create_text_box_7 = CreateTextBox(Label=max_rain_fall_in_one_hour_2, DefaultText=max_rain_fall_in_one_hour, UpdateButton=True, showLabel=True)
value_listener_30 = ValueListener(Elements=create_text_box_7, SomeProperty=True)  # -> Values, Indices
set_object_value_10 = SetObjectValue(ObjectToSet=get_selected_objects_26.ParamObjects, ValueToSet=value_listener_30.Values)

trim_tree_2 = TrimTree(Depth=1)
total_region_area = Panel("Total region area")

get_selected_objects_27 = GetSelectedObjects(AllObjects_Object=total_region_area_3)  # -> ComponentObjects, ParamObjects, OtherObjects
total_region_area_2 = Panel("1100")
create_text_box_8 = CreateTextBox(Label=total_region_area, DefaultText=total_region_area_2, UpdateButton=True, showLabel=True)
value_listener_31 = ValueListener(Elements=create_text_box_8, SomeProperty=True)  # -> Values, Indices
set_object_value_11 = SetObjectValue(ObjectToSet=get_selected_objects_27.ParamObjects, ValueToSet=value_listener_31.Values)

panel_9 = Panel("Urban areas frequently face challenges with rainwater management, including excessive runoff, flooding, and inefficient water collection. This research seeks to develop a parametric model that optimizes roof design for effective rainwater management. By collecting and analyzing data on urban locations with rainwater issues, we aim to inform the design process and achieve a balance between maximizing water collection and minimizing runoff.")
create_text_block_2 = CreateTextBlock(Text=panel_9, TextSize=12, Justification=3)
number_slider_4 = Slider(0, range=0..33)
adjust_element_positioning_8 = AdjustElementPositioning(
    ElementsToAdjust=create_text_block_2,
    Margin="0,50,0,0",
    AbsolutePositioning=True,
    Width=Slider(641, range=0..1000),
    Height=Slider(185, range=0..1000),
    HorizontalAlignment=1)
adjust_element_appearance_6 = AdjustElementAppearance(
    ElementsToAdjust=create_text_block_2,
    Foreground=ColourSwatch(SwatchColor=RGB(255, 255, 255)),
    Background=ColourSwatch(SwatchColor=RGBA(0, 32, 76, 0)),
    FontSize=Slider(17, range=0..100))

number_slider_5 = Slider(223, range=0..1000)
file_path = FilePath("C:\Users\Aly Mahmoud\Downloads\OIG1 (1).png")
create_image = CreateImage(ImageSource=file_path, ImageWidth=number_slider_5, ImageHeight=number_slider_5)
adjust_element_positioning_9 = AdjustElementPositioning(ElementsToAdjust=create_image, Margin="0,50,0,0", AbsolutePositioning=True, HorizontalAlignment=Slider(0, range=0..33))

value_listener_32 = ValueListener(Elements=create_text_box_6, SomeProperty=True)  # -> Values, Indices
adjust_element_appearance_7 = AdjustElementAppearance(ElementsToAdjust=create_text_box_2)

panel_10 = Panel("This analysis offers a holistic overview for identifying potential flooding hotspots caused by high urban density.")
create_label_4 = CreateLabel(LabelText=panel_10, LabelSize=12, Justification=0)
adjust_element_appearance_8 = AdjustElementAppearance(
    ElementsToAdjust=create_label_4,
    Foreground=ColourSwatch(SwatchColor=RGB(59, 203, 255)),
    FontSize=Slider(13, range=0..100))
adjust_element_positioning_10 = AdjustElementPositioning(
    ElementsToAdjust=create_label_4,
    AbsolutePositioning=False,
    Width=Slider(654, range=0..1000),
    Height=Slider(49, range=0..1000))

set_object_value_12 = SetObjectValue(ObjectToSet=get_selected_objects_23.ParamObjects, ValueToSet=value_listener_32.Values)
adjust_element_positioning_11 = AdjustElementPositioning(
    ElementsToAdjust=[create_file_picker, create_file_picker_2, create_file_picker_3],
    Margin="0,0,0,0",
    AbsolutePositioning=True,
    Width=Slider(264, range=0..1000),
    Height=Slider(35, range=0..1000))
get_selected_objects_28 = GetSelectedObjects(AllObjects_Object=panel_84)  # -> ComponentObjects, ParamObjects, OtherObjects
adjust_element_positioning_12 = AdjustElementPositioning(
    ElementsToAdjust=create_button,
    AbsolutePositioning=False,
    Width=Slider(312, range=0..1000),
    Height=Slider(39, range=0..1000))
adjust_element_positioning_13 = AdjustElementPositioning(
    ElementsToAdjust=create_text_box_3,
    AbsolutePositioning=False,
    Width=Slider(344, range=0..1000),
    Height=Slider(30, range=0..1000))
create_text_box_9 = CreateTextBox(Label="Select a Building", UpdateButton=True, showLabel=True)
create_separator = CreateSeparator(Thickness=Slider(102, range=0..1100), Horizontal=invert(True), Color=ColourSwatch(SwatchColor=RGB(38, 38, 38)))
adjust_element_positioning_14 = AdjustElementPositioning(
    ElementsToAdjust=[create_toggle_2, create_toggle_3],
    Margin="0,20,0,0",
    AbsolutePositioning=False,
    Width=Slider(277, range=0..1000),
    Height=Slider(60, range=0..1000),
    HorizontalAlignment=0)
value_listener_33 = ValueListener(Elements=create_text_box_9, SomeProperty=True)  # -> Values, Indices
create_stack = CreateStack(UIElements=[create_toggle, create_separator, create_text_box_9], Horizontal=True)
get_selected_objects_29 = GetSelectedObjects(AllObjects_Object=[herbs_4, cluster_12, herbs_3, herbs_2, cluster_11, cluster_18, cluster_13, herbs_5, cluster_14, cluster_16, cluster_3, cluster_17, cluster_15, cluster_19])  # -> ComponentObjects, ParamObjects, OtherObjects

create_label_5 = CreateLabel(LabelText="Site Selection", LabelSize=18, Justification=0)
create_label_6 = CreateLabel(LabelText="Center of Targeted Region", LabelSize=18, Justification=1)
adjust_element_positioning_15 = AdjustElementPositioning(ElementsToAdjust=create_label_5, AbsolutePositioning=False, Height=Slider(46, range=0..100))
adjust_element_appearance_9 = AdjustElementAppearance(ElementsToAdjust=create_label_6, FontSize=Slider(19, range=0..100))
merge_2 = Merge(Data1=create_label_5, Data2=create_multidimensional_slider, Data3=create_label_6)
create_stack_2 = CreateStack(UIElements=merge_2, Horizontal=invert(True))
adjust_element_positioning_16 = AdjustElementPositioning(ElementsToAdjust=create_stack_2, AbsolutePositioning=False, Width=Slider(383, range=0..1000), HorizontalAlignment=0)

number_slider_6 = Slider(11, range=0..100)
colour_swatch_2 = ColourSwatch(SwatchColor=RGB(38, 38, 38))
create_separator_2 = CreateSeparator(Thickness=number_slider_6, Horizontal=True, Color=colour_swatch_2)
create_separator_3 = CreateSeparator(Thickness=number_slider_6, Horizontal=True, Color=colour_swatch_2)
create_stack_3 = CreateStack(UIElements=[create_text_block_2, create_button, create_label_4], Horizontal=invert(True))

number_slider_7 = Slider(16, range=0..100)
cluster = Cluster_7(thickness=Slider(25, range=0..300))  # -> separator_2, separator_3, separator_6, separator, separator_4, separator_5, separator_7, separator_8
adjust_element_positioning_17 = AdjustElementPositioning(
    ElementsToAdjust=[create_text_box_8, create_text_box_5, create_text_box_4, create_pulldown_menu, create_text_box_7],
    AbsolutePositioning=False,
    Width=Slider(402, range=0..1000),
    HorizontalAlignment=0)

cluster_2 = Cluster_3(thickness=Slider(40, range=0..100))  # -> separator_2, separator_3, separator_6, separator, separator_4, separator_5, separator_7, separator_8
merge_3 = Merge(
    Data1=create_checklist_8,
    Data2=cluster_2.separator_2,
    Data3=create_checklist_7,
    Data4=cluster_2.separator_3,
    Data5=create_checklist_9,
    Data6=cluster_2.separator_6,
    Data7=create_checklist_6,
    Data8=cluster_2.separator,
    Data9=create_checklist_5,
    Data10=cluster_2.separator_4,
    Data11=create_checklist_4,
    Data12=cluster_2.separator_5,
    Data13=create_checklist_3,
    Data14=cluster_2.separator_7,
    Data15=create_checklist,
    Data16=cluster_2.separator_8,
    Data17=create_checklist_2)
create_stack_4 = CreateStack(UIElements=merge_3, Horizontal=True)
create_scroll_viewer = CreateScrollViewer(
    UIElements=create_stack_4,
    HorizontalScrollBarVisibility=2,
    VerticalScrollBarVisibility=1,
    Width=Slider(739, range=0..1500),
    Height=Slider(381, range=0..1000))

colrange = LBColorRange(index=Slider(27, range=0..100))  # -> colors; plug-in component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
get_selected_objects_30 = GetSelectedObjects(AllObjects_Object=[cull_pattern_28, pull_point_6, larger_than_4, pull_point_7, remap_numbers, bounds, construct_domain_4, starting_domain, constrained_area_rectangle, square, number_slider_70, box_rectangle, brep_wireframe_6, box_bottom_surface, join_curves_6, number_slider_69, clean_tree_4, box_top_surface_8, box_sides, entwine, panel_90, construct_domain_5, align_plane_2, number_slider_71, panel_88, panel_87])  # -> ComponentObjects, ParamObjects, OtherObjects
get_selected_objects_31 = GetSelectedObjects(AllObjects_Object=stream_filter)  # -> ComponentObjects, ParamObjects, OtherObjects
adjust_element_positioning_18 = AdjustElementPositioning(
    ElementsToAdjust=create_text_box_9,
    AbsolutePositioning=False,
    Width=Slider(215, range=0..1100),
    Height=Slider(29, range=0..1100),
    HorizontalAlignment=2,
    VerticalAlignment=0)

create_toggle_7 = CreateToggle(Default=False, Label=" Preview")
value_listener_34 = ValueListener(Elements=create_toggle_7, SomeProperty=True)  # -> Values, Indices
hide_show_object_preview_9 = HideShowObjectPreview(Objects=get_selected_objects_31.ComponentObjects, Visible=invert(value_listener_34.Values))
enable_disable_object_7 = EnableDisableObject(
    Objects=[get_selected_objects_30.ComponentObjects, get_selected_objects_30.ParamObjects, get_selected_objects_30.OtherObjects],
    Enabled=value_listener_34.Values,
    AllObjects_Object=[cull_pattern_28, pull_point_6, larger_than_4, pull_point_7, remap_numbers, bounds, construct_domain_4, constrained_area_rectangle, square, box_rectangle, brep_wireframe_6, box_bottom_surface, join_curves_6, clean_tree_4, box_top_surface_8, box_sides, entwine, construct_domain_5, align_plane_2, starting_domain, number_slider_70, number_slider_69, panel_90, number_slider_71, panel_88, panel_87])

merge_4 = Merge(Data1=create_slider_2, Data2=create_slider_3, Data3=create_slider_4, Data4=create_slider, Data6=create_toggle_7)
set_object_value_13 = SetObjectValue(ObjectToSet=get_selected_objects_28.ParamObjects, ValueToSet=value_listener_33.Values)
create_label_7 = CreateLabel(LabelText="Import Geojsons for the study zone", LabelSize=12, Justification=0)
adjust_element_positioning_19 = AdjustElementPositioning(
    ElementsToAdjust=create_label_7,
    AbsolutePositioning=False,
    Height=Slider(29, range=0..100),
    HorizontalAlignment=1,
    VerticalAlignment=1)

colour_swatch_3 = ColourSwatch(SwatchColor=RGB(74, 74, 74))
create_expander_2 = CreateExpander(UIElements=merge_4, Header="Generic Roof", Open=True)
adjust_element_appearance_10 = AdjustElementAppearance(
    ElementsToAdjust=merge_4,
    Foreground=ColourSwatch(SwatchColor=RGB(255, 255, 255)),
    Background=ColourSwatch(SwatchColor=RGB(38, 38, 38)),
    FontSize=Slider(12, range=0..100))
adjust_element_appearance_11 = AdjustElementAppearance(
    ElementsToAdjust=create_expander_2,
    Background=ColourSwatch(SwatchColor=RGB(49, 146, 181)),
    FontSize=Slider(25, range=0..100))
panel_11 = Panel("""0
1""")
merge_5 = Merge(Data1=create_expander_2, Data2=create_expander)
adjust_element_positioning_20 = AdjustElementPositioning(
    ElementsToAdjust=create_expander_2,
    Margin="0,20,0,0",
    AbsolutePositioning=False,
    Width=Slider(414, range=0..1000),
    Height=Slider(316, range=0..1000))
create_grid = CreateGrid(
    UIElements=merge_5,
    ColumnDefinitions=[Slider(422, range=0..1000), Slider(334, range=0..1000)],
    ElementColumn=panel_11,
    ElementRowSpan=1,
    ElementColumnSpan=1)

panel_12 = Panel("""0
0""")
create_stack_5 = CreateStack(UIElements=create_stack_3, Horizontal=invert(True))
get_selected_objects_32 = GetSelectedObjects(AllObjects_Object=stream_filter)  # -> ComponentObjects, ParamObjects, OtherObjects
get_selected_objects_33 = GetSelectedObjects(AllObjects_Object=[cull_pattern_28, pull_point_6, larger_than_4, pull_point_7, remap_numbers, bounds, construct_domain_4, starting_domain, constrained_area_rectangle, square, number_slider_70, box_rectangle, brep_wireframe_6, box_bottom_surface, join_curves_6, number_slider_69, clean_tree_4, box_top_surface_8, box_sides, entwine, panel_90, construct_domain_5, align_plane_2, number_slider_71, panel_88, panel_87])  # -> ComponentObjects, ParamObjects, OtherObjects

create_toggle_8 = CreateToggle(Default=False, Label=" Preview")
value_listener_35 = ValueListener(Elements=create_toggle_8, SomeProperty=True)  # -> Values, Indices
hide_show_object_preview_10 = HideShowObjectPreview(Objects=get_selected_objects_32.ComponentObjects, Visible=invert(value_listener_35.Values))
enable_disable_object_8 = EnableDisableObject(
    Objects=[get_selected_objects_33.ComponentObjects, get_selected_objects_33.ParamObjects, get_selected_objects_33.OtherObjects],
    Enabled=value_listener_35.Values,
    AllObjects_Object=[cull_pattern_28, pull_point_6, larger_than_4, pull_point_7, remap_numbers, bounds, construct_domain_4, constrained_area_rectangle, square, box_rectangle, brep_wireframe_6, box_bottom_surface, join_curves_6, clean_tree_4, box_top_surface_8, box_sides, entwine, construct_domain_5, align_plane_2, starting_domain, number_slider_70, number_slider_69, panel_90, number_slider_71, panel_88, panel_87])

get_selected_objects_34 = GetSelectedObjects()  # -> ComponentObjects, ParamObjects, OtherObjects
adjust_element_positioning_21 = AdjustElementPositioning(ElementsToAdjust=create_toggle_8, AbsolutePositioning=False, HorizontalAlignment=0, VerticalAlignment=1)
number_slider_8 = Slider(49, range=0..100)
colour_swatch_4 = ColourSwatch(SwatchColor=RGB(38, 38, 38))
create_separator_4 = CreateSeparator(Thickness=number_slider_8, Horizontal=True, Color=colour_swatch_4)
create_separator_5 = CreateSeparator(Thickness=number_slider_8, Horizontal=True, Color=colour_swatch_4)
create_separator_6 = CreateSeparator(Thickness=number_slider_8, Horizontal=True, Color=colour_swatch_4)

rhino_command = RhinoCommand(SendCommandToggle=Button(), CommandString="SelAll")
rhino_command_2 = RhinoCommand(SendCommandToggle=Button(), CommandString="Delete")

get_selected_objects_35 = GetSelectedObjects(AllObjects_Object=value_list)  # -> ComponentObjects, ParamObjects, OtherObjects

panel_13 = Panel("""Generic Green Roof 
Design my Own Roof""")
create_list_box = CreateListBox(ListItems=panel_13, SelectedIndex=0, Height=100)
create_label_8 = CreateLabel(LabelText="Select method ------->", LabelSize=12, Justification=0)
value_listener_36 = ValueListener(Elements=create_list_box, SomeProperty=True)  # -> Values, Indices
create_stack_6 = CreateStack(UIElements=[create_label_8, create_list_box], Horizontal=True)
set_object_value_14 = SetObjectValue(ObjectToSet=get_selected_objects_35.ParamObjects, ValueToSet=value_listener_36.Values)
adjust_element_appearance_12 = AdjustElementAppearance(ElementsToAdjust=[create_list_box, create_label_8], FontSize=Slider(17, range=0..100))
adjust_element_positioning_22 = AdjustElementPositioning(
    ElementsToAdjust=create_label_8,
    Margin="0,10,0,0",
    AbsolutePositioning=False,
    Width=Slider(190, range=0..1000),
    Height=Slider(55, range=0..1000),
    HorizontalAlignment=1,
    VerticalAlignment=2)
adjust_element_positioning_23 = AdjustElementPositioning(
    ElementsToAdjust=create_list_box,
    Margin="5,20,0,0",
    AbsolutePositioning=False,
    Width=Slider(217, range=0..1000),
    Height=Slider(80, range=0..1000),
    HorizontalAlignment=2,
    VerticalAlignment=2)

panel_14 = Panel("""Choose between 2 methods : 

-The Generic roof where you have control over the percentage and the grid size. 

-Design Your Roof gives the flexiability to manipulate the roof spaces more, place items that might be on the roof... etc.""")
create_text_block_3 = CreateTextBlock(Text=panel_14, TextSize=12, Justification=3)
adjust_element_appearance_13 = AdjustElementAppearance(ElementsToAdjust=create_text_block_3, Foreground=ColourSwatch(SwatchColor=RGB(135, 135, 135)))
number_slider_9 = Slider(21, range=0..100)
adjust_element_positioning_24 = AdjustElementPositioning(ElementsToAdjust=create_text_block_3, Margin="15,20,0,0", AbsolutePositioning=False, Width=Slider(236, range=0..1000))
colour_swatch_5 = ColourSwatch(SwatchColor=RGB(38, 38, 38))
create_stack_7 = CreateStack(UIElements=[create_stack_6, create_text_block_3], Horizontal=True)
create_separator_7 = CreateSeparator(Thickness=number_slider_9, Horizontal=True, Color=colour_swatch_5)
create_separator_8 = CreateSeparator(Thickness=number_slider_9, Horizontal=True, Color=colour_swatch_5)
get_selected_objects_36 = GetSelectedObjects(AllObjects_Object=enumerator_2)  # -> ComponentObjects, ParamObjects, OtherObjects
rhino_command_3 = RhinoCommand(SendCommandToggle=Button(), CommandString="ChangeLayer")
colour_swatch_6 = ColourSwatch(SwatchColor=RGB(3, 39, 76))

# ----
# grid size
grid_size_m = Slider(1, range=0.5..3)

# ----
# Green roof %
green_roof_percentage_2 = Slider(100, range=0..100)
division = Division(A=green_roof_percentage_2, B=100)

locate = Slider(0, range=0..1)

button = Button()
button_2 = Button()
button_3 = Button()
button_4 = Button()
rhino_command_4 = RhinoCommand(SendCommandToggle=button, CommandString="Points")
rhino_command_5 = RhinoCommand(SendCommandToggle=button_3, CommandString="SelPt")
rhino_command_6 = RhinoCommand(SendCommandToggle=button_4, CommandString="ChangeLayer")
create_layers = CreateLayers(CreateToggle=button_2, LayerNames="Point obstacles", LayerColors=ColourSwatch(SwatchColor=RGB(255, 0, 0)))

button_5 = Button()
button_6 = Button()
button_7 = Button()
button_8 = Button()
button_9 = Button()
rhino_command_7 = RhinoCommand(SendCommandToggle=button_5, CommandString="Rectangle")
rhino_command_8 = RhinoCommand(SendCommandToggle=button_7, CommandString="SelCrv")
rhino_command_9 = RhinoCommand(SendCommandToggle=button_8, CommandString="ChangeLayer")
rhino_command_10 = RhinoCommand(SendCommandToggle=button_9, CommandString="Delete")
create_layers_2 = CreateLayers(CreateToggle=button_6, LayerNames="Box Obstacles", LayerColors=ColourSwatch(SwatchColor=RGB(255, 255, 255)))

button_10 = Button()
curve = Curve([<curve referenced from the Rhino model> x4])
colour_swatch_7 = ColourSwatch(SwatchColor=RGB(23, 51, 0))
point = Point(Point(103559.2978, 2097246.828, 0))
number_slider_10 = Slider(10, range=0..10)

# ---- group: shrubs
cluster_3 = Cluster_6()  # disabled

# ----
number_slider_11 = Slider(2, range=0..100)
number_slider_12 = Slider(8, range=0..100)
number_slider_13 = Slider(2, range=0..100)
number_slider_14 = Slider(8, range=0..10)
number_slider_15 = Slider(8, range=0..10)
number_slider_16 = Slider(8, range=0..10)
number_slider_17 = Slider(3.97, range=0..10)
golden_ratio = GoldenRatio(Factor=1)
number_slider_18 = Slider(2, range=0..100)
number_slider_19 = Slider(2, range=0..100)
number_slider_20 = Slider(8, range=0..10)
number_slider_21 = Slider(8, range=0..10)
number_slider_22 = Slider(8, range=0..100)
number_slider_23 = Slider(8, range=0..10)
golden_ratio_2 = GoldenRatio(Factor=1)
number_slider_24 = Slider(2, range=0..100)
golden_ratio_3 = GoldenRatio(Factor=number_slider_17)
number_slider_25 = Slider(8, range=0..10)
multiplication = Multiplication(A=number_slider_17, B=1.15)
multiplication_2 = Multiplication(A=multiplication, B=1.15)
multiplication_3 = Multiplication(A=multiplication_2, B=1.15)
golden_ratio_4 = GoldenRatio(Factor=1)
number_slider_26 = Slider(8, range=0..100)
multiplication_4 = Multiplication(A=multiplication_3, B=1.15)
number_slider_27 = Slider(8, range=0..10)
number_slider_28 = Slider(16, range=0..100)
number_slider_29 = Slider(8, range=0..10)
number_slider_30 = Slider(11, range=0..100)
number_slider_31 = Slider(8, range=0..10)
number_slider_32 = Slider(4, range=0..100)
number_slider_33 = Slider(8, range=0..10)

cluster_4 = Cluster_13()  # -> surface_3, surface_2, surface, surface_7, surface_8, surface_9, mesh_2, textdot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
cluster_5 = Cluster_12()  # -> tween_4, tween_5, tween_6, tween_7, tween_8, tween_9, tween_10, tween_11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
merge_6 = Merge(
    Data1=cluster_5.tween_4,
    Data2=cluster_5.tween_5,
    Data3=cluster_5.tween_6,
    Data4=cluster_5.tween_7,
    Data5=cluster_5.tween_8,
    Data6=cluster_5.tween_9,
    Data7=cluster_5.tween_10,
    Data8=cluster_5.tween_11,
    Data9=cluster_5.tween_12,
    Data10=cluster_5.tween,
    Data11=cluster_5.tween_2,
    Data12=cluster_5.tween_3)
merge_7 = Merge(
    Data1=cluster_4.surface_3,
    Data2=cluster_4.surface_2,
    Data3=cluster_4.surface,
    Data4=cluster_4.surface_7,
    Data5=cluster_4.surface_8,
    Data6=cluster_4.surface_9,
    Data7=cluster_4.surface_10,
    Data8=cluster_4.surface_11,
    Data9=cluster_4.surface_12,
    Data10=cluster_4.surface_4,
    Data11=cluster_4.surface_5,
    Data12=cluster_4.surface_6)
center = Center(Geometry=merge_7)  # -> Center, Dimension
custom_preview = CustomPreview(Geometry=cluster_4.textdot, Material=cluster_4.colors)
data_2 = Data(["Mentha arvensis*", "Eclipta prostata", "Cynodon dactylon", "Ocimum tenuiflorum", "Flemingia strobilifera,Reinwardtia indica", """Achyranthes aspera,
Agave amica """, """Alocasia 
indica """, """Murraya
koenigii""", """Jasminum sambac-1
,Murraya exotica""", """Bauhinia 
tomentosa""", """Citrus limon
,Hibiscus species""", """Bauhinia racemosa
,Carica papaya"""])
unit_x = UnitX(Factor=Slider(8, range=0..10))
panel_15 = Panel("""Shade
Partial sun
Full sun
Shade
Partial sun
Full sun
Shade
Partial sun
Full sun
Shade
Partial sun
Full sun""")
custom_preview_2 = CustomPreview(Geometry=merge_7, Material=merge_6)
move = Move(Geometry=center.Center, Motion=unit_x)  # -> Geometry, Transform
line = Line(StartPoint=center.Center, EndPoint=move.Geometry)
define_text_dot = DefineTextDot(Text=panel_15, Location=move.Geometry, Font="Arial", Size=14)
custom_preview_3 = CustomPreview(Geometry=define_text_dot, Material=merge_6)

cluster_6 = Cluster_12()  # -> tween_4, tween_5, tween_6, tween_7, tween_8, tween_9, tween_10, tween_11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

control_wire_display = ControlWireDisplay(WireDisplay=2, AllObjects_Object=[merge_6, merge_7])
number_slider_34 = Slider(8, range=0..10)  # disabled
number_slider_35 = Slider(3, range=0..10)  # disabled
series = Series(Start=0, Step=number_slider_34, Count=number_slider_35)  # disabled
series_2 = Series(Start=Slider(4, range=0..20), Step=Slider(14, range=0..20), Count=Slider(2, range=0..30))
number_slider_36 = Slider(27, range=0..100)  # disabled
colrange_2 = LBColorRange(index=Slider(27, range=0..100))  # -> colors; plug-in component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
colrange_3 = LBColorRange(index=number_slider_36)  # -> colors; disabled; plug-in component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

# ----
# Green roof section
md_slider = MDSlider(
    SliderMode=0,
    slider_value=Point(0.6261287337, 0.5209214363, 0),
    x_domain=Domain(0, 1),
    y_domain=Domain(0, 1),
    z_domain=Domain(0, 1))
panel_16 = Panel("80")

point_2 = Point(md_slider)

panel_17 = Panel("C:\Users\Aly Mahmoud\Downloads\Malad west newbuildings.geojson")
shrimp_read_geojson = ShrimpGISReadGeojson(geojson_file=panel_17, run_it=Toggle(True))  # -> out, field, type, geometry; inputs run_it: Boolean; plug-in component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
geometry = Geometry(shrimp_read_geojson.geometry)
center_2 = Center(Geometry=flatten(geometry))  # -> Center, Dimension

bounding_rectangle = BoundingRectangle(Geometry=flatten(geometry), Plane=PlaneXY(0, 0, 0), Axis=0, Slide=0, Union=True)  # -> Bounding, DimensionX, DimensionY
evaluate_surface = EvaluateSurface(Surface=reparameterize(bounding_rectangle.Bounding), Point=point_2)  # -> Point, Normal, UDirection, VDirection, Frame
circle = Circle(Plane=evaluate_surface.Point, Radius=panel_16)
custom_preview_lineweights = CustomPreviewLineweights(Geometry=circle, Shader=ColourSwatch(SwatchColor=RGB(0, 0, 0)), Thickness=Slider(2.5, range=0..10), Absolute=False)

panel_18 = Panel(evaluate_surface.Point)

create_rhino_command_button = CreateRhinoCommandButton(ButtonName="Find my layout", RhinoScript="Zoom Selected", ButtonStyle=0)
value_listener_37 = ValueListener(Elements=create_rhino_command_button, SomeProperty=True)  # -> Values, Indices
zoom_to = ZoomTo(TargetPoint=evaluate_surface.Point, Reset=value_listener_37.Values, Distance=Slider(874, range=0..10000))

panel_19 = Panel("C:\Users\Aly Mahmoud\Downloads\Malad west highways.geojson")
shrimp_read_geojson_2 = ShrimpGISReadGeojson(geojson_file=panel_19, run_it=Toggle(True))  # -> out, field, type, geometry; inputs run_it: Boolean; plug-in component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
geometry_2 = Geometry(shrimp_read_geojson_2.geometry)
polyline_offset = PolylineOffset(
    Polylines=geometry_2,
    Distance=Slider(2, range=0..10),
    Plane=Plane(origin=(0, 0, 0), x=(0, 0, 0), y=(0, 0, 0)),
    Tolerance=0.01,
    ClosedFillet=1,
    OpenFillet=1,
    Miter=2)  # -> Contour, Holes
center_3 = Center(Geometry=flatten(polyline_offset.Contour))  # -> Center, Dimension
divide_curve = DivideCurve(Curve=circle, Count=10, Kinks=False)  # -> Points, Tangents, Parameters
distance = Distance(PointA=center_3.Center, PointB=divide_curve.Points)
smaller_than = SmallerThan(FirstNumber=distance, SecondNumber=Slider(550, range=0..550))  # -> SmallerThan, OrEqualTo
cull_pattern_10 = CullPattern(List=flatten(polyline_offset.Contour), CullPattern=smaller_than.SmallerThan)
cull_pattern_11 = CullPattern(List=flatten(polyline_offset.Contour), CullPattern=invert(smaller_than.SmallerThan))
region_union = RegionUnion(Curves=cull_pattern_10)  # disabled
boundary_surfaces = BoundarySurfaces(Edges=region_union)  # disabled
custom_preview_lineweights_2 = CustomPreviewLineweights(Geometry=cull_pattern_11, Shader=ColourSwatch(SwatchColor=RGB(0, 0, 0)), Absolute=False)
brep_curve = BrepCurve(Brep=boundary_surfaces, Curve=circle)  # -> flatten(Curves), Points; disabled
surface_split = SurfaceSplit(Surface=boundary_surfaces, Curves=brep_curve.Curves)  # -> flatten(Fragments); disabled
center_4 = Center(Geometry=surface_split)  # -> Center, Dimension; disabled
number_slider_37 = Slider(43, range=0..1010)  # disabled
pull_point = PullPoint(Point=center_4.Center, Geometry=evaluate_surface.Point, ClosestOnly=True)  # -> ClosestPoint, Distance; disabled
smaller_than_2 = SmallerThan(FirstNumber=pull_point.Distance, SecondNumber=number_slider_37)  # -> SmallerThan, OrEqualTo; disabled
cull_pattern_12 = CullPattern(List=surface_split, CullPattern=smaller_than_2.SmallerThan)  # disabled
colour_swatch_8 = ColourSwatch(SwatchColor=RGB(125, 125, 125))  # disabled
custom_preview_lineweights_3 = CustomPreviewLineweights(Geometry=[geometry_2, cull_pattern_12], Shader=colour_swatch_8, Absolute=False)  # disabled

file_path_2 = FilePath("C:\Users\Aly Mahmoud\Downloads\tardeo green.geojson")
shrimp_read_geojson_3 = ShrimpGISReadGeojson(geojson_file=file_path_2, run_it=Toggle(True))  # -> out, field, type, geometry; inputs run_it: Boolean; plug-in component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
geometry_3 = Geometry(shrimp_read_geojson_3.geometry)
center_5 = Center(Geometry=flatten(geometry_3))  # -> Center, Dimension
point_in_curve = PointInCurve(Point=center_5.Center, Curve=circle)  # -> Relationship, Point
cull_pattern_13 = CullPattern(List=flatten(geometry_3), CullPattern=point_in_curve.Relationship)
cull_pattern_14 = CullPattern(List=flatten(geometry_3), CullPattern=invert(point_in_curve.Relationship))
colour_swatch_9 = ColourSwatch(SwatchColor=RGB(0, 0, 0))
colour_swatch_10 = ColourSwatch(SwatchColor=RGB(76, 138, 0))
custom_preview_lineweights_4 = CustomPreviewLineweights(Geometry=cull_pattern_14, Shader=colour_swatch_10, Absolute=False)
custom_preview_lineweights_5 = CustomPreviewLineweights(Geometry=cull_pattern_13, Shader=colour_swatch_10, Absolute=False)

point_in_curve_2 = PointInCurve(Point=center_2.Center, Curve=circle)  # -> Relationship, Point
cull_pattern_15 = CullPattern(List=flatten(geometry), CullPattern=point_in_curve_2.Relationship)
cull_pattern_16 = CullPattern(List=flatten(geometry), CullPattern=invert(point_in_curve_2.Relationship))
custom_preview_lineweights_6 = CustomPreviewLineweights(Geometry=cull_pattern_15, Shader=ColourSwatch(SwatchColor=RGB(153, 132, 50)), Absolute=False)
custom_preview_lineweights_7 = CustomPreviewLineweights(Geometry=cull_pattern_16, Shader=ColourSwatch(SwatchColor=RGB(117, 117, 117)), Absolute=False)

list_indices = ListIndices(List=cull_pattern_15)
model_hatch = ModelHatch(
    Boundary=circle,
    HatchPattern={Lines=2, Path="Plus", Base=(-0.125, 0), Offset=(0, 1), Segments=[0.25, -0.75], Angle=1.570796327, Base=(0, -0.125), Offset=(0, 1), Segments=[0.25, -0.75]},
    Scale=Slider(6, range=0..100))  # -> Hatch, Boundary, HatchPattern, BasePoint, Rotation, Scale, ShowBoundary, Background, FillStyle
custom_preview_lineweights_8 = CustomPreviewLineweights(Geometry=geometry_2, Shader=ColourSwatch(SwatchColor=RGB(0, 0, 0)), Absolute=False)
set_checklist_contents = SetChecklistContents(ChecklistToModify=create_checklist_2, NewChecklistContents=list_indices)
set_checklist_contents_2 = SetChecklistContents(ChecklistToModify=create_checklist_3, NewChecklistContents=list_indices)
set_checklist_contents_3 = SetChecklistContents(ChecklistToModify=create_checklist, NewChecklistContents=list_indices)
set_checklist_contents_4 = SetChecklistContents(ChecklistToModify=create_checklist_4, NewChecklistContents=list_indices)
set_checklist_contents_5 = SetChecklistContents(ChecklistToModify=create_checklist_5, NewChecklistContents=list_indices)
set_checklist_contents_6 = SetChecklistContents(ChecklistToModify=create_checklist_6, NewChecklistContents=list_indices)
set_checklist_contents_7 = SetChecklistContents(ChecklistToModify=create_checklist_9, NewChecklistContents=list_indices)
set_checklist_contents_8 = SetChecklistContents(ChecklistToModify=create_checklist_7, NewChecklistContents=list_indices)
set_checklist_contents_9 = SetChecklistContents(ChecklistToModify=create_checklist_8, NewChecklistContents=list_indices)

# ----
# Building heights
number_slider_38 = Slider(8, range=0..10)
list_length = ListLength(List=cull_pattern_15)
construct_domain = ConstructDomain(DomainStart=number_slider_38, DomainEnd=Slider(31, range=0..100))
number_slider_39 = Slider(10, range=0..10)
random = Random(Range=construct_domain, Number=list_length, Seed=Slider(8, range=0..10))
unit_z = UnitZ(Factor=random)
extrude = Extrude(Base=cull_pattern_15, Direction=unit_z)
number_slider_40 = Slider(9, range=0..10)
list_item = ListItem(Index=Slider(22, range=0..100), Wrap=True)

merge_8 = Merge(
    Data1=create_label_7,
    Data2=create_file_picker,
    Data3=create_file_picker_3,
    Data4=create_rhino_command_button,
    Data5=create_text_box_2)
adjust_element_positioning_25 = AdjustElementPositioning(
    ElementsToAdjust=merge_8,
    Margin="0,10,0,0",
    AbsolutePositioning=False,
    Width=Slider(273, range=0..3000),
    Height=Slider(32, range=0..3000),
    HorizontalAlignment=0)

create_stack_8 = CreateStack(UIElements=merge_8, Horizontal=invert(True))
adjust_element_positioning_26 = AdjustElementPositioning(
    ElementsToAdjust=create_stack_8,
    AbsolutePositioning=False,
    Width=Slider(700, range=0..3000),
    Height=Slider(251, range=0..3000),
    HorizontalAlignment=0,
    VerticalAlignment=1)

create_stack_9 = CreateStack(UIElements=[create_stack_2, create_stack_8], Horizontal=True)
adjust_element_positioning_27 = AdjustElementPositioning(ElementsToAdjust=create_stack_9, AbsolutePositioning=False, Width=Slider(700, range=0..3000), HorizontalAlignment=0)

# ----
# UI SECTION
panel_20 = Panel("DELETE")
create_label_9 = CreateLabel(LabelText="Add rectangular obstacles on your roof", LabelSize=12, Justification=0)
create_label_10 = CreateLabel(LabelText="Create rectangle layer", LabelSize=12, Justification=0)
create_label_11 = CreateLabel(LabelText="place obstacle as rectangle", LabelSize=12, Justification=0)
create_label_12 = CreateLabel(LabelText="Select rectangles", LabelSize=12, Justification=0)
create_label_13 = CreateLabel(LabelText="set rectangles to the created layer", LabelSize=12, Justification=0)
create_label_14 = CreateLabel(LabelText=panel_20, LabelSize=12, Justification=0)
create_border_2 = CreateBorder(UIElement=create_label_9, BorderThickness=5, BorderColor=RGB(0, 0, 0), CornerRadius=Slider(1, range=0..1))
adjust_element_positioning_28 = AdjustElementPositioning(
    ElementsToAdjust=create_border_2,
    AbsolutePositioning=False,
    Width=Slider(310, range=0..1000),
    Height=Slider(47, range=0..1000),
    HorizontalAlignment=0,
    VerticalAlignment=2)
adjust_element_appearance_14 = AdjustElementAppearance(
    ElementsToAdjust=create_label_9,
    Foreground=ColourSwatch(SwatchColor=RGB(0, 0, 0)),
    Background=ColourSwatch(SwatchColor=RGB(30, 115, 168)),
    FontSize=Slider(16, range=0..100))

get_selected_objects_37 = GetSelectedObjects(AllObjects_Object=button_6)  # -> ComponentObjects, ParamObjects, OtherObjects
get_selected_objects_38 = GetSelectedObjects(AllObjects_Object=button_5)  # -> ComponentObjects, ParamObjects, OtherObjects
get_selected_objects_39 = GetSelectedObjects(AllObjects_Object=button_7)  # -> ComponentObjects, ParamObjects, OtherObjects
get_selected_objects_40 = GetSelectedObjects(AllObjects_Object=button_8)  # -> ComponentObjects, ParamObjects, OtherObjects
get_selected_objects_41 = GetSelectedObjects(AllObjects_Object=button_9)  # -> ComponentObjects, ParamObjects, OtherObjects
get_selected_objects_42 = GetSelectedObjects(AllObjects_Object=buffer)  # -> ComponentObjects, ParamObjects, OtherObjects
create_button_2 = CreateButton(ButtonName="Create", ButtonStyle=0)
create_button_3 = CreateButton(ButtonName="place", ButtonStyle=0)
create_button_4 = CreateButton(ButtonName="Select", ButtonStyle=0)
create_button_5 = CreateButton(ButtonName="set layer", ButtonStyle=0)
create_button_6 = CreateButton(ButtonName="DELETE", ButtonStyle=0)
create_slider_5 = CreateSlider(
    Slider=get_selected_objects_42.ParamObjects,
    ShowBounds=False,
    ShowTicks=False,
    ShowTooltip=False,
    ShowValLabel=True,
    showLabel=True)
value_listener_38 = ValueListener(Elements=create_button_2, SomeProperty=True)  # -> Values, Indices
value_listener_39 = ValueListener(Elements=create_button_3, SomeProperty=True)  # -> Values, Indices
value_listener_40 = ValueListener(Elements=create_slider_5, SomeProperty=True)  # -> Values, Indices
value_listener_41 = ValueListener(Elements=create_button_4, SomeProperty=True)  # -> Values, Indices
value_listener_42 = ValueListener(Elements=create_button_5, SomeProperty=True)  # -> Values, Indices
value_listener_43 = ValueListener(Elements=create_button_6, SomeProperty=True)  # -> Values, Indices
set_object_value_15 = SetObjectValue(ObjectToSet=get_selected_objects_37.ParamObjects, ValueToSet=value_listener_38.Values)
set_object_value_16 = SetObjectValue(ObjectToSet=get_selected_objects_38.ParamObjects, ValueToSet=value_listener_39.Values)
set_object_value_17 = SetObjectValue(ObjectToSet=get_selected_objects_39.ParamObjects, ValueToSet=value_listener_41.Values)
set_object_value_18 = SetObjectValue(ObjectToSet=get_selected_objects_40.ParamObjects, ValueToSet=value_listener_42.Values)
set_object_value_19 = SetObjectValue(ObjectToSet=get_selected_objects_41.ParamObjects, ValueToSet=value_listener_43.Values)
set_slider_properties_5 = SetSliderProperties(Slider=get_selected_objects_42.ParamObjects, Value=value_listener_40.Values)
adjust_element_positioning_29 = AdjustElementPositioning(ElementsToAdjust=create_slider_5, AbsolutePositioning=False, Width=Slider(304, range=0..600), HorizontalAlignment=0)

create_label_15 = CreateLabel(LabelText="set points to the created layer", LabelSize=12, Justification=0)
create_label_16 = CreateLabel(LabelText="Place obstacles as points", LabelSize=12, Justification=0)
create_label_17 = CreateLabel(LabelText="Select points", LabelSize=12, Justification=0)
create_label_18 = CreateLabel(LabelText="create point layer", LabelSize=12, Justification=0)
create_label_19 = CreateLabel(LabelText="Add Point obstacles on your roof", LabelSize=12, Justification=0)
create_border_3 = CreateBorder(UIElement=create_label_19, BorderThickness=5, BorderColor=RGB(0, 0, 0), CornerRadius=Slider(1, range=0..1))
adjust_element_appearance_15 = AdjustElementAppearance(
    ElementsToAdjust=create_label_19,
    Foreground=ColourSwatch(SwatchColor=RGB(0, 0, 0)),
    Background=ColourSwatch(SwatchColor=RGB(30, 115, 168)),
    FontSize=Slider(16, range=0..100))
adjust_element_positioning_30 = AdjustElementPositioning(
    ElementsToAdjust=create_border_3,
    AbsolutePositioning=False,
    Width=Slider(255, range=0..1000),
    Height=Slider(47, range=0..1000),
    HorizontalAlignment=0,
    VerticalAlignment=2)

get_selected_objects_43 = GetSelectedObjects(AllObjects_Object=button_2)  # -> ComponentObjects, ParamObjects, OtherObjects
get_selected_objects_44 = GetSelectedObjects(AllObjects_Object=button)  # -> ComponentObjects, ParamObjects, OtherObjects
get_selected_objects_45 = GetSelectedObjects(AllObjects_Object=button_3)  # -> ComponentObjects, ParamObjects, OtherObjects
get_selected_objects_46 = GetSelectedObjects(AllObjects_Object=button_4)  # -> ComponentObjects, ParamObjects, OtherObjects
get_selected_objects_47 = GetSelectedObjects(AllObjects_Object=buffer_2)  # -> ComponentObjects, ParamObjects, OtherObjects
create_button_7 = CreateButton(ButtonName="create", ButtonStyle=0)
create_button_8 = CreateButton(ButtonName="Place", ButtonStyle=0)
create_button_9 = CreateButton(ButtonName="Select", ButtonStyle=0)
create_button_10 = CreateButton(ButtonName="set layer", ButtonStyle=0)
create_slider_6 = CreateSlider(
    Slider=get_selected_objects_47.ParamObjects,
    ShowBounds=False,
    ShowTicks=False,
    ShowTooltip=False,
    ShowValLabel=True,
    showLabel=True)
value_listener_44 = ValueListener(Elements=create_button_7, SomeProperty=True)  # -> Values, Indices
value_listener_45 = ValueListener(Elements=create_button_8, SomeProperty=True)  # -> Values, Indices
value_listener_46 = ValueListener(Elements=create_slider_6, SomeProperty=True)  # -> Values, Indices
value_listener_47 = ValueListener(Elements=create_button_9, SomeProperty=True)  # -> Values, Indices
value_listener_48 = ValueListener(Elements=create_button_10, SomeProperty=True)  # -> Values, Indices
set_object_value_20 = SetObjectValue(ObjectToSet=get_selected_objects_43.ParamObjects, ValueToSet=value_listener_44.Values)
set_object_value_21 = SetObjectValue(ObjectToSet=get_selected_objects_44.ParamObjects, ValueToSet=value_listener_45.Values)
set_object_value_22 = SetObjectValue(ObjectToSet=get_selected_objects_45.ParamObjects, ValueToSet=value_listener_47.Values)
set_object_value_23 = SetObjectValue(ObjectToSet=get_selected_objects_46.ParamObjects, ValueToSet=value_listener_48.Values)
set_slider_properties_6 = SetSliderProperties(Slider=get_selected_objects_47.ParamObjects, Value=value_listener_46.Values)

number_slider_41 = Slider(49, range=0..100)
colour_swatch_11 = ColourSwatch(SwatchColor=RGB(38, 38, 38))
adjust_element_positioning_31 = AdjustElementPositioning(
    ElementsToAdjust=[create_label_18, create_label_11, create_label_16, create_label_14, create_label_17, create_label_13, create_label_15, create_label_12, create_label_10],
    AbsolutePositioning=False,
    Width=Slider(205, range=0..1000),
    Height=Slider(29, range=0..1000))
adjust_element_appearance_16 = AdjustElementAppearance(
    ElementsToAdjust=[create_label_18, create_label_11, create_label_16, create_label_14, create_label_17, create_label_13, create_label_15, create_label_12, create_label_10],
    FontSize=Slider(13, range=0..100))

create_stack_10 = CreateStack(UIElements=[create_label_17, create_button_9], Horizontal=True)
create_stack_11 = CreateStack(UIElements=[create_label_16, create_button_8], Horizontal=True)
create_stack_12 = CreateStack(UIElements=[create_label_15, create_button_10], Horizontal=True)
create_stack_13 = CreateStack(UIElements=[create_label_18, create_button_7], Horizontal=True)
create_separator_9 = CreateSeparator(Thickness=number_slider_41, Horizontal=True, Color=colour_swatch_11)
create_separator_10 = CreateSeparator(Thickness=number_slider_41, Horizontal=True, Color=colour_swatch_11)
create_separator_11 = CreateSeparator(Thickness=number_slider_41, Horizontal=True, Color=colour_swatch_11)
create_separator_12 = CreateSeparator(Thickness=Slider(140, range=0..200), Horizontal=True, Color=colour_swatch_11)

create_stack_14 = CreateStack(UIElements=[create_label_11, create_button_3], Horizontal=True)
create_stack_15 = CreateStack(UIElements=[create_label_10, create_button_2], Horizontal=True)
create_stack_16 = CreateStack(UIElements=[create_label_14, create_button_6], Horizontal=True)
create_stack_17 = CreateStack(UIElements=[create_label_13, create_button_5], Horizontal=True)
create_stack_18 = CreateStack(UIElements=[create_label_12, create_button_4], Horizontal=True)
create_separator_13 = CreateSeparator(Thickness=number_slider_41, Horizontal=True, Color=colour_swatch_11)
create_separator_14 = CreateSeparator(Thickness=number_slider_41, Horizontal=True, Color=colour_swatch_11)
create_separator_15 = CreateSeparator(Thickness=number_slider_41, Horizontal=True, Color=colour_swatch_11)
create_separator_16 = CreateSeparator(Thickness=number_slider_41, Horizontal=True, Color=colour_swatch_11)

create_separator_17 = CreateSeparator(Thickness=number_slider_41, Horizontal=True, Color=colour_swatch_11)

merge_9 = Merge(
    Data1=create_border_2,
    Data2=create_stack_15,
    Data3=create_separator_13,
    Data4=create_stack_14,
    Data5=create_separator_14,
    Data6=create_stack_18,
    Data7=create_separator_15,
    Data8=create_stack_17,
    Data9=create_separator_16,
    Data10=create_stack_16,
    Data11=create_separator_17,
    Data12=create_slider_5,
    Data13=create_toggle_8)
merge_10 = Merge(
    Data1=create_border_3,
    Data2=create_stack_13,
    Data3=create_separator_9,
    Data4=create_stack_11,
    Data5=create_separator_10,
    Data6=create_stack_10,
    Data7=create_separator_11,
    Data8=create_stack_12,
    Data9=create_separator_12,
    Data10=create_slider_6)
create_stack_19 = CreateStack(UIElements=merge_10, Horizontal=invert(True))
create_stack_20 = CreateStack(UIElements=merge_9, Horizontal=invert(True))
create_stack_21 = CreateStack(UIElements=[create_stack_19, create_stack_20], Horizontal=True)
get_selected_objects_48 = GetSelectedObjects()  # -> ComponentObjects, ParamObjects, OtherObjects
adjust_element_positioning_32 = AdjustElementPositioning(
    ElementsToAdjust=create_stack_19,
    AbsolutePositioning=False,
    Width=Slider(333, range=0..1000),
    Height=Slider(555, range=0..1000),
    HorizontalAlignment=0,
    VerticalAlignment=2)
adjust_element_positioning_33 = AdjustElementPositioning(
    ElementsToAdjust=create_stack_20,
    Margin="20,0,0,0",
    AbsolutePositioning=False,
    Width=Slider(575, range=0..1000),
    Height=Slider(594, range=0..1000),
    HorizontalAlignment=0,
    VerticalAlignment=2)
panel_21 = Panel("""Generic Green Roof 
Design my Own Roof""")
create_expander_3 = CreateExpander(UIElements=create_stack_21, Header="Design your roof", Open=True)
create_label_20 = CreateLabel(LabelText="Select methode ------->", LabelSize=12, Justification=0)
create_list_box_2 = CreateListBox(ListItems=panel_21, SelectedIndex=0, Height=100)
value_listener_49 = ValueListener(Elements=create_list_box_2, SomeProperty=True)  # -> Values, Indices
create_stack_22 = CreateStack(UIElements=[create_label_20, create_list_box_2], Horizontal=True)
set_object_value_24 = SetObjectValue(ObjectToSet=get_selected_objects_48.ParamObjects, ValueToSet=value_listener_49.Values)
create_stack_23 = CreateStack(UIElements=create_label_20, Horizontal=invert(True))
adjust_element_appearance_17 = AdjustElementAppearance(ElementsToAdjust=create_expander_3, FontSize=Slider(30, range=0..100))
adjust_element_positioning_34 = AdjustElementPositioning(
    ElementsToAdjust=create_expander_3,
    AbsolutePositioning=False,
    Width=Slider(688, range=0..1000),
    Height=Slider(661, range=0..1000),
    HorizontalAlignment=0,
    VerticalAlignment=0)
adjust_element_positioning_35 = AdjustElementPositioning(
    ElementsToAdjust=create_label_20,
    AbsolutePositioning=invert(False),
    Width=Slider(225, range=0..1000),
    Height=Slider(89, range=0..1000),
    HorizontalAlignment=3,
    VerticalAlignment=0)
adjust_element_appearance_18 = AdjustElementAppearance(ElementsToAdjust=[create_list_box_2, create_label_20], FontSize=Slider(17, range=0..100))

create_button_11 = CreateButton(ButtonName="Select/Zoom", ButtonStyle=0)
panel_22 = Panel("""Select the pitched Roof Buildings in the study zone.

Then press this button to change their layer to Pitched Roof layer""")
create_button_12 = CreateButton(ButtonName="Delete", ButtonStyle=0)
create_button_13 = CreateButton(ButtonName="Bake !", ButtonStyle=0)
create_button_14 = CreateButton(ButtonName="Change To Pitched Roof Layer", ButtonStyle=0)
create_label_21 = CreateLabel(LabelText=panel_22, LabelSize=12, Justification=1)
value_listener_50 = ValueListener(Elements=create_button_14, SomeProperty=True)  # -> Values, Indices
attach_tooltip_to_element_3 = AttachTooltipToElement(
    ElementsToAttachTo=create_button_13,
    TooltipContent="Press twice please ",
    ShowDelay=500,
    Duration=Slider(50000, range=0..100000))
merge_11 = Merge(Data1=create_button_13, Data2=create_button_11, Data3=create_button_12, Data4=create_button_14)
adjust_element_positioning_36 = AdjustElementPositioning(ElementsToAdjust=create_label_21, AbsolutePositioning=False, Width=Slider(447, range=0..900), VerticalAlignment=1)
create_stack_24 = CreateStack(UIElements=merge_11, Horizontal=True)
rhino_command_11 = RhinoCommand(SendCommandToggle=value_listener_50.Values, CommandString="ChangeLayer")
create_border_4 = CreateBorder(UIElement=create_stack_24, BorderThickness=5, BorderColor=RGB(0, 0, 0), CornerRadius=0)
create_stack_25 = CreateStack(UIElements=[create_label_21, create_button_14], Horizontal=True)
adjust_element_positioning_37 = AdjustElementPositioning(
    ElementsToAdjust=create_border_4,
    Margin="0,20,0,0",
    AbsolutePositioning=False,
    Width=Slider(674, range=0..1100),
    Height=Slider(68, range=0..1100),
    HorizontalAlignment=0)
adjust_element_positioning_38 = AdjustElementPositioning(
    ElementsToAdjust=merge_11,
    AbsolutePositioning=False,
    Width=Slider(213, range=0..1100),
    Height=Slider(47, range=0..1100),
    VerticalAlignment=2)
create_stack_26 = CreateStack(UIElements=[create_border_4, create_stack_25], Horizontal=invert(True))
adjust_element_appearance_19 = AdjustElementAppearance(ElementsToAdjust=[create_button_14, create_label_21], FontSize=Slider(14, range=0..100))

value_listener_51 = ValueListener(Elements=create_button_11, SomeProperty=True)  # -> Values, Indices
panel_23 = Panel(value_listener_51.Values)
value_listener_52 = ValueListener(Elements=create_button_12, SomeProperty=True)  # -> Values, Indices
rhino_command_12 = RhinoCommand(SendCommandToggle=value_listener_51.Values, CommandString="Zoom Selected")

rhino_command_13 = RhinoCommand(SendCommandToggle=value_listener_51.Values, CommandString=["SelPolysrf", "Selsrf"])
rhino_command_14 = RhinoCommand(SendCommandToggle=value_listener_52.Values, CommandString="Delete")

value_listener_53 = ValueListener(Elements=create_button_13, SomeProperty=True)  # -> Values, Indices

number_slider_42 = Slider(22, range=0..100)
adjust_element_appearance_20 = AdjustElementAppearance(
    ElementsToAdjust=create_button_13,
    Foreground=ColourSwatch(SwatchColor=RGB(255, 255, 255)),
    Background=ColourSwatch(SwatchColor=RGB(47, 67, 125)),
    FontSize=number_slider_42)
adjust_element_appearance_21 = AdjustElementAppearance(
    ElementsToAdjust=create_button_11,
    Foreground=ColourSwatch(SwatchColor=RGB(255, 255, 255)),
    Background=ColourSwatch(SwatchColor=RGB(0, 0, 0)),
    FontSize=number_slider_42)
adjust_element_appearance_22 = AdjustElementAppearance(
    ElementsToAdjust=create_button_12,
    Foreground=ColourSwatch(SwatchColor=RGB(0, 0, 0)),
    Background=ColourSwatch(SwatchColor=RGB(255, 255, 255)),
    FontSize=number_slider_42)

panel_24 = Panel("The results are from shallow machine learning XG Boost regression model, trained on datasets of 1400 neighborhoods with varying urban densities, achieved an R² score of 0.981. The predicted vs. actual values plot reveals a strong diagonal trend, indicating good model performance.")
create_text_block_4 = CreateTextBlock(Text=panel_24, TextSize=16, Justification=3)
adjust_element_positioning_39 = AdjustElementPositioning(ElementsToAdjust=create_text_block_4, Margin="5,0,5,0", AbsolutePositioning=False, Width=Slider(281, range=0..1000))
create_separator_18 = CreateSeparator(Thickness=Slider(32, range=0..1000), Horizontal=True, Color=ColourSwatch(SwatchColor=RGB(38, 38, 38)))

adjust_element_appearance_23 = AdjustElementAppearance(ElementsToAdjust=create_text_block_4, Foreground=ColourSwatch(SwatchColor=RGB(135, 135, 135)))

panel_25 = Panel("1 Floor")
panel_26 = Panel("2 Floor")
panel_27 = Panel("3 Floor")
panel_28 = Panel("4 Floor")
panel_29 = Panel("5 Floor")
panel_30 = Panel("6 Floor")
panel_31 = Panel("7 Floor")
panel_32 = Panel("8 Floor")
panel_33 = Panel("15 Floor")

# ----
# Charts
panel_34 = Panel("Green Roof Percentage")
panel_35 = Panel("""0
1
2
3
4
5
6
7
8""")
create_chart_2 = CreateChart(Data=panel_35, Names="%", Title=panel_34, ChartType=4)
adjust_element_appearance_24 = AdjustElementAppearance(ElementsToAdjust=create_chart_2, Foreground=ColourSwatch(SwatchColor=RGB(255, 255, 255)))
number_slider_43 = Slider(389, range=0..1000)
chart_appearance_2 = ChartAppearance(ChartToModify=create_chart_2, Colors=ColourSwatch(SwatchColor=RGB(132, 209, 69)))

concatenate = Concatenate(Fragment_A="The non-built up area of this region is  ", Fragment_B="0", A=" m2")
create_label_22 = CreateLabel(LabelText=concatenate, LabelSize=12, Justification=0)
adjust_element_appearance_25 = AdjustElementAppearance(
    ElementsToAdjust=create_label_22,
    Foreground=ColourSwatch(SwatchColor=RGB(232, 232, 232)),
    FontSize=Slider(24, range=0..30))

concatenate_2 = Concatenate(Fragment_A="The built up area of this region is  ", Fragment_B="0", A=" m2")
create_label_23 = CreateLabel(LabelText=concatenate_2, LabelSize=12, Justification=0)
adjust_element_appearance_26 = AdjustElementAppearance(
    ElementsToAdjust=create_label_23,
    Foreground=ColourSwatch(SwatchColor=RGB(232, 232, 232)),
    FontSize=Slider(24, range=0..30))

# ----
# Charts
number_slider_44 = Slider(11, range=0..20)
panel_36 = Panel("""0
1
2
3
4
5
6
7
8""")
panel_37 = Panel("""Plastic
Soil
Vegetation""")
create_chart_3 = CreateChart(Data=panel_36, Names=panel_37, Title="Plastic", SubTitle="Estimate cost", ChartType=2)
adjust_element_appearance_27 = AdjustElementAppearance(ElementsToAdjust=create_chart_3, Foreground=ColourSwatch(SwatchColor=RGB(255, 255, 255)), FontSize=number_slider_44)
number_slider_45 = Slider(8, range=0..30)
adjust_element_positioning_40 = AdjustElementPositioning(
    ElementsToAdjust=create_chart_3,
    Margin="0,0,0,0",
    AbsolutePositioning=False,
    Width=Slider(622, range=0..1000),
    Height=Slider(364, range=0..1000))
chart_appearance_3 = ChartAppearance(
    ChartToModify=create_chart_3,
    Colors=[ColourSwatch(SwatchColor=RGB(97, 97, 97)), ColourSwatch(SwatchColor=RGB(110, 67, 19)), ColourSwatch(SwatchColor=RGB(71, 153, 31))],
    Legend=True)

concatenate_3 = Concatenate(Fragment_A="You have selected an area of ", Fragment_B="0", A=" m2")
create_label_24 = CreateLabel(LabelText=concatenate_3, LabelSize=12, Justification=0)
panel_38 = Panel("0")
adjust_element_appearance_28 = AdjustElementAppearance(
    ElementsToAdjust=create_label_24,
    Foreground=ColourSwatch(SwatchColor=RGB(232, 232, 232)),
    FontSize=Slider(24, range=0..30))

concatenate_4 = Concatenate(Fragment_A="With a building count of ", Fragment_B="0", A="  Buildings")
create_label_25 = CreateLabel(LabelText=concatenate_4, LabelSize=12, Justification=0)
adjust_element_appearance_29 = AdjustElementAppearance(
    ElementsToAdjust=create_label_25,
    Foreground=ColourSwatch(SwatchColor=RGB(232, 232, 232)),
    FontSize=Slider(24, range=0..30))

merge_12 = Merge(Data1=create_label_24, Data2=create_label_25, Data3=create_label_23, Data4=create_label_22)
adjust_element_appearance_30 = AdjustElementAppearance(ElementsToAdjust=merge_12, Foreground=ColourSwatch(SwatchColor=RGB(255, 255, 255)), Background=colrange)
create_border_5 = CreateBorder(
    UIElement=[create_label_24, create_label_25, create_label_22, create_label_23],
    BorderThickness=5,
    BorderColor=RGB(0, 0, 0),
    CornerRadius=0)
adjust_element_positioning_41 = AdjustElementPositioning(ElementsToAdjust=create_border_5, AbsolutePositioning=False, Width=Slider(579, range=0..1000), HorizontalAlignment=0)

# ----
# Charts
panel_39 = Panel("""Existing Run Off Volume
Reduced Run Off Volume""")
panel_40 = Panel("""1
2""")
data_3 = Data(panel_16)
concatenate_5 = Concatenate(FragmentB=data_3, FragmentA="m radius")
create_chart_4 = CreateChart(Data=panel_40, Names=panel_39, Title="Total reduced run off", SubTitle=concatenate_5, ChartType=0)
adjust_element_appearance_31 = AdjustElementAppearance(
    ElementsToAdjust=create_chart_4,
    Foreground=ColourSwatch(SwatchColor=RGB(255, 255, 255)),
    FontSize=Slider(14, range=0..20))
adjust_element_positioning_42 = AdjustElementPositioning(
    ElementsToAdjust=create_chart_4,
    Margin="0,0,0,0",
    AbsolutePositioning=False,
    Width=Slider(292, range=0..1000),
    Height=Slider(339, range=0..1000))
chart_appearance_4 = ChartAppearance(
    ChartToModify=create_chart_4,
    Colors=[ColourSwatch(SwatchColor=RGB(155, 209, 242)), ColourSwatch(SwatchColor=RGB(57, 164, 230)), ColourSwatch(SwatchColor=RGB(44, 106, 145))])

# ----
# Charts
panel_41 = Panel("Run Off Reduction")
panel_42 = Panel("""0
1
2
3
4
5
6
7
8""")
panel_43 = Panel("""B01
B02
B03
B04
B05
B06
B07
B08
B09""")
create_chart_5 = CreateChart(Data=panel_42, Names=panel_43, Title=panel_41, SubTitle="percentage %", ChartType=4)
adjust_element_appearance_32 = AdjustElementAppearance(
    ElementsToAdjust=create_chart_5,
    Foreground=ColourSwatch(SwatchColor=RGB(255, 255, 255)),
    FontSize=Slider(10, range=0..20))
number_slider_46 = Slider(346, range=0..1000)
number_slider_47 = Slider(350, range=0..1000)
adjust_element_positioning_43 = AdjustElementPositioning(
    ElementsToAdjust=create_chart_5,
    Margin="0,0,0,0",
    AbsolutePositioning=False,
    Width=number_slider_46,
    Height=number_slider_47)
chart_appearance_5 = ChartAppearance(
    ChartToModify=create_chart_5,
    Colors=[ColourSwatch(SwatchColor=RGB(155, 209, 242)), ColourSwatch(SwatchColor=RGB(57, 164, 230)), ColourSwatch(SwatchColor=RGB(44, 106, 145))],
    Legend=True,
    Title=True)

merge_13 = Merge(Data2=create_chart_2, Data3=create_chart_5)
panel_44 = Panel("""0
0""")
panel_45 = Panel("""0
1""")
create_grid_2 = CreateGrid(
    UIElements=merge_13,
    Width=Slider(2559, range=0..10000),
    Height=Slider(2438, range=0..10000),
    RowDefinitions=[Slider(393, range=0..1000), Slider(112, range=0..1000)],
    ColumnDefinitions=[Slider(366, range=0..1000), Slider(350, range=0..1000)],
    ElementRow=panel_44,
    ElementColumn=panel_45,
    ElementRowSpan=1,
    ElementColumnSpan=1)
colour_swatch_12 = ColourSwatch(SwatchColor=RGB(74, 74, 74))
create_expander_4 = CreateExpander(UIElements=create_grid_2, Header="Run off", Open=invert(False))
adjust_element_appearance_33 = AdjustElementAppearance(ElementsToAdjust=create_grid_2, Background=ColourSwatch(SwatchColor=RGB(38, 38, 38)))
adjust_element_positioning_44 = AdjustElementPositioning(
    ElementsToAdjust=create_expander_4,
    Margin="0,0,0,0",
    AbsolutePositioning=False,
    Width=Slider(689, range=0..1000),
    Height=Slider(370, range=0..1000),
    HorizontalAlignment=0)

get_selected_objects_49 = GetSelectedObjects(AllObjects_Object=plastic_price_polypropylene_pp)  # -> ComponentObjects, ParamObjects, OtherObjects
get_selected_objects_50 = GetSelectedObjects(AllObjects_Object=vegitation_price_per_m2_perennials_and_w)  # -> ComponentObjects, ParamObjects, OtherObjects
get_selected_objects_51 = GetSelectedObjects(AllObjects_Object=cocopeat_soil_price_per_m3)  # -> ComponentObjects, ParamObjects, OtherObjects
create_text_box_10 = CreateTextBox(Label="Plastic price", UpdateButton=True, showLabel=True)
create_text_box_11 = CreateTextBox(Label="Soil price", UpdateButton=True, showLabel=True)
create_text_box_12 = CreateTextBox(Label="Vegetation price", UpdateButton=True, showLabel=True)
value_listener_54 = ValueListener(Elements=create_text_box_10, SomeProperty=True)  # -> Values, Indices
value_listener_55 = ValueListener(Elements=create_text_box_11, SomeProperty=True)  # -> Values, Indices
value_listener_56 = ValueListener(Elements=create_text_box_12, SomeProperty=True)  # -> Values, Indices
set_object_value_25 = SetObjectValue(ObjectToSet=get_selected_objects_49.ParamObjects, ValueToSet=value_listener_54.Values)
set_object_value_26 = SetObjectValue(ObjectToSet=get_selected_objects_50.ParamObjects, ValueToSet=value_listener_56.Values)
set_object_value_27 = SetObjectValue(ObjectToSet=get_selected_objects_51.ParamObjects, ValueToSet=value_listener_55.Values)

create_stack_27 = CreateStack(UIElements=[create_text_box_10, create_text_box_11], Horizontal=invert(True))
create_stack_28 = CreateStack(UIElements=[create_text_box_12, create_text_box_6], Horizontal=invert(True))
merge_14 = Merge(Data1=[create_text_box_10, create_text_box_11, create_text_box_12, create_text_box_6])

create_stack_29 = CreateStack(UIElements=[create_stack_27, create_stack_28], Horizontal=True)
adjust_element_positioning_45 = AdjustElementPositioning(ElementsToAdjust=merge_14, AbsolutePositioning=False, Width=Slider(307, range=0..1000))

merge_15 = Merge(Data1=create_chart_3, Data2=create_stack_29)
number_slider_48 = Slider(648, range=0..1000)
multiplication_5 = Multiplication(A=number_slider_48, B=1)
multiplication_6 = Multiplication(A=number_slider_48, B=1)
panel_46 = Panel("""0
1""")
create_grid_3 = CreateGrid(
    UIElements=merge_15,
    Width=Slider(2559, range=0..10000),
    Height=Slider(2438, range=0..10000),
    RowDefinitions=[Slider(358, range=0..1000), Slider(221, range=0..1000)],
    ColumnDefinitions=[number_slider_48, multiplication_5, multiplication_6],
    ElementRow=panel_46,
    ElementColumn=panel_12,
    ElementRowSpan=1,
    ElementColumnSpan=1)
colour_swatch_13 = ColourSwatch(SwatchColor=RGB(74, 74, 74))
adjust_element_appearance_34 = AdjustElementAppearance(ElementsToAdjust=create_grid_3, Background=ColourSwatch(SwatchColor=RGB(38, 38, 38)))
create_expander_5 = CreateExpander(UIElements=create_grid_3, Header="Cost Estimate", Open=invert(False))
adjust_element_positioning_46 = AdjustElementPositioning(
    ElementsToAdjust=create_expander_5,
    Margin="0,20,0,0",
    AbsolutePositioning=False,
    Width=Slider(689, range=0..1000),
    Height=Slider(482, range=0..1000),
    HorizontalAlignment=0)

# ----
# Charts
panel_47 = Panel("for region ")
panel_48 = Panel("Estimated run off volume for built and non built")
panel_49 = Panel("""Built run off volume
Non-Built run off volume""")
panel_50 = Panel("""1
2""")
data_4 = Data(panel_16)
concatenate_6 = Concatenate(B=panel_47, Fragment_B=data_4, A="m radius")
create_chart_6 = CreateChart(Data=panel_50, Names=panel_49, Title=panel_48, SubTitle=concatenate_6, ChartType=3)
adjust_element_appearance_35 = AdjustElementAppearance(
    ElementsToAdjust=create_chart_6,
    Foreground=ColourSwatch(SwatchColor=RGB(255, 255, 255)),
    FontSize=Slider(14, range=0..20))
adjust_element_positioning_47 = AdjustElementPositioning(
    ElementsToAdjust=create_chart_6,
    Margin="0,0,0,0",
    AbsolutePositioning=False,
    Width=Slider(720, range=0..1000),
    Height=Slider(424, range=0..1000),
    HorizontalAlignment=0)
chart_appearance_6 = ChartAppearance(
    ChartToModify=create_chart_6,
    Colors=[ColourSwatch(SwatchColor=RGB(155, 209, 242)), ColourSwatch(SwatchColor=RGB(57, 164, 230)), ColourSwatch(SwatchColor=RGB(44, 106, 145))])

get_selected_objects_52 = GetSelectedObjects(AllObjects_Object=max_rain_fail_in_one_hour)  # -> ComponentObjects, ParamObjects, OtherObjects
panel_51 = Panel("Input the maximum rain fall volume in meters per hour and press the button to update")
create_text_box_13 = CreateTextBox(Label="Maximum Rain fall m/hr", DefaultText="0.0653", UpdateButton=True, showLabel=True)
value_listener_57 = ValueListener(Elements=create_text_box_13, SomeProperty=True)  # -> Values, Indices
set_object_value_28 = SetObjectValue(ObjectToSet=get_selected_objects_52.ParamObjects, ValueToSet=value_listener_57.Values)

# ----
# Charts
panel_52 = Panel("for region ")
panel_53 = Panel("""0
1
2
3""")
panel_54 = Panel("""Flat roof buildings run off (Concrete)
Pitched roof buildings run off (Tiled)
Roads Runoff volume (Asphalt)
other Lands Runoff volume (Unimproved)""")
data_5 = Data(panel_16)
concatenate_7 = Concatenate(B=panel_52, Fragment_B=data_5, A="m radius")
create_chart_7 = CreateChart(Data=panel_53, Names=panel_54, Title="Estimated run off volume detailed", SubTitle=concatenate_7, ChartType=0)
adjust_element_appearance_36 = AdjustElementAppearance(
    ElementsToAdjust=create_chart_7,
    Foreground=ColourSwatch(SwatchColor=RGB(255, 255, 255)),
    FontSize=Slider(14, range=0..20))
adjust_element_positioning_48 = AdjustElementPositioning(
    ElementsToAdjust=create_chart_7,
    Margin="0,0,0,0",
    AbsolutePositioning=False,
    Width=Slider(720, range=0..1000),
    Height=Slider(445, range=0..1000),
    HorizontalAlignment=0)
chart_appearance_7 = ChartAppearance(
    ChartToModify=create_chart_7,
    Colors=[ColourSwatch(SwatchColor=RGB(155, 209, 242)), ColourSwatch(SwatchColor=RGB(57, 164, 230)), ColourSwatch(SwatchColor=RGB(44, 106, 145)), ColourSwatch(SwatchColor=RGB(8, 45, 69))])

panel_55 = Panel("""Tool to estimate the average green roof area needed for the targeted surface runoff reduction.
(The percentage of green roof calculated here serves as a starting point for green roof design)""")

create_text_block_5 = CreateTextBlock(Text=panel_55, TextSize=12, Justification=0)

adjust_element_appearance_37 = AdjustElementAppearance(
    ElementsToAdjust=create_text_block_5,
    Foreground=ColourSwatch(SwatchColor=RGB(22, 185, 245)),
    FontSize=Slider(16.642, range=0..100))
adjust_element_positioning_49 = AdjustElementPositioning(ElementsToAdjust=create_text_block_5, AbsolutePositioning=False, Width=Slider(696, range=0..1000), HorizontalAlignment=0)

# ----
# Charts
# Estimated total Runoff volume
panel_56 = Panel("0")
create_label_26 = CreateLabel(LabelText=panel_56, LabelSize=24, Justification=1)
number_slider_49 = Slider(0, range=0..2)
number_slider_50 = Slider(2, range=0..2)
merge_16 = Merge(Data1=create_text_box_13, Data2=create_label_26)
adjust_element_appearance_38 = AdjustElementAppearance(
    ElementsToAdjust=create_label_26,
    Foreground=ColourSwatch(SwatchColor=RGB(232, 232, 232)),
    Background=ColourSwatch(SwatchColor=RGB(9, 54, 82)),
    FontSize=Slider(28, range=0..30))
create_stack_30 = CreateStack(UIElements=merge_16, Horizontal=False)
create_border_6 = CreateBorder(UIElement=create_stack_30, BorderThickness=5, BorderColor=RGB(0, 0, 0), CornerRadius=Slider(10, range=0..10))
adjust_element_positioning_50 = AdjustElementPositioning(
    ElementsToAdjust=[create_border_6, create_label_26],
    Margin="0,0,0,0",
    AbsolutePositioning=False,
    Width=Slider(393, range=0..1000),
    Height=Slider(95, range=0..1000),
    HorizontalAlignment=0)

attach_tooltip_to_element_4 = AttachTooltipToElement(
    ElementsToAttachTo=[create_text_box_13, create_stack_30],
    TooltipContent=panel_51,
    ShowDelay=500,
    Duration=Slider(5000, range=0..10000))

merge_17 = Merge(Data1=create_label_2, Data2=create_border_6, Data3=create_chart_6, Data4=create_chart_7)
adjust_element_appearance_39 = AdjustElementAppearance(ElementsToAdjust=merge_17, Background=ColourSwatch(SwatchColor=RGB(74, 74, 74)))

create_label_27 = CreateLabel(LabelText="00", LabelSize=18, Justification=1)
create_border_7 = CreateBorder(UIElement=create_label_27, BorderThickness=2, BorderColor=ColourSwatch(SwatchColor=RGB(255, 255, 255)), CornerRadius=2)
create_label_28 = CreateLabel(LabelText="Green Roof Area (m2) = ", LabelSize=18, Justification=2)
create_stack_31 = CreateStack(UIElements=[create_label_28, create_border_7], Horizontal=True)
adjust_element_positioning_51 = AdjustElementPositioning(
    ElementsToAdjust=create_border_7,
    Margin="5,20,5,0",
    AbsolutePositioning=False,
    Width=Slider(57, range=0..100),
    Height=Slider(39, range=0..100),
    HorizontalAlignment=1,
    VerticalAlignment=2)
adjust_element_appearance_40 = AdjustElementAppearance(
    ElementsToAdjust=[create_stack_31, create_label_27],
    Foreground=ColourSwatch(SwatchColor=RGB(26, 219, 116)),
    Background=ColourSwatch(SwatchColor=RGB(38, 38, 38)))

adjust_element_positioning_52 = AdjustElementPositioning(
    ElementsToAdjust=create_label_28,
    Margin="5,20,5,0",
    AbsolutePositioning=False,
    Width=Slider(200, range=0..400),
    HorizontalAlignment=1,
    VerticalAlignment=2)

merge_18 = Merge(Data1=create_stack_31, Data2=create_separator_18, Data3=create_text_block_4)
create_stack_32 = CreateStack(UIElements=merge_18, Horizontal=invert(True))

create_stack_33 = CreateStack(UIElements=[create_border, create_stack_32], Horizontal=True)
merge_19 = Merge(
    Data1=cluster.separator_2,
    Data2=create_text_block_5,
    Data3=cluster.separator_3,
    Data4=create_text_box_8,
    Data5=cluster.separator_6,
    Data6=create_text_box_5,
    Data7=cluster.separator,
    Data8=create_text_box_4,
    Data9=cluster.separator_4,
    Data10=create_pulldown_menu,
    Data11=cluster.separator_7,
    Data12=create_text_box_7,
    Data13=cluster.separator_8,
    Data14=create_stack_33)

create_stack_34 = CreateStack(UIElements=merge_19, Horizontal=invert(True))
adjust_element_appearance_41 = AdjustElementAppearance(
    ElementsToAdjust=create_stack_34,
    Foreground=ColourSwatch(SwatchColor=RGB(0, 174, 255)),
    Background=ColourSwatch(SwatchColor=RGB(38, 38, 38)))

# ----
# Charts
panel_57 = Panel("for region ")  # disabled
panel_58 = Panel("Estimated run off volume for built and non built")  # disabled
panel_59 = Panel("""Built run off volume
Non-Built run off volume""")  # disabled
panel_60 = Panel("""1
2""")  # disabled
panel_61 = Panel("m radius")  # disabled
data_6 = Data(panel_16)  # disabled
concatenate_8 = Concatenate(B=panel_57, Fragment_B=data_6, A=panel_61)  # disabled
number_slider_51 = Slider(14, range=0..20)  # disabled
create_chart_8 = CreateChart(Data=panel_60, Names=panel_59, Title=panel_58, SubTitle=concatenate_8, ChartType=3)  # disabled
colour_swatch_14 = ColourSwatch(SwatchColor=RGB(255, 255, 255))  # disabled
adjust_element_appearance_42 = AdjustElementAppearance(ElementsToAdjust=create_chart_8, Foreground=colour_swatch_14, FontSize=number_slider_51)  # disabled
number_slider_52 = Slider(0, range=0..2)  # disabled
number_slider_53 = Slider(723, range=0..1000)  # disabled
number_slider_54 = Slider(424, range=0..1000)  # disabled
number_slider_55 = Slider(2, range=0..2)  # disabled
colour_swatch_15 = ColourSwatch(SwatchColor=RGB(44, 106, 145))  # disabled
colour_swatch_16 = ColourSwatch(SwatchColor=RGB(155, 209, 242))  # disabled
colour_swatch_17 = ColourSwatch(SwatchColor=RGB(57, 164, 230))  # disabled
panel_62 = Panel("0,0,0,0")  # disabled
adjust_element_positioning_53 = AdjustElementPositioning(
    ElementsToAdjust=create_chart_8,
    Margin=panel_62,
    AbsolutePositioning=False,
    Width=number_slider_53,
    Height=number_slider_54,
    HorizontalAlignment=number_slider_52,
    VerticalAlignment=number_slider_55)  # disabled
chart_appearance_8 = ChartAppearance(ChartToModify=create_chart_8, Colors=[colour_swatch_16, colour_swatch_17, colour_swatch_15])  # disabled

# ----
# Charts
panel_63 = Panel("Estimated run off volume for built and non built")  # disabled
panel_64 = Panel("for region ")  # disabled
panel_65 = Panel("m radius")  # disabled
panel_66 = Panel("""0
1
2
3""")  # disabled
panel_67 = Panel("""Flat roof buildings run off (Concrete)
Pitched roof buildings run off (Tiled)
Roads Runoff volume (Asphalt)
other Lands Runoff volume (Unimproved)""")  # disabled
data_7 = Data(panel_16)  # disabled
concatenate_9 = Concatenate(B=panel_64, Fragment_B=data_7, A=panel_65)  # disabled
number_slider_56 = Slider(14, range=0..20)  # disabled
create_chart_9 = CreateChart(Data=panel_66, Names=panel_67, Title=panel_63, SubTitle=concatenate_9, ChartType=0)  # disabled
colour_swatch_18 = ColourSwatch(SwatchColor=RGB(255, 255, 255))  # disabled
adjust_element_appearance_43 = AdjustElementAppearance(ElementsToAdjust=create_chart_9, Foreground=colour_swatch_18, FontSize=number_slider_56)  # disabled
number_slider_57 = Slider(715, range=0..1000)  # disabled
number_slider_58 = Slider(469, range=0..1000)  # disabled
colour_swatch_19 = ColourSwatch(SwatchColor=RGB(155, 209, 242))  # disabled
colour_swatch_20 = ColourSwatch(SwatchColor=RGB(57, 164, 230))  # disabled
colour_swatch_21 = ColourSwatch(SwatchColor=RGB(44, 106, 145))  # disabled
colour_swatch_22 = ColourSwatch(SwatchColor=RGB(8, 45, 69))  # disabled
panel_68 = Panel("0,0,0,0")  # disabled
adjust_element_positioning_54 = AdjustElementPositioning(
    ElementsToAdjust=create_chart_9,
    Margin=panel_68,
    AbsolutePositioning=False,
    Width=number_slider_57,
    Height=number_slider_58)  # disabled
chart_appearance_9 = ChartAppearance(ChartToModify=create_chart_9, Colors=[colour_swatch_19, colour_swatch_20, colour_swatch_22, colour_swatch_21])  # disabled

# ----
# Charts
# Estimated total Runoff volume
panel_69 = Panel("0")  # disabled
panel_70 = Panel(" m3 in one hr")  # disabled
create_label_29 = CreateLabel(LabelText=panel_69, LabelSize=24, Justification=1)  # disabled
number_slider_59 = Slider(28, range=0..30)  # disabled
colour_swatch_23 = ColourSwatch(SwatchColor=RGB(232, 232, 232))  # disabled
colour_swatch_24 = ColourSwatch(SwatchColor=RGB(9, 54, 82))  # disabled
number_slider_60 = Slider(393, range=0..1000)  # disabled
number_slider_61 = Slider(0, range=0..2)  # disabled
number_slider_62 = Slider(58, range=0..1000)  # disabled
number_slider_63 = Slider(2, range=0..2)  # disabled
merge_20 = Merge(Data2=create_label_29)  # disabled
panel_71 = Panel("0,0,0,0")  # disabled
number_slider_64 = Slider(10, range=0..10)  # disabled
adjust_element_appearance_44 = AdjustElementAppearance(ElementsToAdjust=create_label_29, Foreground=colour_swatch_23, Background=colour_swatch_24, FontSize=number_slider_59)  # disabled
create_stack_35 = CreateStack(UIElements=merge_20, Horizontal=False)  # disabled
create_border_8 = CreateBorder(UIElement=create_stack_35, BorderThickness=5, BorderColor=RGB(0, 0, 0), CornerRadius=number_slider_64)  # disabled
adjust_element_positioning_55 = AdjustElementPositioning(
    ElementsToAdjust=[create_border_8, create_label_29],
    Margin=panel_71,
    AbsolutePositioning=False,
    Width=number_slider_60,
    Height=number_slider_62,
    HorizontalAlignment=number_slider_61,
    VerticalAlignment=number_slider_63)  # disabled

merge_21 = Merge(Data1=create_label_3, Data2=create_border_8, Data3=create_chart_8, Data4=create_chart_9)  # disabled
colour_swatch_25 = ColourSwatch(SwatchColor=RGB(88, 125, 80))  # disabled
adjust_element_appearance_45 = AdjustElementAppearance(ElementsToAdjust=merge_21, Background=colour_swatch_25)  # disabled

merge_22 = Merge(
    Data1=create_toggle_6,
    Data2=create_separator_4,
    Data3=create_border_5,
    Data4=create_separator_5,
    Data5=merge_17,
    Data6=create_separator_6,
    Data7=merge_21)
create_stack_36 = CreateStack(UIElements=merge_22, Horizontal=invert(True))

adjust_element_positioning_56 = AdjustElementPositioning(
    ElementsToAdjust=create_chart_2,
    Margin="0,0,0,0",
    AbsolutePositioning=False,
    Width=number_slider_46,
    Height=number_slider_47)

create_label_30 = CreateLabel(LabelText="-->Careful this might take a while !!", LabelSize=24, Justification=1)
adjust_element_appearance_46 = AdjustElementAppearance(ElementsToAdjust=create_label_30, Foreground=ColourSwatch(SwatchColor=RGB(222, 155, 0)))
adjust_element_positioning_57 = AdjustElementPositioning(
    ElementsToAdjust=create_label_30,
    AbsolutePositioning=False,
    Width=Slider(432, range=0..1000),
    Height=Slider(43, range=0..1000),
    HorizontalAlignment=1)

# ----
# Render
merge_23 = Merge(
    Data1=get_selected_objects_29.ComponentObjects,
    Data2=get_selected_objects_29.ParamObjects,
    Data3=get_selected_objects_29.OtherObjects)
create_toggle_9 = CreateToggle(Default=False, Label="Render")
value_listener_58 = ValueListener(Elements=create_toggle_9, SomeProperty=True)  # -> Values, Indices
enable_disable_object_9 = EnableDisableObject(
    Objects=merge_23,
    Enabled=value_listener_58.Values,
    AllObjects_Object=[herbs_4, cluster_12, herbs_3, herbs_2, cluster_11, cluster_18, cluster_13, herbs_5, cluster_14, cluster_16, cluster_3, cluster_17, cluster_15, cluster_19])

adjust_element_positioning_58 = AdjustElementPositioning(ElementsToAdjust=create_toggle_9, AbsolutePositioning=False, Width=Slider(195, range=0..1000), HorizontalAlignment=1)

merge_24 = Merge(Data1=create_text_box_3, Data2=create_toggle_2, Data3=create_toggle_3)
merge_25 = Merge(Data1=create_toggle_5, Data2=create_toggle_4)
merge_26 = Merge(Data1=create_toggle_9)
create_stack_37 = CreateStack(UIElements=merge_24, Horizontal=invert(True))
create_stack_38 = CreateStack(UIElements=merge_25, Horizontal=invert(True))
create_stack_39 = CreateStack(UIElements=[create_toggle_9, create_label_30], Horizontal=True)
create_stack_40 = CreateStack(UIElements=[create_stack_37, create_stack_38], Horizontal=True)
create_stack_41 = CreateStack(UIElements=[create_stack_40, create_stack_39], Horizontal=invert(True))
create_expander_6 = CreateExpander(UIElements=create_stack_41, Header="Visualize More Data", Open=True)
adjust_element_positioning_59 = AdjustElementPositioning(
    ElementsToAdjust=create_expander_6,
    Margin="0,20,0,0",
    AbsolutePositioning=False,
    Width=Slider(689, range=0..1000),
    Height=Slider(374, range=0..1000),
    HorizontalAlignment=0)

adjust_element_positioning_60 = AdjustElementPositioning(
    ElementsToAdjust=create_stack_37,
    Margin="0,20,0,0",
    AbsolutePositioning=False,
    Width=Slider(372, range=0..1000),
    Height=Slider(244, range=0..1000),
    HorizontalAlignment=0)
adjust_element_positioning_61 = AdjustElementPositioning(
    ElementsToAdjust=create_stack_38,
    Margin="0,20,0,0",
    AbsolutePositioning=False,
    Width=Slider(284, range=0..1000),
    Height=Slider(151, range=0..1000),
    HorizontalAlignment=0,
    VerticalAlignment=0)

create_modify_layers = CreateModifyLayers(
    LayerName=["2 Floors", "4 Floors", "6 Floors", "8 Floors", "10 Floors", "15+ Floors", "20+ Floors", "30+ Floors", "50+ Floors"],
    DeleteLayer=False,
    enableFullPath=False)  # -> LayerNames, LayerFullPath
button_11 = Button()
data_8 = Data(cull_pattern)
data_9 = Data(cull_pattern_5)
data_10 = Data(cull_pattern_6)
data_11 = Data(cull_pattern_2)
data_12 = Data(cull_pattern_9)
data_13 = Data(cull_pattern_3)
data_14 = Data(cull_pattern_4)
data_15 = Data(cull_pattern_7)
data_16 = Data(cull_pattern_8)
list_item_2 = ListItem(List=create_modify_layers.LayerNames, Index=0, Wrap=True)  # -> Item, Item1, Item2, Item3, Item4, Item5, Item6, Item7, Item8, Item9
unit_z_2 = UnitZ(Factor=expr("x*3", "30"))
unit_z_3 = UnitZ(Factor=expr("x*3", "20"))
unit_z_4 = UnitZ(Factor=expr("x*3", "50"))
unit_z_5 = UnitZ(Factor=expr("x*3", "4"))
unit_z_6 = UnitZ(Factor=expr("x*3", "16"))
unit_z_7 = UnitZ(Factor=expr("x*3", "2"))
unit_z_8 = UnitZ(Factor=expr("x*3", "10"))
unit_z_9 = UnitZ(Factor=expr("x*3", "8"))
unit_z_10 = UnitZ(Factor=expr("x*3", "6"))

create_label_31 = CreateLabel(LabelText=create_modify_layers.LayerNames, LabelSize=12, Justification=0)
adjust_element_positioning_62 = AdjustElementPositioning(ElementsToAdjust=create_label_31, Margin="-4,0,0,0", AbsolutePositioning=False, Width=Slider(81, range=0..100))
create_stack_42 = CreateStack(UIElements=create_label_31, Horizontal=True)

createattributes = CreateAttributes(LayerName=create_modify_layers.LayerNames, enableFullPath=False)
list_item_3 = ListItem(List=createattributes, Index=0, Wrap=True)  # -> Item, Item1, Item2, Item3, Item4, Item5, Item6, Item7, Item8, Item9

enumerator = Enumerator(Object=cull_pattern_15)  # -> Numbers, Color
panel_72 = Panel(data_14)
filter_by_item = FilterByItem(GuideList=enumerator.Numbers, SelectedItems=panel_72, ListList0=cull_pattern_15, invert=False)
bake_geometry = BakeGeometry(
    Bake=value_listener_53.Values,
    Geometry=filter_by_item,
    Attributes=list_item_3.Item5,
    DeleteOldBakes=False,
    PreserveTrees=False)

enumerator_2 = Enumerator(Object=cull_pattern_15)  # -> Numbers, Color
panel_73 = Panel(data_8)
filter_by_item_2 = FilterByItem(GuideList=enumerator_2.Numbers, SelectedItems=panel_73, ListList0=cull_pattern_15, invert=False)
bake_geometry_2 = BakeGeometry(
    Bake=value_listener_53.Values,
    Geometry=filter_by_item_2,
    Attributes=list_item_3.Item,
    DeleteOldBakes=False,
    PreserveTrees=False)

enumerator_3 = Enumerator(Object=cull_pattern_15)  # -> Numbers, Color
panel_74 = Panel(data_16)
filter_by_item_3 = FilterByItem(GuideList=enumerator_3.Numbers, SelectedItems=panel_74, ListList0=cull_pattern_15, invert=False)
bake_geometry_3 = BakeGeometry(
    Bake=value_listener_53.Values,
    Geometry=filter_by_item_3,
    Attributes=list_item_3.Item6,
    DeleteOldBakes=False,
    PreserveTrees=False)

enumerator_4 = Enumerator(Object=cull_pattern_15)  # -> Numbers, Color
panel_75 = Panel(data_9)
filter_by_item_4 = FilterByItem(GuideList=enumerator_4.Numbers, SelectedItems=panel_75, ListList0=cull_pattern_15, invert=False)
bake_geometry_4 = BakeGeometry(
    Bake=value_listener_53.Values,
    Geometry=filter_by_item_4,
    Attributes=list_item_3.Item1,
    DeleteOldBakes=False,
    PreserveTrees=False)

enumerator_5 = Enumerator(Object=cull_pattern_15)  # -> Numbers, Color
panel_76 = Panel(data_10)
filter_by_item_5 = FilterByItem(GuideList=enumerator_5.Numbers, SelectedItems=panel_76, ListList0=cull_pattern_15, invert=False)
bake_geometry_5 = BakeGeometry(
    Bake=value_listener_53.Values,
    Geometry=filter_by_item_5,
    Attributes=list_item_3.Item2,
    DeleteOldBakes=False,
    PreserveTrees=False)

enumerator_6 = Enumerator(Object=cull_pattern_15)  # -> Numbers, Color
panel_77 = Panel(data_13)
filter_by_item_6 = FilterByItem(GuideList=enumerator_6.Numbers, SelectedItems=panel_77, ListList0=cull_pattern_15, invert=False)
bake_geometry_6 = BakeGeometry(
    Bake=value_listener_53.Values,
    Geometry=filter_by_item_6,
    Attributes=list_item_3.Item4,
    DeleteOldBakes=False,
    PreserveTrees=False)

enumerator_7 = Enumerator(Object=cull_pattern_15)  # -> Numbers, Color
panel_78 = Panel(data_15)
filter_by_item_7 = FilterByItem(GuideList=enumerator_7.Numbers, SelectedItems=panel_78, ListList0=cull_pattern_15, invert=False)
bake_geometry_7 = BakeGeometry(
    Bake=value_listener_53.Values,
    Geometry=filter_by_item_7,
    Attributes=list_item_3.Item8,
    DeleteOldBakes=False,
    PreserveTrees=False)

enumerator_8 = Enumerator(Object=cull_pattern_15)  # -> Numbers, Color
panel_79 = Panel(data_12)
filter_by_item_8 = FilterByItem(GuideList=enumerator_8.Numbers, SelectedItems=panel_79, ListList0=cull_pattern_15, invert=False)
bake_geometry_8 = BakeGeometry(
    Bake=value_listener_53.Values,
    Geometry=filter_by_item_8,
    Attributes=list_item_3.Item3,
    DeleteOldBakes=False,
    PreserveTrees=False)

enumerator_9 = Enumerator(Object=cull_pattern_15)  # -> Numbers, Color
panel_80 = Panel(data_11)
filter_by_item_9 = FilterByItem(GuideList=enumerator_9.Numbers, SelectedItems=panel_80, ListList0=cull_pattern_15, invert=False)
bake_geometry_9 = BakeGeometry(
    Bake=value_listener_53.Values,
    Geometry=filter_by_item_9,
    Attributes=list_item_3.Item7,
    DeleteOldBakes=False,
    PreserveTrees=False)

query_model_objects = QueryModelObjects(Layer=list_item_2.Item, Locked=True, Hidden=True, AutoUpdateState=True)
model_object = ModelObject(Object=query_model_objects)  # -> Object, Geometry, Name, Layer, Visibility, Display, Drafting, Render
geometry_4 = Geometry(model_object.Geometry)

query_model_objects_2 = QueryModelObjects(Layer=list_item_2.Item2, Locked=True, Hidden=True, AutoUpdateState=True)
model_object_2 = ModelObject(Object=query_model_objects_2)  # -> Object, Geometry, Name, Layer, Visibility, Display, Drafting, Render
geometry_5 = Geometry(model_object_2.Geometry)

query_model_objects_3 = QueryModelObjects(Layer=list_item_2.Item1, Locked=True, Hidden=True, AutoUpdateState=True)
model_object_3 = ModelObject(Object=query_model_objects_3)  # -> Object, Geometry, Name, Layer, Visibility, Display, Drafting, Render
geometry_6 = Geometry(model_object_3.Geometry)

query_model_objects_4 = QueryModelObjects(Layer=list_item_2.Item3, Locked=True, Hidden=True, AutoUpdateState=True)
model_object_4 = ModelObject(Object=query_model_objects_4)  # -> Object, Geometry, Name, Layer, Visibility, Display, Drafting, Render
geometry_7 = Geometry(model_object_4.Geometry)

query_model_objects_5 = QueryModelObjects(Layer=list_item_2.Item4, Locked=True, Hidden=True, AutoUpdateState=True)
model_object_5 = ModelObject(Object=query_model_objects_5)  # -> Object, Geometry, Name, Layer, Visibility, Display, Drafting, Render
geometry_8 = Geometry(model_object_5.Geometry)

query_model_objects_6 = QueryModelObjects(Layer=list_item_2.Item5, Locked=True, Hidden=True, AutoUpdateState=True)
model_object_6 = ModelObject(Object=query_model_objects_6)  # -> Object, Geometry, Name, Layer, Visibility, Display, Drafting, Render
geometry_9 = Geometry(model_object_6.Geometry)

query_model_objects_7 = QueryModelObjects(Layer=list_item_2.Item6, Locked=True, Hidden=True, AutoUpdateState=True)
model_object_7 = ModelObject(Object=query_model_objects_7)  # -> Object, Geometry, Name, Layer, Visibility, Display, Drafting, Render
geometry_10 = Geometry(model_object_7.Geometry)

query_model_objects_8 = QueryModelObjects(Layer=list_item_2.Item8, Locked=True, Hidden=True, AutoUpdateState=True)
model_object_8 = ModelObject(Object=query_model_objects_8)  # -> Object, Geometry, Name, Layer, Visibility, Display, Drafting, Render
geometry_11 = Geometry(model_object_8.Geometry)

query_model_objects_9 = QueryModelObjects(Layer=list_item_2.Item7, Locked=True, Hidden=True, AutoUpdateState=True)
model_object_9 = ModelObject(Object=query_model_objects_9)  # -> Object, Geometry, Name, Layer, Visibility, Display, Drafting, Render
geometry_12 = Geometry(model_object_9.Geometry)

extrude_2 = Extrude(Base=geometry_11, Direction=unit_z_4)
extrude_3 = Extrude(Base=geometry_10, Direction=unit_z_3)
extrude_4 = Extrude(Base=geometry_12, Direction=unit_z_2)
extrude_5 = Extrude(Base=geometry_9, Direction=unit_z_6)
extrude_6 = Extrude(Base=geometry_8, Direction=unit_z_8)
extrude_7 = Extrude(Base=geometry_7, Direction=unit_z_9)
extrude_8 = Extrude(Base=geometry_5, Direction=unit_z_10)
extrude_9 = Extrude(Base=geometry_4, Direction=unit_z_7)
extrude_10 = Extrude(Base=geometry_6, Direction=unit_z_5)
merge_27 = Merge(
    Data1=extrude_9,
    Data2=extrude_10,
    Data3=extrude_8,
    Data4=extrude_7,
    Data5=extrude_6,
    Data6=extrude_5,
    Data7=extrude_3,
    Data8=extrude_4,
    Data9=extrude_2)
clean_tree = CleanTree(RemoveNulls=True, RemoveInvalid=True, RemoveEmpty=True, Tree=merge_27)

panel_81 = Panel(merge_27)

merge_28 = Merge(Data3=create_stack_5, Data4=create_stack_9)
merge_29 = Merge(Data1=create_label, Data2=create_stack_42, Data3=create_scroll_viewer, Data4=create_stack_26)
colour_swatch_26 = ColourSwatch(SwatchColor=RGB(255, 255, 255))
create_expander_7 = CreateExpander(UIElements=merge_29, Header="Refine Your Context", Open=True)
adjust_element_positioning_63 = AdjustElementPositioning(
    ElementsToAdjust=create_expander_7,
    Margin="0,30,0,0",
    AbsolutePositioning=False,
    Width=Slider(704, range=0..1000),
    Height=Slider(664, range=0..2000),
    HorizontalAlignment=0)
adjust_element_appearance_47 = AdjustElementAppearance(ElementsToAdjust=create_expander_7, FontSize=Slider(19, range=0..100))

create_stack_43 = CreateStack(UIElements=merge_28, Horizontal=invert(True))

merge_30 = Merge(Data1=create_stack_43, Data2=create_expander_7)
create_stack_44 = CreateStack(UIElements=merge_30, Horizontal=invert(True))
adjust_element_positioning_64 = AdjustElementPositioning(
    ElementsToAdjust=create_stack_43,
    Margin="0,0,0,0",
    AbsolutePositioning=False,
    Width=Slider(660, range=0..1000),
    Height=Slider(786, range=0..2000),
    HorizontalAlignment=0,
    VerticalAlignment=2)
adjust_element_positioning_65 = AdjustElementPositioning(
    ElementsToAdjust=create_stack_44,
    Margin="0,0,0,0",
    AbsolutePositioning=False,
    Width=Slider(1000, range=0..1000),
    Height=Slider(2000, range=0..2000),
    HorizontalAlignment=0)

merge_31 = Merge(
    Data1=create_stack_7,
    Data2=create_stack,
    Data3=create_grid,
    Data4=create_separator_7,
    Data5=create_expander_3,
    Data6=create_separator_8,
    Data7=create_expander_4,
    Data8=create_expander_5,
    Data9=create_expander_6)

create_stack_45 = CreateStack(UIElements=merge_31, Horizontal=invert(True))
adjust_element_positioning_66 = AdjustElementPositioning(ElementsToAdjust=create_stack_45, AbsolutePositioning=False, Width=Slider(796, range=0..1000))

adjust_element_appearance_48 = AdjustElementAppearance(ElementsToAdjust=create_stack_45, Background=ColourSwatch(SwatchColor=RGB(38, 38, 38)))

# ----
# Design your Own roof
panel_82 = Panel("GreenRoof")
panel_83 = Panel("Cost")
tabbed_view = TabbedView(
    TabNames=["Intro |", "Zone Analysis |", "Preliminary investigation |", panel_82],
    TabTextSize=24,
    Tab0=flatten(create_stack_44),
    Tab1=flatten(create_stack_36),
    Tab2=flatten(create_stack_34),
    Tab3=flatten(create_stack_45))
adjust_element_positioning_67 = AdjustElementPositioning(
    ElementsToAdjust=tabbed_view,
    Margin="10,10,10,10",
    AbsolutePositioning=False,
    Width=Slider(805, range=0..10000),
    Height=Slider(2569, range=0..3000))
launch_window = LaunchWindow(
    Show=Toggle(True),
    Name="Urban Flood Mitigation",
    Width=Slider(755, range=0..1000),
    Height=Slider(817, range=0..1000),
    ChildStatus=1,
    EnableHorizScroll=False)
# Rain water visuals
set_window_properties = SetWindowProperties(
    Window=launch_window,
    StartingLocation="750,0",
    Theme=Slider(1, range=0..1),
    ShowTitleBar=True,
    BackgroundColor=ColourSwatch(SwatchColor=RGB(38, 38, 38)),
    ScaleFactor=1)
add_elements = AddElements(Window=launch_window, Elements=flatten(tabbed_view), DoVLChecking=True)  # -> AddedElements, ElementNames

createattributes_2 = CreateAttributes(LayerName="Buildings", enableFullPath=False)
button_12 = Button()
bake_geometry_10 = BakeGeometry(
    Bake=value_listener_53.Values,
    Geometry=clean_tree,
    Attributes=createattributes_2,
    DeleteOldBakes=False,
    PreserveTrees=False)
query_model_objects_10 = QueryModelObjects(Layer="Buildings", Locked=True, Hidden=True, AutoUpdateState=True)
model_object_10 = ModelObject(Object=query_model_objects_10)  # -> Object, Geometry, Name, Layer, Visibility, Display, Drafting, Render
list = ValueList({"Round : Constant slope(sand)": 0, "Butt  : Angular(roof)": 1, "Square : Simple": 2}, selected="Square : Simple")

create_modify_layers_2 = CreateModifyLayers(
    LayerName=["Buildings", "pitched Roof Buildings"],
    LayerColor=ColourSwatch(SwatchColor=RGB(76, 76, 76)),
    DeleteLayer=False,
    enableFullPath=False)  # -> LayerNames, LayerFullPath

clean_tree_2 = CleanTree(RemoveNulls=True, RemoveInvalid=True, RemoveEmpty=True, Tree=model_object_10.Geometry)
list_length_2 = ListLength(List=clean_tree_2)
addition = Addition(A=list_length_2, B=0)
smaller_than_3 = SmallerThan(FirstNumber=addition, SecondNumber="1")  # -> SmallerThan, OrEqualTo
hide_show_object_preview_11 = HideShowObjectPreview(Objects=get_selected_objects_36.ComponentObjects, Visible=smaller_than_3.SmallerThan)

query_model_objects_11 = QueryModelObjects(Layer="pitched Roof Buildings", Locked=True, Hidden=True, AutoUpdateState=True)
model_object_11 = ModelObject(Object=query_model_objects_11)  # -> Object, Geometry, Name, Layer, Visibility, Display, Drafting, Render
box_top_surface = BoxTopSurface(brep=model_object_11.Geometry)
brep_wireframe = BrepWireframe(Brep=box_top_surface, Density=-1)
join_curves = JoinCurves(Curves=brep_wireframe, Preserve=False)
curve_region_to_roof_automatic = CurveRegionToRoofAutomatic(Curves=join_curves, AngleOfRoof=degrees(Slider(33, range=-180..180)), RoofType=list, PrecisionFactor=1)  # -> Roof, MedialAxis

panel_84 = Panel("8")
list_item_4 = ListItem(List=model_object_10.Geometry, Index=panel_84, Wrap=True)

concatenate_10 = Concatenate(FragmentA="Building ", FragmentB=panel_84)

# ----
# Filtering by minimum area
box_top_surface_2 = BoxTopSurface(brep=list_item_4)
area = Area(Geometry=box_top_surface_2)  # -> Area, Centroid
larger_than = LargerThan(FirstNumber=area.Area, SecondNumber=Slider(300, range=0..1000))  # -> LargerThan, OrEqualTo
cull_pattern_17 = CullPattern(List=box_top_surface_2, CullPattern=larger_than.LargerThan)

# ----
# Parapet
brep_wireframe_2 = BrepWireframe(Brep=box_top_surface_2, Density=-1)
join_curves_2 = JoinCurves(Curves=brep_wireframe_2, Preserve=False)
number_slider_65 = Slider(0.12, range=0..1)
number_slider_66 = Slider(0.012, range=0..0.1)
offset_curve_loose = OffsetCurveLoose(Curve=join_curves_2, Distance="-0.25")
unit_z_11 = UnitZ(Factor=Slider(1.2, range=0..10))
ruled_surface = RuledSurface(CurveA=join_curves_2, CurveB=offset_curve_loose)
extrude_11 = Extrude(Base=ruled_surface, Direction=unit_z_11)
colour_swatch_27 = ColourSwatch(SwatchColor=RGB(66, 66, 66))
custom_preview_lineweights_9 = CustomPreviewLineweights(Shader=colour_swatch_6, Thickness=0.2, Absolute=False)

custom_preview_4 = CustomPreview(Geometry=[cull_pattern_17, extrude_11, list_item_4], Material=colour_swatch_6)

# ----
# Buildings color coding
merge_32 = Merge(Data1=model_object_10.Geometry)
cluster_7 = Cluster(brep=merge_32)  # -> start, end, result
list_length_3 = ListLength(List=merge_32)
gradient = Gradient(
    LowerLimit=cluster_7.end,
    UpperLimit=cluster_7.start,
    Parameter=cluster_7.result,
    stops=[0: RGB(0, 34, 77), 0.0312: RGB(0, 40, 91), 0.0625: RGB(0, 45, 105), 0.0938: RGB(4, 50, 112), 0.125: RGB(26, 56, 111), 0.156: RGB(39, 61, 109)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])
custom_preview_5 = CustomPreview(Geometry=merge_32, Material=gradient)

concatenate_11 = Concatenate(Fragment_A="With a building count of ", Fragment_B=list_length_3, A="  Buildings")
set_label_contents = SetLabelContents(LabelToModify=create_label_25, NewLabelContents=concatenate_11)

box_top_surface_3 = BoxTopSurface(brep=merge_32)  # -> flatten(list)

center_6 = Center(Geometry=box_top_surface_3)  # -> Center, Dimension

line_sdl = LineSDL(Start=center_6.Center, Direction=Vector(0, 0, 1), Length=Slider(10, range=0..10))
move_2 = Move(Geometry=center_6.Center, Motion=Vector(0, 0, 10))  # -> Geometry, Transform

enumerator_10 = Enumerator(Object=merge_32, branchID=False)  # -> Numbers, Color
define_text_dot_2 = DefineTextDot(Text=enumerator_10.Numbers, Location=move_2.Geometry, Font="Arial", Size=Slider(10, range=0..10))

# ----
# Estimated run off volume for Non built up
merge_33 = Merge(Data1=merge_32)  # disabled
box_top_surface_4 = BoxTopSurface(brep=merge_33)  # disabled
brep_wireframe_3 = BrepWireframe(Brep=box_top_surface_4, Density=-1)  # disabled
join_curves_3 = JoinCurves(Curves=brep_wireframe_3, Preserve=False)  # disabled
max_rain_fail_in_one_hour = Panel("0.060")  # disabled
project = Project(Curve=join_curves_3, Brep=circle, Direction=Vector(0, 0, 1))  # disabled
close_curve = CloseCurve(Curve=project, CloseType=0, Bulge=0.5, Tolerance=0)  # -> Closed, ResultBoolean; disabled
boundary_surfaces_2 = BoundarySurfaces(Edges=circle)  # disabled
boundary_surfaces_3 = BoundarySurfaces(Edges=flatten(close_curve.Closed))  # disabled
solid_difference = SolidDifference(BrepsA=boundary_surfaces_2, BrepsB=boundary_surfaces_3)  # disabled
area_2 = Area(Geometry=cull_pattern_12)  # -> Area, Centroid; disabled
area_3 = Area(Geometry=solid_difference)  # -> Area, Centroid; disabled
mass_addition = MassAddition(Input=flatten(area_2.Area))  # -> Result, PartialResults; disabled
run_off_coeffecient_non_built = Panel("0.2")  # disabled
mass_addition_2 = MassAddition(Input=flatten(area_3.Area))  # -> Result, PartialResults; disabled
run_off_coeffecient_asphalt = Panel("0.95")  # disabled
multiplication_7 = Multiplication(A=mass_addition.Result, B=max_rain_fail_in_one_hour, C=run_off_coeffecient_asphalt)  # disabled
subtraction = Subtraction(A=mass_addition_2.Result, B=mass_addition.Result)
multiplication_8 = Multiplication(A=subtraction, B=max_rain_fail_in_one_hour, C=run_off_coeffecient_non_built)  # disabled
addition_2 = Addition(A=multiplication_7, B=0)
addition_3 = Addition(A=multiplication_8, B=0)
estimated_run_off_volume_for_other_land = Panel(addition_3)  # "Estimated run off volume for other land (unimproved)"
estimated_run_off_volume_for_roads_aspha = Panel(addition_2)  # "Estimated run off volume for roads (asphalt)"
addition_4 = Addition(A=addition_2, B=addition_3)
estimated_run_off_volume_for_non_built_u = Panel(addition_4)  # "Estimated run off volume for NON built up area"

# ----
# Estimated run off volume for built up area
box_top_surface_5 = BoxTopSurface(brep=merge_32)  # disabled
area_4 = Area(Geometry=circle)  # -> Area, Centroid
area_5 = Area(Geometry=box_top_surface_5)  # -> Area, Centroid; disabled
mass_addition_3 = MassAddition(Input=flatten(area_4.Area))  # -> Result, PartialResults
mass_addition_4 = MassAddition(Input=flatten(area_5.Area))  # -> Result, PartialResults; disabled
run_off_coeffecient_concrete = Panel("0.70")  # disabled
round = Round(Number=mass_addition_3.Result)  # -> Nearest, Floor, Ceiling
multiplication_9 = Multiplication(A=mass_addition_4.Result, B=max_rain_fail_in_one_hour, C=run_off_coeffecient_concrete)  # disabled
estimated_run_off_volume_for_flat_roof_a = Panel(multiplication_9)  # "Estimated run off volume for flat roof area ( concrete)"

concatenate_12 = Concatenate(Fragment_A="You have selected an area of ", Fragment_B=round.Nearest, A=" m2")
set_label_contents_2 = SetLabelContents(LabelToModify=create_label_24, NewLabelContents=concatenate_12)

box_top_surface_6 = BoxTopSurface()  # disabled
area_6 = Area(Geometry=box_top_surface)  # -> Area, Centroid; disabled
run_off_coeffecient_tiles_roof_slope = Panel("0.90")  # disabled
mass_addition_5 = MassAddition(Input=flatten(area_6.Area))  # -> Result, PartialResults; disabled
multiplication_10 = Multiplication(A=mass_addition_5.Result, B=max_rain_fail_in_one_hour, C=run_off_coeffecient_tiles_roof_slope)  # disabled
estimated_run_off_volume_for_pitched_roo = Panel(multiplication_10)  # "Estimated run off volume for Pitched roof area (tiled + slope)"

max_rain_fail_in_one_hour_2 = Panel("0.0653")
addition_5 = Addition(A=multiplication_9, B=multiplication_10)
addition_6 = Addition(A=estimated_run_off_volume_for_flat_roof_a, B=0)
addition_7 = Addition(A=estimated_run_off_volume_for_pitched_roo, B=0)
estimated_run_off_volume_for_built_up_ar = Panel(addition_5)  # "Estimated run off volume for built up area"
addition_8 = Addition(A=estimated_run_off_volume_for_built_up_ar, B=0)

merge_34 = Merge(
    Data1=addition_6,
    Data2=addition_7,
    Data3=estimated_run_off_volume_for_roads_aspha,
    Data4=estimated_run_off_volume_for_other_land)
set_chart_contents_2 = SetChartContents(ChartToModify=create_chart_7, NewChartValues=flatten(merge_34), NewChartNames=panel_54)

merge_35 = Merge(
    Data1=addition_6,
    Data2=addition_7,
    Data3=estimated_run_off_volume_for_roads_aspha,
    Data4=estimated_run_off_volume_for_other_land)  # disabled
set_chart_contents_3 = SetChartContents(ChartToModify=create_chart_9, NewChartValues=flatten(merge_35), NewChartNames=panel_67)  # disabled

merge_36 = Merge(Data1=addition_8, Data2=addition_4)
set_chart_contents_4 = SetChartContents(ChartToModify=create_chart_6, NewChartValues=flatten(merge_36), Title=panel_48, SubTitle=concatenate_6)

round_2 = Round(Number=mass_addition_4.Result)  # -> Nearest, Floor, Ceiling

concatenate_13 = Concatenate(Fragment_A="The built up area of this region is  ", Fragment_B=round_2.Nearest, A=" m2")
set_label_contents_3 = SetLabelContents(LabelToModify=create_label_23, NewLabelContents=concatenate_13)

addition_9 = Addition(A=mass_addition.Result, B=mass_addition_2.Result)
round_3 = Round(Number=addition_9)  # -> Nearest, Floor, Ceiling

concatenate_14 = Concatenate(Fragment_A="The non-built up area of this region is  ", Fragment_B=round_3.Nearest, A=" m2")
set_label_contents_4 = SetLabelContents(LabelToModify=create_label_22, NewLabelContents=concatenate_14)

addition_10 = Addition(A=addition_8, B=estimated_run_off_volume_for_non_built_u)
estimated_total_runoff_volum_for_region = Panel(addition_10)

round_to_decimal_place = RoundToDecimalPlace(NumberX=estimated_total_runoff_volum_for_region, DecimalPlace=2, RoundType=0)  # -> Rounded, Difference
concatenate_15 = Concatenate(FragmentA=round_to_decimal_place.Rounded, FragmentB=" m3 in one hr")
set_label_contents_5 = SetLabelContents(LabelToModify=create_label_26, NewLabelContents=concatenate_15)

box_top_surface_7 = BoxTopSurface(brep=list_item_4)
clean_tree_3 = CleanTree(RemoveNulls=True, RemoveInvalid=True, RemoveEmpty=True, Tree=box_top_surface_7)
offset_surface = OffsetSurface(Surface=clean_tree_3, Distance=1, BothSides=0, CreateSolid=True)

deconstruct_brep = DeconstructBrep(Brep=clean_tree_3)  # -> Faces, Edges, Vertices
number_slider_67 = Slider(0.36, range=0..1)
list_item_5 = ListItem(List=deconstruct_brep.Edges, Index=0, Wrap=True)
xy_plane = XYPlane(Origin=Point(0, 0, 0))
align_plane = AlignPlane(Plane=xy_plane, Direction=list_item_5)  # -> Plane, Angle
bounding_rectangle_2 = BoundingRectangle(Geometry=clean_tree_3, Plane=align_plane.Plane, Axis=0, Slide=number_slider_67, Union=True)  # -> Bounding, DimensionX, DimensionY
grid_in_rectangle = GridInRectangle(Rectangle=bounding_rectangle_2.Bounding, Size=1, Compact=True, FitSize=False)  # -> flatten(Points), U, V
point_in_brep = PointInBrep(Brep=offset_surface, Point=grid_in_rectangle.Points, Strict=False)
cull_pattern_18 = CullPattern(List=grid_in_rectangle.Points, CullPattern=point_in_brep)

cluster_8 = Cluster_2(brep_2=clean_tree_3, brep=clean_tree_3)  # -> i, plane

bounding_rectangle_3 = BoundingRectangle(Geometry=clean_tree_3, Plane=cluster_8.plane, Axis=0, Slide=0, Union=True)  # -> Bounding, DimensionX, DimensionY
grid_in_rectangle_2 = GridInRectangle(Rectangle=bounding_rectangle_3.Bounding, Size=grid_size_m, Compact=False, FitSize=False)  # -> flatten(Points), U, V
point_in_brep_2 = PointInBrep(Brep=offset_surface, Point=grid_in_rectangle_2.Points, Strict=False)
cull_pattern_19 = CullPattern(List=grid_in_rectangle_2.Points, CullPattern=point_in_brep_2)

center_7 = Center(Geometry=bounding_rectangle_3.Bounding)  # -> Center, Dimension
unit_z_12 = UnitZ(Factor=Slider(1.6, range=0..10))
move_3 = Move(Geometry=center_7.Center, Motion=unit_z_12)  # -> flatten(Geometry), Transform
list_length_4 = ListLength(List=move_3.Geometry)
series_3 = Series(Start=Slider(1, range=0..1), Step=1, Count=list_length_4)
concatenate_16 = Concatenate(FragmentA="B 0", FragmentB=series_3)
colour_swatch_28 = ColourSwatch(SwatchColor=RGB(0, 212, 255))
define_text_dot_3 = DefineTextDot(Text=concatenate_16, Location=move_3.Geometry, Font="Arial", Size=14)
text_tag_3d = TextTag3D(Location=move_3.Geometry, Text=concatenate_16, Size=Slider(5, range=0..10), Colour=colour_swatch_28, Justification=1)  # disabled
text_tag = TextTag(Location=move_3.Geometry, Text=concatenate_16, Colour=colour_swatch_28)

enumerator_11 = Enumerator(Object=move_3.Geometry)  # -> Numbers, Color

# ----
# Dividing roof into 3 regions which accumilates to givin percentage
center_8 = Center(Geometry=clean_tree_3)  # -> Center, Dimension
pull_point_2 = PullPoint(Point=cull_pattern_19, Geometry=center_8.Center, ClosestOnly=True)  # -> ClosestPoint, Distance
min_max = MinMax(Number=pull_point_2.Distance)  # -> Minimum, Maximum
number_slider_68 = Slider(3, range=0..10)
construct_domain_2 = ConstructDomain(DomainStart=0, DomainEnd=min_max.Maximum)
divide_domain = DivideDomain(Domain=construct_domain_2, Count=number_slider_68)
list_item_6 = ListItem(List=divide_domain, Index=0, Wrap=True)  # -> Item, Item1, Item2
includes = Includes(Value=pull_point_2.Distance, Domain=list_item_6.Item)  # -> Includes, Deviation
includes_2 = Includes(Value=pull_point_2.Distance, Domain=list_item_6.Item1)  # -> Includes, Deviation
includes_3 = Includes(Value=pull_point_2.Distance, Domain=list_item_6.Item2)  # -> Includes, Deviation
cull_pattern_20 = CullPattern(List=cull_pattern_19, CullPattern=includes_2.Includes)
cull_pattern_21 = CullPattern(List=cull_pattern_19, CullPattern=includes.Includes)
cull_pattern_22 = CullPattern(List=cull_pattern_19, CullPattern=includes_3.Includes)
list_length_5 = ListLength(List=cull_pattern_21)
list_length_6 = ListLength(List=cull_pattern_20)
list_length_7 = ListLength(List=cull_pattern_22)
multiplication_11 = Multiplication(A=list_length_5, B=division)
multiplication_12 = Multiplication(A=list_length_6, B=division)
multiplication_13 = Multiplication(A=list_length_7, B=division)
closest_points = ClosestPoints(Point=center_8.Center, Cloud=cull_pattern_21, Count=multiplication_11)  # -> ClosestPoint, CPIndex, Distance
closest_points_2 = ClosestPoints(Point=center_8.Center, Cloud=cull_pattern_22, Count=multiplication_13)  # -> ClosestPoint, CPIndex, Distance
closest_points_3 = ClosestPoints(Point=center_8.Center, Cloud=cull_pattern_20, Count=multiplication_12)  # -> ClosestPoint, CPIndex, Distance
list_length_8 = ListLength(List=closest_points.ClosestPoint)
list_length_9 = ListLength(List=closest_points_2.ClosestPoint)
list_length_10 = ListLength(List=closest_points_3.ClosestPoint)
merge_37 = Merge(Data1=closest_points.ClosestPoint, Data2=closest_points_3.ClosestPoint, Data3=closest_points_2.ClosestPoint)
list_length_11 = ListLength(List=flatten(cull_pattern_19))
list_length_12 = ListLength(List=flatten(merge_37))
mass_addition_6 = MassAddition(Input=flatten(list_length_11))  # -> Result, PartialResults
mass_addition_7 = MassAddition(Input=flatten(list_length_12))  # -> Result, PartialResults
division_2 = Division(A=mass_addition_7.Result, B=mass_addition_6.Result)
panel_85 = Panel(division_2)

query_model_objects_12 = QueryModelObjects(Layer="Box Obstacles", Locked=True, Hidden=True, AutoUpdateState=True)
model_object_12 = ModelObject(Object=query_model_objects_12)  # -> Object, Geometry, Name, Layer, Visibility, Display, Drafting, Render
data_17 = Data(cull_pattern_19)
surface = Surface(clean_tree_3)
project_2 = Project(Geometry=model_object_12.Geometry, Plane=cluster_8.plane)  # -> Geometry, Transform
brep_wireframe_4 = BrepWireframe(Brep=project_2.Geometry, Density=-1)
unit_z_13 = UnitZ(Factor=Slider(3, range=0..10))
join_curves_4 = JoinCurves(Curves=brep_wireframe_4, Preserve=False)  # -> flatten(Curves)
boundary_surfaces_4 = BoundarySurfaces(Edges=join_curves_4)
buffer = Slider(2, range=0.1..20)
pull_point_3 = PullPoint(Point=data_17, Geometry=boundary_surfaces_4, ClosestOnly=True)  # -> ClosestPoint, Distance
extrude_12 = Extrude(Base=join_curves_4, Direction=unit_z_13)
larger_than_2 = LargerThan(FirstNumber=pull_point_3.Distance, SecondNumber=buffer)  # -> LargerThan, OrEqualTo
cap_holes = CapHoles(Brep=extrude_12)
custom_preview_6 = CustomPreview(Geometry=cap_holes, Material=ColourSwatch(SwatchColor=RGB(76, 76, 76)))

brep_wireframe_5 = BrepWireframe(Brep=clean_tree_3, Density=-1)
join_curves_5 = JoinCurves(Curves=brep_wireframe_5, Preserve=False)
list_item_7 = ListItem(List=join_curves_5, Index=0, Wrap=True)
divide_into_groups = Slider(1, range=0..4)
list_length_13 = ListLength(List=flatten(cull_pattern_19))
mass_addition_8 = MassAddition(Input=flatten(list_length_13))  # -> Result, PartialResults

evaluate_curve = EvaluateCurve(Curve=reparameterize(list_item_7), Parameter=locate)  # -> Point, Tangent, Angle

pull_point_4 = PullPoint(Point=cull_pattern_19, Geometry=evaluate_curve.Point, ClosestOnly=True)  # -> ClosestPoint, Distance
min_max_2 = MinMax(Number=pull_point_4.Distance)  # -> Minimum, Maximum
construct_domain_3 = ConstructDomain(DomainStart=0, DomainEnd=min_max_2.Maximum)
divide_domain_2 = DivideDomain(Domain=construct_domain_3, Count=divide_into_groups)
list_item_8 = ListItem(List=divide_domain_2, Index=0, Wrap=True)  # -> Item, Item1, Item2, Item3
includes_4 = Includes(Value=pull_point_4.Distance, Domain=list_item_8.Item)  # -> Includes, Deviation
includes_5 = Includes(Value=pull_point_4.Distance, Domain=list_item_8.Item1)  # -> Includes, Deviation
includes_6 = Includes(Value=pull_point_4.Distance, Domain=list_item_8.Item2)  # -> Includes, Deviation
includes_7 = Includes(Value=pull_point_4.Distance, Domain=list_item_8.Item3)  # -> Includes, Deviation
cull_pattern_23 = CullPattern(List=cull_pattern_19, CullPattern=includes_4.Includes)
cull_pattern_24 = CullPattern(List=cull_pattern_19, CullPattern=includes_6.Includes)
cull_pattern_25 = CullPattern(List=cull_pattern_19, CullPattern=includes_5.Includes)
cull_pattern_26 = CullPattern(List=cull_pattern_19, CullPattern=includes_7.Includes)
list_length_14 = ListLength(List=cull_pattern_26)
list_length_15 = ListLength(List=cull_pattern_23)
list_length_16 = ListLength(List=cull_pattern_25)
list_length_17 = ListLength(List=cull_pattern_24)
multiplication_14 = Multiplication(A=list_length_14, B=division)
multiplication_15 = Multiplication(A=list_length_16, B=division)
multiplication_16 = Multiplication(A=list_length_17, B=division)
multiplication_17 = Multiplication(A=list_length_15, B=division)
closest_points_4 = ClosestPoints(Point=evaluate_curve.Point, Cloud=cull_pattern_23, Count=multiplication_17)  # -> ClosestPoint, CPIndex, Distance
closest_points_5 = ClosestPoints(Point=evaluate_curve.Point, Cloud=cull_pattern_24, Count=multiplication_16)  # -> ClosestPoint, CPIndex, Distance
closest_points_6 = ClosestPoints(Point=evaluate_curve.Point, Cloud=cull_pattern_26, Count=multiplication_14)  # -> ClosestPoint, CPIndex, Distance
closest_points_7 = ClosestPoints(Point=evaluate_curve.Point, Cloud=cull_pattern_25, Count=multiplication_15)  # -> ClosestPoint, CPIndex, Distance
list_length_18 = ListLength(List=closest_points_4.ClosestPoint)
list_length_19 = ListLength(List=closest_points_6.ClosestPoint)
list_length_20 = ListLength(List=closest_points_5.ClosestPoint)
list_length_21 = ListLength(List=closest_points_7.ClosestPoint)
merge_38 = Merge(
    Data1=closest_points_4.ClosestPoint,
    Data2=closest_points_7.ClosestPoint,
    Data3=closest_points_5.ClosestPoint,
    Data4=closest_points_6.ClosestPoint)

removeduplicatepts = RemoveDuplicatePts(Points=merge_38, Tolerance=0.01)

list_length_22 = ListLength(List=flatten(removeduplicatepts))
mass_addition_9 = MassAddition(Input=flatten(list_length_22))  # -> Result, PartialResults
division_3 = Division(A=mass_addition_9.Result, B=mass_addition_8.Result)
panel_86 = Panel(division_3)

query_model_objects_13 = QueryModelObjects(Layer="Point obstacles", Locked=True, Hidden=True, AutoUpdateState=True)
data_18 = Data(cull_pattern_19)
model_object_13 = ModelObject(Object=query_model_objects_13)  # -> Object, Geometry, Name, Layer, Visibility, Display, Drafting, Render
project_3 = Project(Geometry=model_object_13.Geometry, Plane=cluster_8.plane)  # -> Geometry, Transform
buffer_2 = Slider(1.1, range=0.1..20)
colour_swatch_29 = ColourSwatch(SwatchColor=RGB(0, 74, 130))

surface_2 = Surface(clean_tree_3)
surface_closest_point = SurfaceClosestPoint(Point=project_3.Geometry, Surface=surface_2)  # -> Point, UVPoint, Distance

pull_point_5 = PullPoint(Point=data_18, Geometry=surface_closest_point.Point, ClosestOnly=True)  # -> ClosestPoint, Distance
dot_display = DotDisplay(Point=surface_closest_point.Point, Colour=colour_swatch_29, Size=Slider(0.6, range=0..1))
larger_than_3 = LargerThan(FirstNumber=pull_point_5.Distance, SecondNumber=buffer_2)  # -> LargerThan, OrEqualTo

gate_and = GateAnd(A=larger_than_3.LargerThan, B=larger_than_2.LargerThan)
cull_pattern_27 = CullPattern(List=data_17, CullPattern=gate_and)
custom_preview_lineweights_10 = CustomPreviewLineweights(Geometry=curve, Shader=colour_swatch_29, Thickness=Slider(5, range=0..10), Absolute=False)

value_list = ValueList({"Generic Green Roof": 0, "Design my Own Roof": 1}, selected="Generic Green Roof")
stream_filter = StreamFilter(Gate=value_list, Stream0=removeduplicatepts, Stream1=cull_pattern_27)

# ----
# Rectangles
box_bottom_surface = BoxTopSurface(brep=offset_surface)
brep_wireframe_6 = BrepWireframe(Brep=box_bottom_surface, Density=-1)
join_curves_6 = JoinCurves(Curves=brep_wireframe_6, Preserve=False)  # -> simplify(Curves)
number_slider_69 = Slider(2, range=0..10)
pull_point_6 = PullPoint(Point=stream_filter, Geometry=flatten(join_curves_6), ClosestOnly=True)  # -> ClosestPoint, Distance
list_length_23 = ListLength(List=cull_pattern_19)
list_length_24 = ListLength(List=stream_filter)
larger_than_4 = LargerThan(FirstNumber=pull_point_6.Distance, SecondNumber=number_slider_69)  # -> LargerThan, OrEqualTo
cull_pattern_28 = CullPattern(List=stream_filter, CullPattern=larger_than_4.LargerThan)
clean_tree_4 = CleanTree(RemoveNulls=True, RemoveInvalid=True, RemoveEmpty=True, Tree=cull_pattern_28)  # -> simplify(Tree)
starting_domain = Slider(0.1, range=0.1..1)
align_plane_2 = AlignPlane(Plane=clean_tree_4, Direction=cluster_8.i)  # -> Plane, Angle
pull_point_7 = PullPoint(Point=clean_tree_4, Geometry=join_curves_6, ClosestOnly=True)  # -> ClosestPoint, Distance
number_slider_70 = Slider(1, range=0..1)
number_slider_71 = Slider(1.5, range=0..10)
bounds = Bounds(Numbers=pull_point_7.Distance)
square = Square(Value=grid_size_m)
constrained_area_rectangle = ConstrainedAreaRectangle(Plane=align_plane_2.Plane, Area=square, FactorX=number_slider_70, FactorY=number_slider_70)  # -> Rectangle, DimensionX, DimensionY
panel_87 = Panel(constrained_area_rectangle.DimensionY)
panel_88 = Panel(constrained_area_rectangle.DimensionX)

division_4 = Division(A=list_length_24, B=list_length_23)

# ----
# T Mass / m2
# mass of one cell
# Area of one cell
vegitation_weight_heavy = Panel("200")
saturated_soil_density_cocopeat_per_m3 = Panel("600")
user_inputs_roof_dead_load_bearing = Panel("600")
vegitation_weight_medium = Panel("100")
square_2 = Square(Value=grid_size_m)
vegitation_weight_light = Panel("50")
addition_11 = Addition(A=saturated_soil_density_cocopeat_per_m3, B=vegitation_weight_medium)
multiplication_18 = Multiplication(A=user_inputs_roof_dead_load_bearing, B=square_2)
division_5 = Division(A=user_inputs_roof_dead_load_bearing, B=addition_11)
maximum_soil_depth = Panel(division_5)
round_4 = Round(Number=multiplication_18)  # -> Nearest, Floor, Ceiling

multiplication_19 = Multiplication(A=division_4, B=100)
round_5 = Round(Number=multiplication_19)  # -> Nearest, Floor, Ceiling
panel_89 = Panel(round_5.Nearest)
construct_domain_4 = ConstructDomain(DomainStart=division_5, DomainEnd=starting_domain)
construct_domain_5 = ConstructDomain(DomainStart=starting_domain, DomainEnd=division_5)
remap_numbers = RemapNumbers(Value=pull_point_7.Distance, Source=bounds, Target=construct_domain_5)  # -> Mapped, Clipped
box_rectangle = BoxRectangle(Rectangle=constrained_area_rectangle.Rectangle, Height=remap_numbers.Mapped)  # -> simplify(Box)
panel_90 = Panel(remap_numbers.Mapped)
box_sides = BoxTopSurface_2(brep=box_rectangle)
box_top_surface_8 = BoxTopSurface(brep=box_rectangle)
entwine = Entwine(Branch00=box_top_surface_8, Branch01=box_sides, FlattenInputs=True)

set_chart_contents_5 = SetChartContents(ChartToModify=create_chart_2, NewChartValues=flatten(round_5.Nearest), NewChartNames=concatenate_10)

volume = Volume(Geometry=box_rectangle)  # -> Volume, Centroid
multiplication_20 = Multiplication(A=addition_11, B=volume.Volume)
larger_than_5 = LargerThan(FirstNumber=round_4.Nearest, SecondNumber=multiplication_20)  # -> LargerThan, OrEqualTo
cull_pattern_29 = CullPattern(List=box_rectangle, CullPattern=invert(larger_than_5.OrEqualTo))
cull_pattern_30 = CullPattern(List=box_rectangle, CullPattern=larger_than_5.OrEqualTo)

box_bottom_surface_2 = BoxBottomSurface(brep=box_rectangle)
cluster_9 = Cluster_9(list=box_rectangle)

number_slider_72 = Slider(1.75, range=1..2)
grid_in_rectangle_3 = GridInRectangle(Rectangle=constrained_area_rectangle.Rectangle, Size=number_slider_72, Compact=True)  # -> Points, U, V
unit_z_14 = UnitZ(Factor=remap_numbers.Mapped)
number_slider_73 = Slider(0.2, range=0..10)
number_slider_74 = Slider(0.2, range=0..1)
colour_swatch_30 = ColourSwatch(SwatchColor=RGB(54, 54, 54))
colour_swatch_31 = ColourSwatch(SwatchColor=RGBA(99, 150, 65, 240))
move_4 = Move(Geometry=grid_in_rectangle_3.Points, Motion=unit_z_14)  # -> Geometry, Transform
colour_swatch_32 = ColourSwatch(SwatchColor=RGB(51, 105, 39))
custom_preview_lineweights_11 = CustomPreviewLineweights(Geometry=box_sides, Shader=colour_swatch_30, Thickness=number_slider_74, Absolute=False)
custom_preview_lineweights_12 = CustomPreviewLineweights(Geometry=box_top_surface_8, Shader=colour_swatch_31, Thickness=number_slider_74, Absolute=False)
dot_display_2 = DotDisplay(Point=move_4.Geometry, Colour=colour_swatch_32, Size=number_slider_73)

# ----
# S=1: Perfect balance, all rain is absorbed, no runoff.
# S<1: Insufficient soil absorption, resulting in runoff.
# S>1: Excess soil absorption capacity, no runoff, with room to absorb more water.
division_6 = Division(A=saturated_soil_density_cocopeat_per_m3, B=1000)
max_rain_fail_in_one_hour_3 = Panel(max_rain_fail_in_one_hour)
multiplication_21 = Multiplication(A=division_6, B=remap_numbers.Mapped)
division_7 = Division(A=multiplication_21, B=max_rain_fail_in_one_hour_3)
value_list_2 = ValueList({"Min": 0, "Average": 1, "Max": 2}, selected="Average")
average = Average(Input=division_7)
min_max_3 = MinMax(Number=division_7)  # -> Minimum, Maximum
water_holding_capacity_for_each_box = Panel(multiplication_21)
mass_addition_10 = MassAddition(Input=multiplication_21)  # -> Result, PartialResults
stream_filter_2 = StreamFilter(Gate=value_list_2, Stream0=min_max_3.Minimum, Stream1=average, Stream2=min_max_3.Maximum)
water_holding_capacity_total = Panel(mass_addition_10.Result)
modulus = Modulus(A="1", B=stream_filter_2)
s_soil_retention_factor = Panel(modulus)

# ----
# Sun Hours
panel_91 = Panel("https://climate.onebuilding.org/WMO_Region_2_Asia/IND_India/MH_Maharashtra/IND_MH_Mumbai-Shivaji.Intl.AP.430030_TMYx.zip")
downloadepw = LBDownloadWeather(weather_URL=panel_91)  # -> epw_file, stat_file, ddy_file; plug-in component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
importepw = LBImportEPW(epw_file=downloadepw.epw_file)  # -> location, dry_bulb_temperature, dew_point_temperature, relative_humidity, wind_speed, wind_direction, direct_normal_rad, diffuse_horizontal_rad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; plug-in component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
number_slider_75 = Slider(23, range=0..23)
number_slider_76 = Slider(5, range=5..8)
number_slider_77 = Slider(7, range=1..31)
number_slider_78 = Slider(7, range=0..23)
number_slider_79 = Slider(5, range=5..8)
number_slider_80 = Slider(7, range=1..31)
number_slider_81 = Slider(1, range=0..1)
number_slider_82 = Slider(12, range=0..100)
number_slider_83 = Slider(3.8, range=0..10)
analysisperiod = LBAnalysisPeriod(
    start_month=number_slider_79,
    start_day=number_slider_80,
    start_hour=0,
    end_month=number_slider_76,
    end_day=number_slider_77,
    end_hour=number_slider_75)  # -> period, hoys, dates; plug-in component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
legendpar = LBLegendParameters(min=number_slider_81, max=number_slider_82)  # -> leg_par; plug-in component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
number_slider_84 = Slider(4, range=0..10)
mesh = Mesh(box_top_surface_8)
relay = Relay()
sunpath = LBSunPath(location=importepw.location, hoys=analysisperiod.hoys, scale=number_slider_83)  # -> out, vectors, altitudes, azimuths, hoys, sun_pts, analemma, daily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; plug-in component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
division_8 = Division(A=grid_size_m, B=number_slider_84)
boolean_toggle = BooleanToggle(False)
number_slider_85 = Slider(258.9, range=0..510)
directsunhours = LBDirectSunHours(
    vectors=flatten(sunpath.vectors),
    geometry=flatten(mesh),
    context=flatten(relay),
    grid_size=division_8,
    legend_par=legendpar,
    run=boolean_toggle)  # -> out, points, results, mesh, legend, title, int_mtx; plug-in component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
amplitude = Amplitude(Vector=sunpath.vectors, Amplitude=number_slider_85)
number_slider_86 = Slider(9, range=6..9)
text_tag_2 = TextTag(Location=directsunhours.points, Text=directsunhours.results)
vector_display = VectorDisplay(Anchor=sunpath.sun_pts, Vector=amplitude)
mesh_explode = MeshExplode(Mesh=directsunhours.mesh, Interpolate=False)
number_slider_87 = Slider(5, range=0..6)
smaller_than_4 = SmallerThan(FirstNumber=directsunhours.results, SecondNumber=number_slider_86)  # -> SmallerThan, OrEqualTo
mesh_sphere = MeshSphere(Base=sunpath.sun_pts, Radius=number_slider_87, UCount=10, VCount=20)
colour_swatch_33 = ColourSwatch(SwatchColor=RGBA(255, 247, 0, 145))
custom_preview_7 = CustomPreview(Geometry=mesh_sphere, Material=colour_swatch_33)
cull_pattern_31 = CullPattern(List=mesh_explode, CullPattern=invert(smaller_than_4.SmallerThan))
cull_pattern_32 = CullPattern(List=mesh_explode, CullPattern=smaller_than_4.SmallerThan)

# ----
# Radiation
panel_92 = Panel("2000")
point_3 = Point(Point(103583.6693, 2098096.402, 54))
merge_39 = Merge(Data1=cap_holes, Data2=clean_tree)
skymatrix = LBCumulativeSkyMatrix(location=importepw.location, direct_rad=importepw.direct_normal_rad, diffuse_rad=importepw.diffuse_horizontal_rad)  # -> out, sky_mtx; plug-in component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
legendpar_2 = LBLegendParameters(min="365", max="2372.5", base_plane=point_3)  # -> leg_par; plug-in component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
incidentradiation = LBIncidentRadiation(
    sky_mtx=skymatrix.sky_mtx,
    geometry=flatten(mesh),
    context=flatten(merge_39),
    grid_size=division_8,
    legend_par=legendpar_2,
    run=Toggle(True))  # -> out, points, results, total, mesh, legend, title, int_mtx; plug-in component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
mesh_explode_2 = MeshExplode(Mesh=incidentradiation.mesh, Interpolate=False)
bounds_2 = Bounds(Numbers=incidentradiation.results)
panel_93 = Panel(incidentradiation.results)
divide_domain_3 = DivideDomain(Domain=bounds_2, Count=Slider(5, range=0..10))
list_item_9 = ListItem(List=divide_domain_3, Index=0, Wrap=True)  # -> Item, Item1, Item2, Item3, Item4
includes_8 = Includes(Value=incidentradiation.results, Domain=list_item_9.Item)  # -> Includes, Deviation
includes_9 = Includes(Value=incidentradiation.results, Domain=list_item_9.Item1)  # -> Includes, Deviation
includes_10 = Includes(Value=incidentradiation.results, Domain=list_item_9.Item2)  # -> Includes, Deviation
includes_11 = Includes(Value=incidentradiation.results, Domain=list_item_9.Item4)  # -> Includes, Deviation
includes_12 = Includes(Value=incidentradiation.results, Domain=list_item_9.Item3)  # -> Includes, Deviation
cull_pattern_33 = CullPattern(List=mesh_explode_2, CullPattern=includes_10.Includes)
cull_pattern_34 = CullPattern(List=mesh_explode_2, CullPattern=includes_11.Includes)
cull_pattern_35 = CullPattern(List=mesh_explode_2, CullPattern=includes_12.Includes)
cull_pattern_36 = CullPattern(List=mesh_explode_2, CullPattern=includes_9.Includes)
cull_pattern_37 = CullPattern(List=mesh_explode_2, CullPattern=includes_8.Includes)
mesh_colours = MeshColours(Mesh=cull_pattern_36, Colours=ColourSwatch(SwatchColor=RGB(127, 140, 29)))
mesh_colours_2 = MeshColours(Mesh=cull_pattern_33, Colours=ColourSwatch(SwatchColor=RGB(171, 186, 54)))
mesh_colours_3 = MeshColours(Mesh=cull_pattern_35, Colours=ColourSwatch(SwatchColor=RGB(201, 219, 61)))
mesh_colours_4 = MeshColours(Mesh=cull_pattern_34, Colours=ColourSwatch(SwatchColor=RGB(233, 255, 69)))
mesh_colours_5 = MeshColours(Mesh=cull_pattern_37, Colours=ColourSwatch(SwatchColor=RGB(80, 89, 9)))
custom_preview_8 = CustomPreview(Material={diffuse=RGB(221, 160, 221), emission=RGB(66, 48, 66), shine=0.5, specular=RGB(255, 255, 255), transparency=0})

area_7 = Area(Geometry=constrained_area_rectangle.Rectangle)  # -> Area, Centroid
panel_94 = Panel("1")
subtraction_2 = Subtraction(A=panel_94, B=modulus)
mass_addition_11 = MassAddition(Input=area_7.Area)  # -> Result, PartialResults
run_off_coeffecient_green = Panel("0.2")
gr_area_per_building = Panel(mass_addition_11.Result)
multiplication_22 = Multiplication(A=mass_addition_11.Result, B=max_rain_fail_in_one_hour_3, C=run_off_coeffecient_green, D=subtraction_2)
green_roof_runoff_volume_per_building = Panel(multiplication_22)

area_8 = Area(Geometry=clean_tree_3)  # -> Area, Centroid
mass_addition_12 = MassAddition(Input=area_8.Area)  # -> Result, PartialResults
run_off_coeffecient_concrete_2 = Panel("0.70")
multiplication_23 = Multiplication(A=mass_addition_12.Result, B=max_rain_fail_in_one_hour_3, C=run_off_coeffecient_concrete_2)
roof_area = Panel(mass_addition_12.Result)
concrete_roof_run_off_volume = Panel(multiplication_23)

volume_2 = Volume(Geometry=box_rectangle)  # -> Volume, Centroid
cocopeat_soil_price_per_m3 = Panel("")
multiplication_24 = Multiplication(A=cocopeat_soil_price_per_m3, B=volume_2.Volume)
mass_addition_13 = MassAddition(Input=multiplication_24)  # -> Result, PartialResults
round_6 = Round(Number=multiplication_24)  # -> Nearest, Floor, Ceiling
panel_95 = Panel("")
concatenate_17 = Concatenate(FragmentA=round_6.Nearest, FragmentB=panel_95)
round_7 = Round(Number=mass_addition_13.Result)  # -> Nearest, Floor, Ceiling
concatenate_18 = Concatenate(FragmentA=round_7.Nearest, FragmentB=panel_95)
estimate_cost_per_box = Panel(concatenate_17)
estimate_soil_cost_per_building = Panel(concatenate_18)

concatenate_19 = Concatenate(FragmentA="Estimate cost", FragmentB=panel_95)

box_bottom_surface_3 = BoxTopSurface(brep=box_rectangle)
box_sides_2 = BoxTopSurface_2(brep=box_rectangle)
area_9 = Area(Geometry=box_bottom_surface_3)  # -> Area, Centroid
area_10 = Area(Geometry=box_sides_2)  # -> Area, Centroid
merge_40 = Merge(Data1=area_9.Area, Data2=area_10.Area)
trim_tree_3 = TrimTree(Tree=merge_40, Depth=1)
plastic_price_polypropylene_pp = Panel("")
mass_addition_14 = MassAddition(Input=trim_tree_3)  # -> Result, PartialResults
multiplication_25 = Multiplication(A=mass_addition_14.Result, B=plastic_price_polypropylene_pp)
round_8 = Round(Number=multiplication_25)  # -> Nearest, Floor, Ceiling
plastic_material_area_m2_per_building = Panel(mass_addition_14.Result)
concatenate_20 = Concatenate(FragmentA=round_8.Nearest, FragmentB=panel_95)
estimate_plastic_material_cost = Panel(concatenate_20)

box_top_surface_9 = BoxTopSurface(brep=box_rectangle)
area_11 = Area(Geometry=box_top_surface_9)  # -> Area, Centroid
trim_tree_4 = TrimTree(Tree=area_11.Area, Depth=1)
vegitation_price_per_m2_perennials_and_w = Panel("")  # "Vegitation price per m2 (Perennials and Wildflowers)"
mass_addition_15 = MassAddition(Input=trim_tree_4)  # -> Result, PartialResults
multiplication_26 = Multiplication(A=mass_addition_15.Result, B=vegitation_price_per_m2_perennials_and_w)
round_9 = Round(Number=multiplication_26)  # -> Nearest, Floor, Ceiling
vegitation_area_m2_per_building = Panel(mass_addition_15.Result)
concatenate_21 = Concatenate(FragmentA=round_9.Nearest, FragmentB=panel_95)
estimate_vegitation_material_cost = Panel(concatenate_21)

set_chart_contents_6 = SetChartContents(
    ChartToModify=create_chart_3,
    NewChartValues=flatten([round_8.Nearest, round_7.Nearest, round_9.Nearest]),
    NewChartNames=panel_37)

mass_addition_16 = MassAddition(Input=merge_40)  # -> Result, PartialResults
plastic_material_area_m2_per_box = Panel(mass_addition_16.Result)
mass_addition_17 = MassAddition(Input=round_8.Nearest)  # -> Result, PartialResults
mass_addition_18 = MassAddition(Input=round_7.Nearest)  # -> flatten(Result), PartialResults
addition_12 = Addition(A=round_8.Nearest, B=round_7.Nearest, C=round_9.Nearest)
concatenate_22 = Concatenate(FragmentA=addition_12, FragmentB=panel_95)
entwine_2 = Entwine(Branch00=mass_addition_17.Result, Branch01=round_7.Nearest, FlattenInputs=True)
total_estimated_dry_cost_per_building = Panel(concatenate_22)
panel_96 = Panel(entwine_2)

volume_3 = Volume(Geometry=box_rectangle)  # -> Volume, Centroid
module_price_per_m3 = Panel("1160")
multiplication_27 = Multiplication(A=module_price_per_m3, B=volume_3.Volume)
mass_addition_19 = MassAddition(Input=multiplication_27)  # -> Result, PartialResults
round_10 = Round(Number=multiplication_27)  # -> Nearest, Floor, Ceiling
concatenate_23 = Concatenate(FragmentA=round_10.Nearest, FragmentB=" €")
round_11 = Round(Number=mass_addition_19.Result)  # -> Nearest, Floor, Ceiling
concatenate_24 = Concatenate(FragmentA=round_11.Nearest, FragmentB=panel_95)
estimate_cost_per_box_2 = Panel(concatenate_23)
estimate_cost_per_building = Panel(concatenate_24)

# ----
# Soil Depth
number_slider_88 = Slider(0.2, range=0..1)
construct_domain_6 = ConstructDomain(DomainStart=Slider(0.01, range=0..0.01), DomainEnd=Slider(0.2, range=0..1))
construct_domain_7 = ConstructDomain(DomainStart=Slider(0.4, range=0..1), DomainEnd=Slider(0.6, range=0..1))
construct_domain_8 = ConstructDomain(DomainStart=Slider(0.6, range=0..1), DomainEnd=Slider(1, range=0..1))
construct_domain_9 = ConstructDomain(DomainStart=number_slider_88, DomainEnd=Slider(0.4, range=0..1))
includes_13 = Includes(Value=remap_numbers.Mapped, Domain=construct_domain_9)  # -> Includes, Deviation
includes_14 = Includes(Value=remap_numbers.Mapped, Domain=construct_domain_7)  # -> Includes, Deviation
includes_15 = Includes(Value=remap_numbers.Mapped, Domain=construct_domain_8)  # -> Includes, Deviation
includes_16 = Includes(Value=remap_numbers.Mapped, Domain=construct_domain_6)  # -> Includes, Deviation
cull_pattern_38 = CullPattern(List=box_rectangle, CullPattern=includes_13.Includes)
cull_pattern_39 = CullPattern(List=box_rectangle, CullPattern=includes_14.Includes)
cull_pattern_40 = CullPattern(List=box_rectangle, CullPattern=includes_16.Includes)
cull_pattern_41 = CullPattern(List=box_rectangle, CullPattern=includes_15.Includes)
colour_swatch_34 = ColourSwatch(SwatchColor=RGB(48, 87, 16))
colour_swatch_35 = ColourSwatch(SwatchColor=RGB(114, 201, 42))
colour_swatch_36 = ColourSwatch(SwatchColor=RGB(78, 143, 24))
box_top_surface_10 = BoxTopSurface(brep=cull_pattern_40)
number_slider_89 = Slider(10, range=0..100)
box_top_surface_11 = BoxTopSurface(brep=cull_pattern_41)
custom_preview_lineweights_13 = CustomPreviewLineweights(Geometry=cull_pattern_38, Shader=colour_swatch_36, Absolute=False)
custom_preview_lineweights_14 = CustomPreviewLineweights(Geometry=cull_pattern_39, Shader=colour_swatch_34, Absolute=False)
herbs = Herbs(geometry=box_top_surface_10, count=number_slider_89)
custom_preview_lineweights_15 = CustomPreviewLineweights(Geometry=cull_pattern_40, Shader=colour_swatch_35, Absolute=False)

panel_97 = Panel(divide_domain_3)
construct_domain_10 = ConstructDomain(DomainStart="365", DomainEnd="1003.75")
construct_domain_11 = ConstructDomain(DomainStart="1003.75", DomainEnd="1825")
construct_domain_12 = ConstructDomain(DomainStart="1825", DomainEnd="2372.5")
includes_17 = Includes(Value=incidentradiation.results, Domain=construct_domain_10)  # -> Includes, Deviation
includes_18 = Includes(Value=incidentradiation.results, Domain=construct_domain_11)  # -> Includes, Deviation
includes_19 = Includes(Value=incidentradiation.results, Domain=construct_domain_12)  # -> Includes, Deviation
cull_pattern_42 = CullPattern(List=mesh_explode_2, CullPattern=includes_18.Includes)
cull_pattern_43 = CullPattern(List=mesh_explode_2, CullPattern=includes_19.Includes)

custom_preview_lineweights_16 = CustomPreviewLineweights(Geometry=cull_pattern_41, Shader=colour_swatch_7, Absolute=False)
cluster_10 = Cluster_10(
    d1=construct_domain_6,
    d2=construct_domain_9,
    d3=construct_domain_7,
    d4=construct_domain_8,
    d1_2=colour_swatch_35,
    d2_2=colour_swatch_36,
    d3_2=colour_swatch_34,
    d4_2=colour_swatch_7,
    base_plane=point)  # -> mesh, label_objs
data_19 = Data([cluster_10.mesh, cluster_10.label_objs])

# ----
# Soil Depth till 0.2m
gate_and_2 = GateAnd(A=includes_16.Includes, B=includes_18.Includes)
gate_and_3 = GateAnd(A=includes_16.Includes, B=includes_17.Includes)
gate_and_4 = GateAnd(A=includes_16.Includes, B=includes_19.Includes)
cull_pattern_44 = CullPattern(List=box_rectangle, CullPattern=gate_and_2)
cull_pattern_45 = CullPattern(List=box_rectangle, CullPattern=gate_and_4)
cull_pattern_46 = CullPattern(List=box_rectangle, CullPattern=gate_and_3)
box_top_surface_12 = BoxTopSurface(brep=cull_pattern_44)
box_top_surface_13 = BoxTopSurface(brep=cull_pattern_46)
box_top_surface_14 = BoxTopSurface(brep=cull_pattern_45)
herbs_2 = Herbs(geometry=box_top_surface_12, count=number_slider_89)  # disabled
herbs_3 = Herbs(geometry=box_top_surface_13, count=number_slider_89)  # disabled
cluster_11 = Cluster_4(geometry=box_top_surface_14, count=number_slider_89)  # disabled
center_9 = Center(Geometry=box_top_surface_12, forall=True)  # -> Center, Dimension
center_10 = Center(Geometry=box_top_surface_13, forall=True)  # -> Center, Dimension
center_11 = Center(Geometry=box_top_surface_14, forall=True)  # -> Center, Dimension

# ----
# Soil Depth 0.2-0.4
gate_and_5 = GateAnd(A=includes_13.Includes, B=includes_18.Includes)
gate_and_6 = GateAnd(A=includes_13.Includes, B=includes_17.Includes)
gate_and_7 = GateAnd(A=includes_13.Includes, B=includes_19.Includes)
cull_pattern_47 = CullPattern(List=box_rectangle, CullPattern=gate_and_5)
cull_pattern_48 = CullPattern(List=box_rectangle, CullPattern=gate_and_7)
cull_pattern_49 = CullPattern(List=box_rectangle, CullPattern=gate_and_6)
box_top_surface_15 = BoxTopSurface(brep=cull_pattern_47)
box_top_surface_16 = BoxTopSurface(brep=cull_pattern_49)
box_top_surface_17 = BoxTopSurface(brep=cull_pattern_48)
panel_98 = Panel("Flemingia strobilifera,Reinwardtia indica")
center_12 = Center(Geometry=box_top_surface_16, forall=True)  # -> Center, Dimension
herbs_4 = Herbs(geometry=box_top_surface_16, count=number_slider_89)  # disabled
cluster_12 = Cluster_4(geometry=box_top_surface_17, count=number_slider_89)  # disabled
center_13 = Center(Geometry=box_top_surface_15, forall=True)  # -> Center, Dimension
panel_99 = Panel("""Achyranthes aspera,
Agave amica """)
center_14 = Center(Geometry=box_top_surface_17, forall=True)  # -> Center, Dimension
text_tag_3 = TextTag(Location=center_13.Center, Text=panel_98)

# ----
# Soil Depth 0.4-0.6
gate_and_8 = GateAnd(A=includes_14.Includes, B=includes_17.Includes)
gate_and_9 = GateAnd(A=includes_14.Includes, B=includes_18.Includes)
gate_and_10 = GateAnd(A=includes_14.Includes, B=includes_19.Includes)
cull_pattern_50 = CullPattern(List=box_rectangle, CullPattern=gate_and_9)
cull_pattern_51 = CullPattern(List=box_rectangle, CullPattern=gate_and_10)
cull_pattern_52 = CullPattern(List=box_rectangle, CullPattern=gate_and_8)
box_top_surface_18 = BoxTopSurface(brep=cull_pattern_50)
box_top_surface_19 = BoxTopSurface(brep=cull_pattern_52)
box_top_surface_20 = BoxTopSurface(brep=cull_pattern_51)
panel_100 = Panel("""Murraya
koenigii""")
herbs_5 = Herbs(geometry=box_top_surface_19, count=number_slider_89)  # disabled
center_15 = Center(Geometry=box_top_surface_18, forall=True)  # -> Center, Dimension
panel_101 = Panel("""Alocasia 
indica """)
center_16 = Center(Geometry=box_top_surface_19, forall=True)  # -> Center, Dimension
center_17 = Center(Geometry=box_top_surface_20, forall=True)  # -> Center, Dimension
panel_102 = Panel("""Jasminum sambac-1
,Murraya exotica""")

# ----
# Soil Depth 0.6-1
gate_and_11 = GateAnd(A=includes_15.Includes, B=includes_17.Includes)
gate_and_12 = GateAnd(A=includes_15.Includes, B=includes_18.Includes)
gate_and_13 = GateAnd(A=includes_15.Includes, B=includes_19.Includes)
cull_pattern_53 = CullPattern(List=box_rectangle, CullPattern=gate_and_12)
cull_pattern_54 = CullPattern(List=box_rectangle, CullPattern=gate_and_13)
cull_pattern_55 = CullPattern(List=box_rectangle, CullPattern=gate_and_11)
box_top_surface_21 = BoxTopSurface(brep=cull_pattern_53)
box_top_surface_22 = BoxTopSurface(brep=cull_pattern_55)
box_top_surface_23 = BoxTopSurface(brep=cull_pattern_54)
center_18 = Center(Geometry=box_top_surface_21, forall=True)  # -> Center, Dimension
center_19 = Center(Geometry=box_top_surface_22, forall=True)  # -> Center, Dimension
center_20 = Center(Geometry=box_top_surface_23, forall=True)  # -> Center, Dimension
panel_103 = Panel("""Citrus limon
,Hibiscus species""")
panel_104 = Panel("""Bauhinia 
tomentosa""")
panel_105 = Panel("""Bauhinia racemosa
,Carica papaya""")
text_tag_4 = TextTag(Location=center_20.Center, Text=panel_105)

# ---- group: shrubs
cluster_13 = Cluster_6(geometry=box_top_surface_15)  # disabled

cluster_14 = Cluster_6(geometry=box_top_surface_18)  # disabled

# ----
cluster_15 = Cluster_6(geometry=box_top_surface_22)  # disabled

# ---- group: shrub
cluster_16 = Cluster_6(geometry=box_top_surface_20)  # disabled

cluster_17 = Cluster_6(geometry=box_top_surface_23)  # disabled

# ---- group: tree
cluster_18 = Cluster_5(geometry=box_top_surface_21)  # disabled

# ----
cluster_19 = Cluster_5(geometry=box_top_surface_23)  # disabled
cluster_20 = Cluster_8(geometry=center_12.Center, length=multiplication_2, text="Ocimum tenuiflorum", size=number_slider_10)  # -> line, textdot
cluster_21 = Cluster_8(geometry=center_15.Center, length=multiplication_3, text=panel_100, size=number_slider_10)  # -> line, textdot
cluster_22 = Cluster_8(geometry=center_13.Center, length=multiplication_2, text=panel_98, size=number_slider_10)  # -> line, textdot
cluster_23 = Cluster_8(geometry=center_9.Center, length=multiplication, text="Eclipta prostata", size=number_slider_10)  # -> line, textdot
cluster_24 = Cluster_8(geometry=center_11.Center, length=multiplication, text="Cynodon dactylon", size=number_slider_10)  # -> line, textdot
cluster_25 = Cluster_8(geometry=center_10.Center, length=number_slider_17, text="Mentha arvensis*", size=number_slider_10)  # -> line, textdot
cluster_26 = Cluster_8(geometry=center_16.Center, length=multiplication_3, text=panel_101, size=number_slider_10)  # -> line, textdot
cluster_27 = Cluster_8(geometry=center_14.Center, length=multiplication_2, text=panel_99, size=number_slider_10)  # -> line, textdot
cluster_28 = Cluster_8(geometry=center_17.Center, length=multiplication_3, text=panel_102, size=number_slider_10)  # -> line, textdot
cluster_29 = Cluster_8(geometry=center_19.Center, length=multiplication_4, text=panel_104, size=number_slider_10)  # -> line, textdot
cluster_30 = Cluster_8(geometry=center_18.Center, length=multiplication_4, text=panel_103, size=number_slider_10)  # -> line, textdot
cluster_31 = Cluster_8(geometry=center_20.Center, length=multiplication_4, text=panel_105, size=number_slider_10)  # -> line, textdot
custom_preview_9 = CustomPreview(Geometry=[cluster_13, cluster_12, herbs_4], Material=ColourSwatch(SwatchColor=RGB(188, 201, 89)))
custom_preview_10 = CustomPreview(Geometry=[cluster_14, cluster_16, herbs_5], Material=ColourSwatch(SwatchColor=RGB(127, 140, 29)))
custom_preview_11 = CustomPreview(Geometry=[herbs_2, cluster_11, herbs_3], Material=ColourSwatch(SwatchColor=RGB(201, 219, 61)))
custom_preview_12 = CustomPreview(Geometry=[cluster_18, cluster_19, cluster_15], Material=ColourSwatch(SwatchColor=RGB(80, 89, 9)))

data_20 = Data(herbs_3)
data_21 = Data(herbs_2)
data_22 = Data(cluster_12)
data_23 = Data(cluster_19)
data_24 = Data(cluster_11)
data_25 = Data(herbs_4)
data_26 = Data(cluster_13)
data_27 = Data(herbs_5)
data_28 = Data(cluster_14)
data_29 = Data(cluster_16)
data_30 = Data(cluster_15)
data_31 = Data(cluster_18)

data_32 = Data(box_top_surface_12)
data_33 = Data(box_top_surface_16)
data_34 = Data(box_top_surface_19)
data_35 = Data(box_top_surface_13)
data_36 = Data(box_top_surface_14)
data_37 = Data(box_top_surface_15)
data_38 = Data(box_top_surface_17)
data_39 = Data(box_top_surface_18)
data_40 = Data(box_top_surface_20)
data_41 = Data(box_top_surface_22)
data_42 = Data(box_top_surface_21)
data_43 = Data(box_top_surface_23)

data_44 = Data(flatten([cluster_25.line, cluster_25.textdot]))
data_45 = Data(flatten([cluster_23.line, cluster_23.textdot]))
data_46 = Data(flatten([cluster_24.line, cluster_24.textdot]))

data_47 = Data(flatten([cluster_22.line, cluster_22.textdot]))
data_48 = Data(flatten([cluster_20.line, cluster_20.textdot]))
data_49 = Data(flatten([cluster_27.line, cluster_27.textdot]))

data_50 = Data(flatten([cluster_29.line, cluster_29.textdot]))
data_51 = Data(flatten([cluster_30.line, cluster_30.textdot]))
data_52 = Data(flatten([cluster_31.line, cluster_31.textdot]))

data_53 = Data(flatten([cluster_26.line, cluster_26.textdot]))
data_54 = Data(flatten([cluster_21.line, cluster_21.textdot]))
data_55 = Data(flatten([cluster_28.line, cluster_28.textdot]))

cluster_32 = Cluster_14(
    geometry=data_20,
    geometry_2=data_21,
    geometry_3=data_24,
    geometry_4=data_25,
    geometry_5=data_26,
    geometry_6=data_22,
    geometry_7=data_27,
    geometry_8=data_28,
    geometry_9=data_29,
    geometry_10=data_30,
    geometry_11=data_31,
    geometry_12=data_23)
data_56 = Data([cluster_25.line, cluster_25.textdot, cluster_23.line, cluster_23.textdot, cluster_24.line, cluster_24.textdot])  # disabled
data_57 = Data([cluster_20.line, cluster_20.textdot, cluster_22.line, cluster_22.textdot, cluster_27.line, cluster_27.textdot])  # disabled
data_58 = Data([cluster_26.line, cluster_26.textdot, cluster_21.line, cluster_21.textdot, cluster_28.line, cluster_28.textdot])  # disabled
data_59 = Data([cluster_29.line, cluster_29.textdot, cluster_30.line, cluster_30.textdot, cluster_31.line, cluster_31.textdot])  # disabled

custom_preview_13 = CustomPreview(Geometry=data_42, Material=flatten(cluster_6.tween_2))
custom_preview_14 = CustomPreview(Geometry=data_41, Material=cluster_6.tween)
custom_preview_15 = CustomPreview(Geometry=data_39, Material=cluster_6.tween_11)
custom_preview_16 = CustomPreview(Geometry=data_43, Material=cluster_6.tween_3)
custom_preview_17 = CustomPreview(Geometry=data_40, Material=cluster_6.tween_12)
custom_preview_18 = CustomPreview(Geometry=data_34, Material=cluster_6.tween_10)
custom_preview_19 = CustomPreview(Geometry=data_37, Material=cluster_6.tween_8)
custom_preview_20 = CustomPreview(Geometry=data_32, Material=cluster_6.tween_5)
custom_preview_21 = CustomPreview(Geometry=data_38, Material=cluster_6.tween_9)
custom_preview_22 = CustomPreview(Geometry=data_35, Material=cluster_6.tween_4)
custom_preview_23 = CustomPreview(Geometry=data_36, Material=cluster_6.tween_6)
custom_preview_24 = CustomPreview(Geometry=data_33, Material=cluster_6.tween_7)

merge_41 = Merge(Data1=data_56, Data2=data_57, Data3=data_58, Data4=data_59)  # disabled
entwine_3 = Entwine(Branch00=data_56, Branch01=data_57, Branch02=data_58, Branch03=data_59, FlattenInputs=True)  # disabled
entwine_4 = Entwine(
    Branch00=data_44,
    Branch01=data_45,
    Branch02=data_46,
    Branch03=data_48,
    Branch04=data_47,
    Branch05=data_49,
    Branch06=data_53,
    Branch07=data_54,
    Branch08=data_55,
    Branch09=data_50,
    Branch010=data_51,
    Branch011=data_52,
    FlattenInputs=True)
list_item_10 = ListItem(List=entwine_3, Index=series, Wrap=True)  # -> Item, Item1; disabled
list_item_11 = ListItem(List=entwine_4, Index=series_2, Wrap=True)  # -> Item, Item1
merge_42 = Merge(Data1=list_item_10.Item, Data2=list_item_10.Item1)  # disabled
merge_43 = Merge(Data1=list_item_11.Item, Data2=list_item_11.Item1)
custom_preview_25 = CustomPreview(Geometry=merge_42, Material=graft(colrange_3))  # disabled
custom_preview_26 = CustomPreview(Geometry=merge_43, Material=graft(colrange_2))

run_off_coeffecient = Panel("0.70")
subtraction_3 = Subtraction(A=mass_addition_12.Result, B=mass_addition_11.Result)
multiplication_28 = Multiplication(A=subtraction_3, B=max_rain_fail_in_one_hour_3, C=run_off_coeffecient)

addition_13 = Addition(A=multiplication_22, B=multiplication_28)
subtraction_4 = Subtraction(A=multiplication_23, B=addition_13)
mass_addition_20 = MassAddition(Input=flatten([addition_13, multiplication_10]))  # -> Result, PartialResults; disabled
mass_addition_21 = MassAddition(Input=flatten(multiplication_23))  # -> Result, PartialResults
mass_addition_22 = MassAddition(Input=subtraction_4)  # -> Result, PartialResults; disabled
mass_addition_23 = MassAddition(Input=flatten(subtraction_4))  # -> Result, PartialResults
merge_44 = Merge(Data1=mass_addition_20.Result, Data2=addition_4)  # disabled
subtraction_5 = Subtraction(A=mass_addition_21.Result, B=mass_addition_23.Result)
reduced_run_off_volume = Panel(mass_addition_22.Result)  # disabled
run_off_volume_built_and_non_built = Panel(merge_44)  # disabled
round_to_decimal_place_2 = RoundToDecimalPlace(NumberX=[subtraction_5, mass_addition_23.Result], DecimalPlace=2, RoundType=0)  # -> Rounded, Difference
data_60 = Data(round_to_decimal_place_2.Rounded)

set_chart_contents_7 = SetChartContents(ChartToModify=create_chart_4, NewChartValues=flatten(data_60), NewChartNames=panel_39)

set_chart_contents_8 = SetChartContents(ChartToModify=create_chart_8, NewChartValues=flatten(merge_44), NewChartNames=panel_59)  # disabled

mass_addition_24 = MassAddition(Input=flatten(subtraction_4))  # -> Result, PartialResults

division_9 = Division(A=multiplication_23, B=subtraction_4)

merge_45 = Merge(Data1=mass_addition_20.Result, Data2=addition_4)
mass_addition_25 = MassAddition(Input=merge_45)  # -> Result, PartialResults
addition_14 = Addition(A=mass_addition_25.Result, B=0)
estimated_total_runoff_volum_for_region_2 = Panel(mass_addition_25.Result)

round_to_decimal_place_3 = RoundToDecimalPlace(NumberX=addition_14, DecimalPlace=2, RoundType=0)  # -> Rounded, Difference; disabled
concatenate_25 = Concatenate(FragmentA=round_to_decimal_place_3.Rounded, FragmentB=panel_70)  # disabled
set_label_contents_6 = SetLabelContents(LabelToModify=create_label_29, NewLabelContents=concatenate_25)  # disabled

# ----
# Run off reduced percentage for each building
division_10 = Division(A=subtraction_4, B=multiplication_23)
multiplication_29 = Multiplication(A=division_10, B=100)

reduced_run_off_volume_2 = Panel(mass_addition_24.Result)
round_to_decimal_place_4 = RoundToDecimalPlace(NumberX=multiplication_29, DecimalPlace=2, RoundType=0)  # -> Rounded, Difference

set_chart_contents_9 = SetChartContents(ChartToModify=create_chart_5, NewChartValues=flatten(round_to_decimal_place_4.Rounded), NewChartNames=concatenate_10)

percentage_of_runoff_reduced = Panel(round_to_decimal_place_4.Rounded)

# ----
# Machine learning Deployment
total_region_area_3 = Panel("1100")
value_list_3 = ValueList({"EXTENSIVE MINERAL SUBSTRATE": 1, "EXTENSIVE MINERAL SUBSTRATE LIGHT": 2, "EXTENSIVE MINERAL SUBSTRATE": 3, "EXTENSIVE SUBSTRATE LIGHT": 4, "EXTENSIVE SUBSTRATE EXTRA LIGHT": 5, "INTENSIVE SUBSTRATE": 6, "EXTENSIVE SUBSTRATE EXTRA LIGHT": 7, "INTENSIVE SUBSTRATE EXTRA LIGHT": 8, "INTENSIVE PLANT SUBSTRATE": 9, "INTENSIVE PLANT SUBSTRATE TG": 10}, selected="EXTENSIVE MINERAL SUBSTRATE")
total_building_roof_area_3 = Panel("500")
max_rain_fall_in_one_hour_3 = Panel("0.065")
of_roof_area_as_green_2 = Panel("20")
percentage = Percentage(Number=total_building_roof_area_3, Percent=of_roof_area_as_green_2)
merge_46 = Merge(
    Data1=total_region_area_3,
    Data2=total_building_roof_area_3,
    Data3=percentage,
    Data4=of_roof_area_as_green_2,
    Data5=value_list_3,
    Data6=max_rain_fall_in_one_hour_3)

set_label_contents_7 = SetLabelContents(LabelToModify=create_label_27, NewLabelContents=percentage)

# ---- group: LINEAR REGRESSOR
python_3_script_3 = Python3Script(inputs=merge_46)  # -> out, a; inputs inputs: tree
# ---------- python_3_script_3: Python ----------
import sys
sys.path.append(r"C:\Users\Aly Mahmoud\AppData\Roaming\Python\Python312\site-packages")
import locale
locale.setlocale(locale.LC_ALL, 'en_US')

# r: xgboost, pandas, scikit-learn

import pickle
import pandas as pd
import numpy as np 
import ghpythonlib.treehelpers as ghth
import xgboost as xgb  # Import xgboost
import sklearn as sk

print("ok")

# Load tree as numpy array
X = np.asarray(ghth.tree_to_list(inputs))
print("Input shape", X.shape)
print("Input data:", X)

# Reshape X to ensure it is 2D with 5 features
X = X.reshape(1, -1)
print("Reshaped Input shape", X.shape)

# Handle None values (replace with 0, or mean, or any other strategy)
X = np.nan_to_num(X, nan=0.0)

# Check if X has 5 features
if X.shape[1] != 6:
    raise ValueError(f"X has {X.shape[1]} feature(s), but 5 features are expected. Please check your input data.")

# Load scaler
pathScaler = r"C:\Users\Aly Mahmoud\Downloads\Sscaler.pkl"
with open(pathScaler, 'rb') as file:
    Sscaler = pickle.load(file)

x_scaled = Sscaler.transform(X)

# Load xgboost regression model
pathModel = r"C:\Users\Aly Mahmoud\Downloads\regModel.pkl"
with open(pathModel, 'rb') as file:
    regModel = pickle.load(file)

# Ensure the model is an XGBoost model
if isinstance(regModel, xgb.XGBRegressor):
    predictions = regModel.predict(x_scaled)
else:
    raise TypeError("The loaded model is not an XGBoost regressor.")

# Compile DataFrame with 5 features
data = pd.DataFrame(X, columns=[f"Feature_{i+1}" for i in range(6)])
data["pred"] = predictions
print(data)

# # Save the DataFrame to a CSV file
# data.to_csv(r"C:\Users\FARIDA\Desktop\Thesis\trial.csv", index=False)

# Convert predictions back to tree structure
a = ghth.list_to_tree(predictions.tolist())
# ---------- end python_3_script_3 ----------

# ----
panel_106 = Panel(python_3_script_3.a)

# ==== cluster BoxTopSurface
brep = ClusterInput()
deconstruct_brep = DeconstructBrep(Brep=brep)  # -> Faces, Edges, Vertices
center = Center(Geometry=deconstruct_brep.Faces, referenceAll=0)  # -> Center, Dimension
deconstruct = Deconstruct(Point=center.Center)  # -> XComponent, YComponent, ZComponent
min_max = MinMax(Number=deconstruct.ZComponent)  # -> Minimum, Maximum
equality = Equality(FirstNumber=deconstruct.ZComponent, SecondNumber=min_max.Maximum)  # -> Equality, Inequality
panel = Panel(min_max.Maximum)
cull_pattern = CullPattern(List=deconstruct_brep.Faces, CullPattern=equality.Equality)
list = ClusterOutput(cull_pattern)

# ==== cluster BoxTopSurface_2
brep = ClusterInput()
deconstruct_brep = DeconstructBrep(Brep=brep)  # -> Faces, Edges, Vertices
center = Center(Geometry=deconstruct_brep.Faces, referenceAll=0)  # -> Center, Dimension
deconstruct = Deconstruct(Point=center.Center)  # -> XComponent, YComponent, ZComponent
min_max = MinMax(Number=deconstruct.ZComponent)  # -> Minimum, Maximum
equality = Equality(FirstNumber=deconstruct.ZComponent, SecondNumber=min_max.Maximum)  # -> Equality, Inequality
equality_2 = Equality(FirstNumber=deconstruct.ZComponent, SecondNumber=min_max.Minimum)  # -> Equality, Inequality
panel = Panel(min_max.Maximum)
gate_and = GateAnd(A=equality.Inequality, B=equality_2.Inequality)
cull_pattern = CullPattern(List=deconstruct_brep.Faces, CullPattern=gate_and)
list = ClusterOutput(cull_pattern)

# ==== cluster Cluster
brep = ClusterInput()
box_top_surface = BoxTopSurface_3(brep=brep)
center = Center(Geometry=flatten(box_top_surface))  # -> Center, Dimension
center_2 = Center(Geometry=flatten(box_top_surface), referenceAll=1)  # -> Center, Dimension
area = Area(Geometry=flatten(box_top_surface))  # -> Area, Centroid
deconstruct = Deconstruct(Point=center.Center)  # -> XComponent, YComponent, ZComponent
proximity_2d = Proximity2D(Points=center_2.Center, Plane=PlaneXY(0, 0, 0), Group=Slider(10, range=0..10))  # -> Links, Topology
number = Number(proximity_2d.Links)
mass_addition = MassAddition(Input=number)  # -> Result, PartialResults
normalizer = Normalizer(Numbers=flatten(mass_addition.Result), istree=True)
normalizer_2 = Normalizer(Numbers=deconstruct.ZComponent, istree=True)
normalizer_3 = Normalizer(Numbers=area.Area)
addition = Addition(A=normalizer_3, B=normalizer_2, C=normalizer)
bounds = Bounds(Numbers=addition)
deconstruct_domain = DeconstructDomain(Domain=bounds)  # -> Start, End
end = ClusterOutput(deconstruct_domain.End)
start = ClusterOutput(deconstruct_domain.Start)
result = ClusterOutput(addition)

# ==== cluster Cluster_2
brep = ClusterInput()
brep_wireframe = BrepWireframe(Brep=brep, Density=-1)
brep_2 = ClusterInput()
brep_wireframe_2 = BrepWireframe(Brep=brep_2, Density=-1)
join_curves = JoinCurves(Curves=brep_wireframe, Preserve=False)
list_item = ListItem(List=join_curves, Index=0, Wrap=True)
planar = Planar(Curve=list_item)  # -> Planar, Plane, Deviation
list_item_2 = ListItem(List=brep_wireframe_2, Index=0, Wrap=True)
i = ClusterOutput(list_item_2)
align_plane = AlignPlane(Plane=planar.Plane, Direction=list_item_2)  # -> Plane, Angle
plane = ClusterOutput(align_plane.Plane)

# ==== cluster Herbs
geometry = ClusterInput()
geometry_2 = Geometry(geometry)
count = ClusterInput()
populate_2d = Populate2D(Region=geometry_2, Count=count, Seed=1)
area = Area(Geometry=geometry_2)  # -> Area, Centroid
point_in_curve = PointInCurve(Point=populate_2d, Curve=geometry_2)  # -> Relationship, Point
equality = Equality(FirstNumber=point_in_curve.Relationship, SecondNumber=Slider(2, range=0..100))  # -> Equality, Inequality
cull_pattern = CullPattern(List=populate_2d, CullPattern=equality.Equality)
point = Point(cull_pattern)
cylinder = Cylinder(Base=point, Radius="0.01", Length="0.3")  # -> flatten(Cylinder)
populate_geometry = PopulateGeometry(Geometry=cylinder, Count=Slider(3, range=0..10), Seed=1)
circle = Circle(Plane=populate_geometry, Radius=Slider(0.05, range=0..0.1))
boundary_surfaces = BoundarySurfaces(Edges=circle)  # -> flatten(Surfaces)
unit_z = UnitZ(Factor=Slider(0.01, range=0..0.01))
extrude = Extrude(Base=boundary_surfaces, Direction=unit_z)
cap_holes = CapHoles(Brep=cylinder)
cap_holes_2 = CapHoles(Brep=extrude)
geometry_3 = Geometry([cap_holes, cap_holes_2])
geometry_4 = ClusterOutput(geometry_3)

# ==== cluster Cluster_3
colour_swatch = ColourSwatch(SwatchColor=RGB(38, 38, 38))
thickness = ClusterInput()
create_separator = CreateSeparator(Thickness=thickness, Horizontal=invert(True), Color=colour_swatch)
create_separator_2 = CreateSeparator(Thickness=thickness, Horizontal=invert(True), Color=colour_swatch)
create_separator_3 = CreateSeparator(Thickness=thickness, Horizontal=invert(True), Color=colour_swatch)
create_separator_4 = CreateSeparator(Thickness=thickness, Horizontal=invert(True), Color=colour_swatch)
create_separator_5 = CreateSeparator(Thickness=thickness, Horizontal=invert(True), Color=colour_swatch)
create_separator_6 = CreateSeparator(Thickness=thickness, Horizontal=invert(True), Color=colour_swatch)
create_separator_7 = CreateSeparator(Thickness=thickness, Horizontal=invert(True), Color=colour_swatch)
create_separator_8 = CreateSeparator(Thickness=thickness, Horizontal=invert(True), Color=colour_swatch)
separator = ClusterOutput(create_separator)
separator_2 = ClusterOutput(create_separator_2)
separator_3 = ClusterOutput(create_separator_3)
separator_4 = ClusterOutput(create_separator_4)
separator_5 = ClusterOutput(create_separator_5)
separator_6 = ClusterOutput(create_separator_6)
separator_7 = ClusterOutput(create_separator_7)
separator_8 = ClusterOutput(create_separator_8)

# ==== cluster Cluster_4
geometry = ClusterInput()
count = ClusterInput()
geometry_2 = Geometry(geometry)
populate_2d = Populate2D(Region=geometry_2, Count=count, Seed=1)
area = Area(Geometry=geometry_2)  # -> Area, Centroid
point_in_curve = PointInCurve(Point=populate_2d, Curve=geometry_2)  # -> Relationship, Point
equality = Equality(FirstNumber=point_in_curve.Relationship, SecondNumber=Slider(2, range=0..100))  # -> Equality, Inequality
cull_pattern = CullPattern(List=populate_2d, CullPattern=equality.Equality)
point = Point(cull_pattern)
panel = Panel("0.6")
circle = Circle(Plane=point, Radius="0.04")
area_2 = Area(Geometry=circle)  # -> Area, Centroid
unit_z = UnitZ(Factor=Slider(0.15, range=0..1))
curve_closest_point = CurveClosestPoint(Point=area_2.Centroid, Curve=geometry_2)  # -> Point, Parameter, Distance
smaller_than = SmallerThan(FirstNumber=curve_closest_point.Distance, SecondNumber="0.04")  # -> SmallerThan, OrEqualTo
cull_pattern_2 = CullPattern(List=circle, CullPattern=invert(smaller_than.SmallerThan))
curve = Curve(cull_pattern_2)
move = Move(Geometry=curve, Motion=unit_z)  # -> Geometry, Transform
circle_2 = Circle(Plane=move.Geometry, Radius=Slider(0.01, range=0..0.01))
merge = Merge(Data1=graft(curve), Data2=graft(circle_2))
loft = Loft(Curves=merge, Options={Adjust=False, Closed=False, LoftEnds=0, LoftSimp=0, LoftType=0, Rebuild=10, Refit=0.01})
panel_2 = Panel(merge)
loft_2 = ClusterOutput(loft)

# ==== cluster Cluster_5

# ---- group: Cluster Input
geometry = ClusterInput()

# ----
geometry_2 = Geometry(geometry)
number_slider = Slider(0.1, range=0..0.1)
area = Area(Geometry=geometry_2)  # -> Area, flatten(Centroid)
panel = Panel("0.1")
unit_z = UnitZ(Factor=Slider(0.9, range=0..10))
construct_domain = ConstructDomain(DomainStart=Slider(0.2, range=0..10), DomainEnd=Slider(0.6, range=0..10))
move = Move(Geometry=area.Centroid, Motion=unit_z)  # -> Geometry, Transform
list_length = ListLength(List=move.Geometry)
random = Random(Range=construct_domain, Number=list_length, Seed=2)
division = Division(A=random, B=2)
sphere = Sphere(Base=move.Geometry, Radius=random)
circle = Circle(Plane=area.Centroid, Radius=Slider(0.05, range=0..1))
extrude = Extrude(Base=circle, Direction=unit_z)

# ---- group: Cluster Output
extrusion = ClusterOutput([extrude, sphere])

# ==== cluster Cluster_6
geometry = ClusterInput()
geometry_2 = Geometry(geometry)
explode = Explode(Curve=geometry_2, Recursive=True)  # -> Segments, Vertices
cull_pattern = CullPattern(List=explode.Vertices, CullPattern=[False, True])
polyline = PolyLine(Vertices=cull_pattern, Closed=False)
point_on_curve = PointOnCurve(polyline, parameter=0.333)
point_on_curve_2 = PointOnCurve(polyline, parameter=0.667)
circle = Circle(Plane=[point_on_curve_2, point_on_curve], Radius="0.25")
area = Area(Geometry=circle)  # -> Area, Centroid
unit_z = UnitZ(Factor="0.4")
scale = Scale(Geometry=circle, Center=area.Centroid, Factor="0.6")  # -> Geometry, Transform
move = Move(Geometry=circle, Motion=unit_z)  # -> Geometry, Transform
unit_z_2 = UnitZ(Factor="0.8")
move_2 = Move(Geometry=scale.Geometry, Motion=unit_z_2)  # -> Geometry, Transform
number_slider = Slider(0.01, range=0..0.01)
area_2 = Area(Geometry=move_2.Geometry)  # -> Area, Centroid
scale_2 = Scale(Geometry=move_2.Geometry, Center=area_2.Centroid, Factor="0.3")  # -> Geometry, Transform
merge = Merge(Data1=graft(scale.Geometry), Data2=graft(move.Geometry), Data3=graft(scale_2.Geometry))
panel = Panel(scale.Geometry)
loft = Loft(Curves=merge, Options={Adjust=False, Closed=False, LoftEnds=0, LoftSimp=0, LoftType=0, Rebuild=10, Refit=0.01})
cap_holes = CapHoles(Brep=loft)
brep_join = BrepJoin(Breps=cap_holes)  # -> Breps, Closed

# ---- group: Cluster Output
breps = ClusterOutput(brep_join.Breps)

# ==== cluster Cluster_7
colour_swatch = ColourSwatch(SwatchColor=RGB(38, 38, 38))
thickness = ClusterInput()
create_separator = CreateSeparator(Thickness=thickness, Horizontal=True, Color=colour_swatch)
create_separator_2 = CreateSeparator(Thickness=thickness, Horizontal=True, Color=colour_swatch)
create_separator_3 = CreateSeparator(Thickness=thickness, Horizontal=True, Color=colour_swatch)
create_separator_4 = CreateSeparator(Thickness=thickness, Horizontal=True, Color=colour_swatch)
create_separator_5 = CreateSeparator(Thickness=thickness, Horizontal=True, Color=colour_swatch)
create_separator_6 = CreateSeparator(Thickness=thickness, Horizontal=True, Color=colour_swatch)
create_separator_7 = CreateSeparator(Thickness=thickness, Horizontal=True, Color=colour_swatch)
create_separator_8 = CreateSeparator(Thickness=thickness, Horizontal=True, Color=colour_swatch)
separator = ClusterOutput(create_separator)
separator_2 = ClusterOutput(create_separator_2)
separator_3 = ClusterOutput(create_separator_3)
separator_4 = ClusterOutput(create_separator_4)
separator_5 = ClusterOutput(create_separator_5)
separator_6 = ClusterOutput(create_separator_6)
separator_7 = ClusterOutput(create_separator_7)
separator_8 = ClusterOutput(create_separator_8)

# ==== cluster Cluster_8
length = ClusterInput()
unit_z = UnitZ(Factor=length)
geometry = ClusterInput()
move = Move(Geometry=geometry, Motion=unit_z)  # -> Geometry, Transform
point_groups = PointGroups(Points=flatten(move.Geometry), Distance=Slider(2, range=0..100))  # -> Groups, Indices
number_slider = Slider(8, range=0..10)
center = Center(Geometry=point_groups.Groups, forall=True)  # -> Center, Dimension
size = ClusterInput()
text = ClusterInput()
define_text_dot = DefineTextDot(Text=text, Location=center.Center, Font="Arial", Size=size)
line_sdl = LineSDL(Start=center.Center, Direction=Vector(0, 0, 1), Length=expr("-x", length))
textdot = ClusterOutput(define_text_dot)
line = ClusterOutput(line_sdl)

# ==== cluster BoxBottomSurface
brep = ClusterInput()
deconstruct_brep = DeconstructBrep(Brep=brep)  # -> Faces, Edges, Vertices
center = Center(Geometry=deconstruct_brep.Faces, referenceAll=0)  # -> Center, Dimension
deconstruct = Deconstruct(Point=center.Center)  # -> XComponent, YComponent, ZComponent
min_max = MinMax(Number=deconstruct.ZComponent)  # -> Minimum, Maximum
equality = Equality(FirstNumber=deconstruct.ZComponent, SecondNumber=min_max.Minimum)  # -> Equality, Inequality
panel = Panel(min_max.Maximum)
cull_pattern = CullPattern(List=deconstruct_brep.Faces, CullPattern=equality.Equality)
list = ClusterOutput(cull_pattern)

# ==== cluster Cluster_9
sddp = ShapeDiverDocumentPayload({AbsoluteTolerance=0, AngleTolerance=0, DistanceDisplayPrecision=0, GltfVersion="Gltf2", GrasshopperVersion="1.0.0008", InputGroups="{}", OutputGroups="{}", RelativeTolerance=0, RhinoVersion="8.11.24254.15001", UnitSystem=0, VersionCreated="1.20.0.0", VersionSaved="1.20.0.0"})
list = ClusterInput()
list_item = ListItem(List=list, Index=Slider(1000, range=0..1000), Wrap=True)
custom_preview = CustomPreview(Geometry=list_item, Material=ColourSwatch(SwatchColor=RGB(0, 50, 107)))
box_bottom_surface = BoxBottomSurface(brep=list_item)
box_top_surface = BoxTopSurface(brep=list_item)
center = Center(Geometry=box_bottom_surface)  # -> Center, Dimension
box_sides = BoxTopSurface_2(brep=list_item)
center_2 = Center(Geometry=box_top_surface)  # -> Center, Dimension
evaluate_surface = EvaluateSurface(Surface=reparameterize(box_bottom_surface), Point=center.Center)  # -> Point, Normal, UDirection, VDirection, Frame
center_3 = Center(Geometry=box_sides)  # -> Center, Dimension
evaluate_surface_2 = EvaluateSurface(Surface=box_top_surface, Point=center_2.Center)  # -> Point, Normal, UDirection, VDirection, Frame
evaluate_surface_3 = EvaluateSurface(Surface=reparameterize(box_sides), Point=center_3.Center)  # -> Point, Normal, UDirection, VDirection, Frame
move = Move(Geometry=box_bottom_surface, Motion=evaluate_surface.Normal)  # -> Geometry, Transform
move_2 = Move(Geometry=box_top_surface, Motion=evaluate_surface_2.Normal)  # -> Geometry, Transform
unit_z = UnitZ(Factor=Slider(0.71, range=0..1))
move_3 = Move(Geometry=box_sides, Motion=evaluate_surface_3.Normal)  # -> Geometry, Transform
center_4 = Center(Geometry=move.Geometry)  # -> Center, Dimension
center_5 = Center(Geometry=move_2.Geometry)  # -> Center, Dimension
extrude = Extrude(Base=move.Geometry, Direction=unit_z)
center_6 = Center(Geometry=move_3.Geometry)  # -> Center, Dimension
line_sdl = LineSDL(Start=center_4.Center, Direction=evaluate_surface.Normal, Length=Slider(0.55, range=0..1))
line_sdl_2 = LineSDL(Start=center_5.Center, Direction=evaluate_surface_2.Normal, Length=Slider(0.55, range=0..1))
line_sdl_3 = LineSDL(Start=center_6.Center, Direction=evaluate_surface_3.Normal, Length=Slider(1.48, range=0..2))
end_points = EndPoints(Curve=line_sdl)  # -> Start, End
end_points_2 = EndPoints(Curve=line_sdl_2)  # -> Start, End
end_points_3 = EndPoints(Curve=line_sdl_3)  # -> Start, End
define_text_dot = DefineTextDot(Text="Soil", Location=end_points.End, Font="Arial", Size=14)
custom_preview_2 = CustomPreview(Geometry=[extrude, define_text_dot], Material=ColourSwatch(SwatchColor=RGB(110, 67, 19)))
define_text_dot_2 = DefineTextDot(Text="Vegetation area", Location=end_points_2.End, Font="Arial", Size=14)
custom_preview_3 = CustomPreview(Geometry=[move_2.Geometry, define_text_dot_2], Material=ColourSwatch(SwatchColor=RGB(71, 153, 31)))
define_text_dot_3 = DefineTextDot(Text="Recycled Plastic", Location=end_points_3.End, Font="Arial", Size=14)
custom_preview_4 = CustomPreview(Geometry=[move_3.Geometry, define_text_dot_3], Material=ColourSwatch(SwatchColor=RGB(97, 97, 97)))

# ==== cluster Cluster_10
d1 = ClusterInput()
d2 = ClusterInput()
d3 = ClusterInput()
d4 = ClusterInput()
d1_2 = ClusterInput()
d2_2 = ClusterInput()
d3_2 = ClusterInput()
d4_2 = ClusterInput()
merge = Merge(Data1=d1, Data2=d2, Data3=d3, Data4=d4)
merge_2 = Merge(Data1=d1_2, Data2=d2_2, Data3=d3_2, Data4=d4_2)
base_plane = ClusterInput()
deconstruct_domain = DeconstructDomain(Domain=merge)  # -> Start, End
legendpar = LBLegendParameters(colors=merge_2, continuous_leg=Toggle(True), base_plane=base_plane)  # -> leg_par; plug-in component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
createlegend = LBCreateLegend(values=deconstruct_domain.End, legend_par=legendpar)  # -> mesh, title_obj, label_objs, label_text, colors; plug-in component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
label_objs = ClusterOutput(createlegend.label_objs)
mesh = ClusterOutput(createlegend.mesh)

# ==== cluster Cluster_12
colrange = LBColorRange(index=Slider(27, range=0..100))  # -> colors; plug-in component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
panel = Panel("""0
1
2
3""")
legendpar = LBLegendParameters(
    min=Slider(0, range=0..100),
    max=Slider(3, range=0..10),
    seg_count="4",
    colors=colrange,
    continuous_leg=Toggle(False),
    seg_height=Slider(5, range=0..100),
    seg_width=Slider(2, range=0..100))  # -> leg_par; plug-in component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
point = Point(<point referenced from the Rhino model>)
createlegend = LBCreateLegend(values=panel, base_plane=point, legend_par=legendpar)  # -> mesh, title_obj, label_objs, label_text, colors; plug-in component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
mesh = Mesh(createlegend.mesh)
mesh_explode = MeshExplode(Mesh=mesh, Interpolate=False)
unit_x = UnitX(Factor=Slider(8, range=0..10))
face_normals = FaceNormals(Mesh=mesh)  # -> Centers, Normals
mesh_naked_edges = MeshNakedEdges(Mesh=mesh_explode)  # -> flatten(Naked), ResultBoolean
move = Move(Geometry=face_normals.Centers, Motion=unit_x)  # -> Geometry, Transform
unit_x_2 = UnitX(Factor=Slider(8, range=0..10))
move_2 = Move(Geometry=mesh_naked_edges.Naked, Motion=unit_x_2)  # -> Geometry, Transform
line = Line(StartPoint=face_normals.Centers, EndPoint=move.Geometry)
panel_2 = Panel("""0.0  to 0.2 m
0.2  to 0.4 m
0.4  to 0.6 m
0.6  to 1.0 m""")
center = Center(Geometry=line)  # -> Center, Dimension
define_text_dot = DefineTextDot(Text=panel_2, Location=center.Center, Font="Arial", Size=14)
custom_preview = CustomPreview(Geometry=define_text_dot, Material=colrange)
list_item = ListItem(List=move_2.Geometry, Index=0, Wrap=True)  # -> Item, Item1, Item2, Item3
list_item_2 = ListItem(List=colrange, Index=0, Wrap=True)  # -> Item, Item1, Item2, Item3, Item4
list_item_3 = ListItem(List=move_2.Geometry, Index=0, Wrap=True)  # -> Item, Item1, Item2, Item3
list_item_4 = ListItem(List=colrange, Index=0, Wrap=True)  # -> Item, Item1, Item2, Item3, Item4
list_item_5 = ListItem(List=move_2.Geometry, Index=0, Wrap=True)  # -> Item, Item1, Item2, Item3
list_item_6 = ListItem(List=colrange, Index=0, Wrap=True)  # -> Item, Item1, Item2, Item3, Item4
list_item_7 = ListItem(List=move_2.Geometry, Index=0, Wrap=True)  # -> Item, Item1, Item2, Item3
list_item_8 = ListItem(List=colrange, Index=0, Wrap=True)  # -> Item, Item1, Item2, Item3, Item4
cluster = Cluster_11(
    surface_3=list_item.Item3,
    surface=list_item.Item3,
    surface_2=list_item.Item3,
    color_a_3=list_item_2.Item3,
    color_b_3=list_item_2.Item4,
    color_a_2=list_item_2.Item3,
    color_b_2=list_item_2.Item4,
    color_a=list_item_2.Item3,
    color_b=list_item_2.Item4)  # -> surface_6, surface_4, surface_5, tween_3, tween_2, tween
cluster_2 = Cluster_11(
    surface_3=list_item_3.Item,
    surface=list_item_3.Item,
    surface_2=list_item_3.Item,
    color_a_3=list_item_4.Item,
    color_b_3=list_item_4.Item1,
    color_a_2=list_item_4.Item,
    color_b_2=list_item_4.Item1,
    color_a=list_item_4.Item,
    color_b=list_item_4.Item1)  # -> surface_6, surface_4, surface_5, tween_3, tween_2, tween
cluster_3 = Cluster_11(
    surface_3=list_item_5.Item1,
    surface=list_item_5.Item1,
    surface_2=list_item_5.Item1,
    color_a_3=list_item_6.Item1,
    color_b_3=list_item_6.Item2,
    color_a_2=list_item_6.Item1,
    color_b_2=list_item_6.Item2,
    color_a=list_item_6.Item1,
    color_b=list_item_6.Item2)  # -> surface_6, surface_4, surface_5, tween_3, tween_2, tween
cluster_4 = Cluster_11(
    surface_3=list_item_7.Item2,
    surface=list_item_7.Item2,
    surface_2=list_item_7.Item2,
    color_a_3=list_item_8.Item2,
    color_b_3=list_item_8.Item3,
    color_a_2=list_item_8.Item2,
    color_b_2=list_item_8.Item3,
    color_a=list_item_8.Item2,
    color_b=list_item_8.Item3)  # -> surface_6, surface_4, surface_5, tween_3, tween_2, tween
tween = ClusterOutput(cluster.tween_3)
tween_2 = ClusterOutput(cluster.tween_2)
tween_3 = ClusterOutput(cluster.tween)
tween_4 = ClusterOutput(cluster_2.tween_3)
tween_5 = ClusterOutput(cluster_2.tween_2)
tween_6 = ClusterOutput(cluster_2.tween)
tween_7 = ClusterOutput(cluster_3.tween_3)
tween_8 = ClusterOutput(cluster_3.tween_2)
tween_9 = ClusterOutput(cluster_3.tween)
tween_10 = ClusterOutput(cluster_4.tween_3)
tween_11 = ClusterOutput(cluster_4.tween_2)
tween_12 = ClusterOutput(cluster_4.tween)

# ==== cluster Cluster_13
colrange = LBColorRange(index=Slider(27, range=0..100))  # -> colors; plug-in component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
panel = Panel("""0
1
2
3""")
legendpar = LBLegendParameters(
    min=Slider(0, range=0..100),
    max=Slider(3, range=0..10),
    seg_count="4",
    colors=colrange,
    continuous_leg=Toggle(False),
    seg_height=Slider(5, range=0..100),
    seg_width=Slider(2, range=0..100))  # -> leg_par; plug-in component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
point = Point(<point referenced from the Rhino model>)
createlegend = LBCreateLegend(values=panel, base_plane=point, legend_par=legendpar)  # -> mesh, title_obj, label_objs, label_text, colors; plug-in component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
unit_x = UnitX(Factor=Slider(8, range=0..10))
unit_x_2 = UnitX(Factor=Slider(8, range=0..10))
panel_2 = Panel("""0.0  to 0.2 m
0.2  to 0.4 m
0.4  to 0.6 m
0.6  to 1.0 m""")
mesh = Mesh(createlegend.mesh)
mesh_explode = MeshExplode(Mesh=mesh, Interpolate=False)
face_normals = FaceNormals(Mesh=mesh)  # -> Centers, Normals
mesh_naked_edges = MeshNakedEdges(Mesh=mesh_explode)  # -> flatten(Naked), ResultBoolean
move = Move(Geometry=face_normals.Centers, Motion=unit_x)  # -> Geometry, Transform
move_2 = Move(Geometry=mesh_naked_edges.Naked, Motion=unit_x_2)  # -> Geometry, Transform
line = Line(StartPoint=face_normals.Centers, EndPoint=move.Geometry)
center = Center(Geometry=line)  # -> Center, Dimension
define_text_dot = DefineTextDot(Text=panel_2, Location=center.Center, Font="Arial", Size=14)
line_2 = ClusterOutput(line)
mesh_2 = ClusterOutput(mesh)
colors = ClusterOutput(colrange)
custom_preview = CustomPreview(Geometry=define_text_dot, Material=colrange)
textdot = ClusterOutput(define_text_dot)
list_item = ListItem(List=move_2.Geometry, Index=0, Wrap=True)  # -> Item, Item1, Item2, Item3
list_item_2 = ListItem(List=colrange, Index=0, Wrap=True)  # -> Item, Item1, Item2, Item3, Item4
list_item_3 = ListItem(List=move_2.Geometry, Index=0, Wrap=True)  # -> Item, Item1, Item2, Item3
list_item_4 = ListItem(List=colrange, Index=0, Wrap=True)  # -> Item, Item1, Item2, Item3, Item4
list_item_5 = ListItem(List=move_2.Geometry, Index=0, Wrap=True)  # -> Item, Item1, Item2, Item3
list_item_6 = ListItem(List=colrange, Index=0, Wrap=True)  # -> Item, Item1, Item2, Item3, Item4
list_item_7 = ListItem(List=move_2.Geometry, Index=0, Wrap=True)  # -> Item, Item1, Item2, Item3
list_item_8 = ListItem(List=colrange, Index=0, Wrap=True)  # -> Item, Item1, Item2, Item3, Item4
cluster = Cluster_11(
    surface_3=list_item.Item3,
    surface=list_item.Item3,
    surface_2=list_item.Item3,
    color_a_3=list_item_2.Item3,
    color_b_3=list_item_2.Item4,
    color_a_2=list_item_2.Item3,
    color_b_2=list_item_2.Item4,
    color_a=list_item_2.Item3,
    color_b=list_item_2.Item4)  # -> surface_6, surface_4, surface_5, tween_3, tween_2, tween
cluster_2 = Cluster_11(
    surface_3=list_item_3.Item,
    surface=list_item_3.Item,
    surface_2=list_item_3.Item,
    color_a_3=list_item_4.Item,
    color_b_3=list_item_4.Item1,
    color_a_2=list_item_4.Item,
    color_b_2=list_item_4.Item1,
    color_a=list_item_4.Item,
    color_b=list_item_4.Item1)  # -> surface_6, surface_4, surface_5, tween_3, tween_2, tween
cluster_3 = Cluster_11(
    surface_3=list_item_5.Item1,
    surface=list_item_5.Item1,
    surface_2=list_item_5.Item1,
    color_a_3=list_item_6.Item1,
    color_b_3=list_item_6.Item2,
    color_a_2=list_item_6.Item1,
    color_b_2=list_item_6.Item2,
    color_a=list_item_6.Item1,
    color_b=list_item_6.Item2)  # -> surface_6, surface_4, surface_5, tween_3, tween_2, tween
cluster_4 = Cluster_11(
    surface_3=list_item_7.Item2,
    surface=list_item_7.Item2,
    surface_2=list_item_7.Item2,
    color_a_3=list_item_8.Item2,
    color_b_3=list_item_8.Item3,
    color_a_2=list_item_8.Item2,
    color_b_2=list_item_8.Item3,
    color_a=list_item_8.Item2,
    color_b=list_item_8.Item3)  # -> surface_6, surface_4, surface_5, tween_3, tween_2, tween
surface = ClusterOutput(cluster_2.surface_5)
surface_2 = ClusterOutput(cluster_2.surface_4)
surface_3 = ClusterOutput(cluster_2.surface_6)
surface_4 = ClusterOutput(cluster.surface_6)
surface_5 = ClusterOutput(cluster.surface_4)
surface_6 = ClusterOutput(cluster.surface_5)
surface_7 = ClusterOutput(cluster_3.surface_6)
surface_8 = ClusterOutput(cluster_3.surface_4)
surface_9 = ClusterOutput(cluster_3.surface_5)
surface_10 = ClusterOutput(cluster_4.surface_6)
surface_11 = ClusterOutput(cluster_4.surface_4)
surface_12 = ClusterOutput(cluster_4.surface_5)

# ==== cluster Cluster_14
cluster = Cluster_12()  # -> tween_4, tween_5, tween_6, tween_7, tween_8, tween_9, tween_10, tween_11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
geometry = ClusterInput()
geometry_2 = ClusterInput()
geometry_3 = ClusterInput()
geometry_4 = ClusterInput()
geometry_5 = ClusterInput()
geometry_6 = ClusterInput()
geometry_7 = ClusterInput()
geometry_8 = ClusterInput()
geometry_9 = ClusterInput()
geometry_10 = ClusterInput()
geometry_11 = ClusterInput()
geometry_12 = ClusterInput()

custom_preview = CustomPreview(Geometry=geometry, Material=cluster.tween_4)
custom_preview_2 = CustomPreview(Geometry=geometry_2, Material=cluster.tween_5)
custom_preview_3 = CustomPreview(Geometry=geometry_3, Material=cluster.tween_6)
custom_preview_4 = CustomPreview(Geometry=geometry_4, Material=cluster.tween_7)
custom_preview_5 = CustomPreview(Geometry=geometry_5, Material=cluster.tween_8)
custom_preview_6 = CustomPreview(Geometry=geometry_6, Material=cluster.tween_9)
custom_preview_7 = CustomPreview(Geometry=geometry_7, Material=cluster.tween_10)
custom_preview_8 = CustomPreview(Geometry=geometry_8, Material=cluster.tween_11)
custom_preview_9 = CustomPreview(Geometry=geometry_9, Material=cluster.tween_12)
custom_preview_10 = CustomPreview(Geometry=geometry_10, Material=cluster.tween)
custom_preview_11 = CustomPreview(Geometry=geometry_11, Material=cluster.tween_2)
custom_preview_12 = CustomPreview(Geometry=geometry_12, Material=cluster.tween_3)

# ==== cluster BoxTopSurface_3
brep = ClusterInput()
deconstruct_brep = DeconstructBrep(Brep=brep)  # -> Faces, Edges, Vertices
clean_tree = CleanTree(RemoveNulls=True, RemoveInvalid=True, RemoveEmpty=True, Tree=deconstruct_brep.Faces)
center = Center(Geometry=clean_tree, referenceAll=0)  # -> Center, Dimension
deconstruct = Deconstruct(Point=center.Center)  # -> XComponent, YComponent, ZComponent
min_max = MinMax(Number=deconstruct.ZComponent)  # -> Minimum, Maximum
equality = Equality(FirstNumber=deconstruct.ZComponent, SecondNumber=min_max.Maximum)  # -> Equality, Inequality
panel = Panel(min_max.Maximum)
cull_pattern = CullPattern(List=clean_tree, CullPattern=equality.Equality)
list = ClusterOutput(cull_pattern)

# ==== cluster Cluster_11
construct_domain² = ConstructDomain²(UMin=Slider(1, range=0..1), UMax=Slider(0, range=0..1), VMin=Slider(0.3, range=0..1), VMax=Slider(0.7, range=0..1))
construct_domain²_2 = ConstructDomain²(UMin=Slider(1, range=0..1), UMax=Slider(0, range=0..1), VMin=Slider(0, range=0..1), VMax=Slider(0.3, range=0..1))
construct_domain²_3 = ConstructDomain²(UMin=Slider(1, range=0..1), UMax=Slider(0, range=0..1), VMin=Slider(0.7, range=0..1), VMax=Slider(1, range=0..1))
color_a = ClusterInput()
color_b = ClusterInput()
color_a_2 = ClusterInput()
color_b_2 = ClusterInput()
color_a_3 = ClusterInput()
color_b_3 = ClusterInput()
surface = ClusterInput()
surface_2 = ClusterInput()
surface_3 = ClusterInput()
tween_two_colors = TweenTwoColors(ColorA=color_a, ColorB=color_b, Factor=Slider(0.1, range=0..1), Alpha=True)
tween_two_colors_2 = TweenTwoColors(ColorA=color_a_2, ColorB=color_b_2, Factor=0.5, Alpha=True)
tween_two_colors_3 = TweenTwoColors(ColorA=color_a_3, ColorB=color_b_3, Factor=Slider(0.9, range=0..1), Alpha=True)
isotrim = Isotrim(Surface=reparameterize(surface), Domain=construct_domain²)
isotrim_2 = Isotrim(Surface=reparameterize(surface_2), Domain=construct_domain²_3)
isotrim_3 = Isotrim(Surface=reparameterize(surface_3), Domain=construct_domain²_2)
tween = ClusterOutput(tween_two_colors)
tween_2 = ClusterOutput(tween_two_colors_2)
tween_3 = ClusterOutput(tween_two_colors_3)
surface_4 = ClusterOutput(isotrim)
surface_5 = ClusterOutput(isotrim_2)
surface_6 = ClusterOutput(isotrim_3)
